# Grasshopper definition data colleciton NN - test1.gh (Grasshopper 1.0.7)
# plug-ins: GHMQTT Info, Robots, Pufferfish, SurfaceTrails2, Firefly.Kinect.V1, Kangaroo2 Components, karambaGH

screen_width = Panel("640")
screen_heigth = Panel("480")
rectangle = Rectangle(Plane=PlaneXY(0, 0, 0), XSize=screen_width, YSize=screen_heigth, Radius=0)  # -> Rectangle, Length
xy = XYPlane(Origin=Point(0, 0, 0))
debrep = DeconstructBrep(Brep=rectangle.Rectangle)  # -> Faces, Edges, Vertices
item = ListItem(List=debrep.Vertices, Index=0, Wrap=True)  # -> Item, Item1, Item2, Item3
number_slider = Slider(20, range=0..100)
number_slider_2 = Slider(18, range=0..100)
aligndim = AlignedDimension(Plane=xy, PointA=item.Item3, PointB=item.Item2, Offset=number_slider, Text="Width :640", Size=number_slider_2)
aligndim_2 = AlignedDimension(Plane=xy, PointA=item.Item, PointB=item.Item3, Offset=number_slider, Text="Heigth :480", Size=number_slider_2)

# ----
# Wrist
# Wrist
panel = Panel("mqtt://test.mosquitto.org:1883/right/index")  # disabled
# Wrist
# Wrist
panel_2 = Panel("mqtt://localhost:1883/right/index")  # disabled
panel_3 = Panel("mqtt://test.mosquitto.org:1883/right/index")  # disabled
# Elbow angle
panel_4 = Panel("mqtt://localhost:1883/left/elbowangle")  # disabled
panel_5 = Panel("mqtt://localhost:1883/left/waist")  # disabled
# Shoulder
panel_6 = Panel("mqtt://localhost:1883/left/shoulder")  # disabled
# Elbow
panel_7 = Panel("mqtt://localhost:1883/left/elbow")  # disabled
# Wrist
# Wrist
panel_8 = Panel("mqtt://localhost:1883/left/wrist")  # disabled
panel_9 = Panel("mqtt://localhost:1883/left/wrist")  # disabled
panel_10 = Panel("mqtt://localhost:1883/left/shoulderangle")  # disabled
# Waist
trigger = Trigger(TimerInterval=5, Target=[mqtt_6, mqtt_5, mqtt_7, mqtt_8, mqtt_3, mqtt_4, mqtt_2, mqtt])  # disabled
number_slider_3 = Slider(100, range=0..100)  # disabled
number_slider_4 = Slider(1000, range=0..1000)  # disabled
mqtt = MQTT(BrokerURI=panel)  # -> Value, Payload; disabled
number_slider_5 = Slider(1350, range=0..10000)  # disabled
mqtt_2 = MQTT(BrokerURI=panel_3)  # -> Value, Payload; disabled
boolean_toggle = BooleanToggle(True)  # disabled
boolean_toggle_2 = BooleanToggle(False)  # disabled
mqtt_3 = MQTT(BrokerURI=panel_4)  # -> Value, Payload; disabled
mqtt_4 = MQTT(BrokerURI=panel_10)  # -> Value, Payload; disabled
mqtt_5 = MQTT(BrokerURI=panel_6)  # -> Value, Payload; disabled
mqtt_6 = MQTT(BrokerURI=panel_5)  # -> Value, Payload; disabled
mqtt_7 = MQTT(BrokerURI=panel_7)  # -> Value, Payload; disabled
mqtt_8 = MQTT(BrokerURI=panel_8)  # -> Value, Payload; disabled
mqtt_9 = MQTT(BrokerURI=panel_9)  # -> Value, Payload; disabled
number_slider_6 = Slider(0.65, range=0.25..0.65)  # disabled
number_slider_7 = Slider(0.5, range=0.3..0.5)  # disabled
panel_11 = Panel(mqtt.Value)  # disabled
panel_12 = Panel(",")  # disabled
panel_13 = Panel(mqtt.Payload)  # disabled
panel_14 = Panel(mqtt_2.Value)  # disabled
panel_15 = Panel(",")  # disabled
panel_16 = Panel(mqtt_2.Payload)  # disabled
panel_17 = Panel(mqtt_5.Value)  # disabled
panel_18 = Panel(",")  # disabled
panel_19 = Panel(mqtt_6.Value)  # disabled
panel_20 = Panel(",")  # disabled
panel_21 = Panel(mqtt_7.Value)  # disabled
panel_22 = Panel(",")  # disabled
panel_23 = Panel(mqtt_8.Value)  # disabled
panel_24 = Panel(",")  # disabled
panel_25 = Panel(mqtt_9.Payload)  # disabled
panel_26 = Panel(mqtt_3.Payload)  # disabled
panel_27 = Panel(mqtt_3.Value)  # disabled
panel_28 = Panel(mqtt_4.Value)  # disabled
split = TextSplit(Text=mqtt.Payload, Separators=panel_12)  # disabled
panel_29 = Panel(mqtt_4.Payload)  # disabled
split_2 = TextSplit(Text=mqtt_2.Payload, Separators=panel_15)  # disabled
kinect_v1_skeletal_tracker = KinectV1SkeletalTracker(
    StartSkeletonTracker=boolean_toggle,
    SkeletonScaleFactor=number_slider_5,
    TranslateInZAxis=boolean_toggle_2,
    TimerIntervalInMillisecondsForUpdatingEvents=5)  # -> Points, JointID, Bones; disabled
split_3 = TextSplit(Text=mqtt_5.Payload, Separators=panel_18)  # disabled
split_4 = TextSplit(Text=mqtt_6.Payload, Separators=panel_20)  # disabled
split_5 = TextSplit(Text=mqtt_7.Payload, Separators=panel_22)  # disabled
split_6 = TextSplit(Text=mqtt_8.Payload, Separators=panel_24)  # disabled

# ----
# Input Cell
rectangle_2 = Rectangle(Plane=PlaneXY(0, 0, 0), XSize=number_slider_7, YSize=number_slider_7, Radius=0)  # -> Rectangle, Length; disabled
box_rectangle = BoxRectangle(Rectangle=rectangle_2.Rectangle, Height=number_slider_6)  # disabled

data_recorder = DataRecorder(split, DataLimit=-10, RecordData=False)  # disabled
data_recorder_2 = DataRecorder(split_2, DataLimit=-10, RecordData=False)  # disabled
number_slider_8 = Slider(13, range=0..19)  # disabled
panel_30 = Panel(split_4)  # disabled
number_slider_9 = Slider(0.35, range=0..10)  # disabled
number_slider_10 = Slider(0.01, range=0..0.01)  # disabled
panel_31 = Panel(data_recorder)  # disabled
volume = Volume(Geometry=box_rectangle)  # -> Volume, Centroid; disabled
txt = Text(data_recorder)  # disabled
txt_2 = Text(split_4)  # disabled
txt_3 = Text(data_recorder_2)  # disabled
txt_4 = Text(split_3)  # disabled
txt_5 = Text(split_5)  # disabled
panel_32 = Panel("""x
y
z
:""")  # disabled
panel_33 = Panel(data_recorder_2)  # disabled
txt_6 = Text(split_6)  # disabled
panel_34 = Panel("""x
y
z
:""")  # disabled
panel_35 = Panel("""x
y
z
:""")  # disabled
panel_36 = Panel("""x
y
z
:""")  # disabled
list_item = ListItem(List=kinect_v1_skeletal_tracker.Bones, Index=number_slider_8, Wrap=True)  # disabled
panel_37 = Panel("""x
y
z
:""")  # disabled
panel_38 = Panel(txt)  # disabled
panel_39 = Panel("""x
y
z
:""")  # disabled
panel_40 = Panel(kinect_v1_skeletal_tracker.Points)  # disabled
panel_41 = Panel(kinect_v1_skeletal_tracker.JointID)  # disabled
split_7 = TextSplit(Text=data_recorder, Separators=panel_32)  # disabled
split_8 = TextSplit(Text=txt_2, Separators=panel_34)  # disabled
panel_42 = Panel(split_8)  # disabled
pipe = Pipe(Curve=kinect_v1_skeletal_tracker.Bones, Radius=number_slider_9, Caps=0)  # -> flatten(Pipe); disabled
number_slider_11 = Slider(7, range=0..19)  # disabled
split_9 = TextSplit(Text=txt_3, Separators=panel_35)  # disabled
split_10 = TextSplit(Text=txt_4, Separators=panel_36)  # disabled
split_11 = TextSplit(Text=txt_5, Separators=panel_37)  # disabled
split_12 = TextSplit(Text=txt_6, Separators=panel_39)  # disabled
num = Number(split_8)  # disabled
panel_43 = Panel(num)  # disabled
num_2 = Number(split_7)  # disabled
num_3 = Number(split_9)  # disabled
num_4 = Number(split_10)  # disabled
num_5 = Number(split_11)  # disabled
num_6 = Number(split_12)  # disabled
colour_swatch = ColourSwatch(SwatchColor=RGB(204, 255, 236))  # disabled
panel_44 = Panel(list_item)  # disabled
number_slider_12 = Slider(15, range=0..19)  # disabled
number_slider_13 = Slider(3, range=0..19)  # disabled
clean = CleanTree(RemoveNulls=True, RemoveInvalid=True, RemoveEmpty=False, Tree=num_2)  # disabled
clean_2 = CleanTree(RemoveNulls=True, RemoveInvalid=True, RemoveEmpty=False, Tree=num)  # disabled
panel_45 = Panel("([]")  # disabled

number_slider_14 = Slider(0.87, range=0.2..0.9)  # disabled
number_slider_15 = Slider(0.68, range=0.2..0.9)  # disabled
number_slider_16 = Slider(0.22, range=0.2..0.9)  # disabled
number_slider_17 = Slider(0.67, range=0.2..0.9)  # disabled

number_slider_18 = Slider(640, range=0..1000)  # disabled
number_slider_19 = Slider(0, range=0..100)  # disabled
number_slider_20 = Slider(480, range=0..1000)  # disabled
number_slider_21 = Slider(0, range=0..100)  # disabled

number_slider_22 = Slider(399, range=0..1000)  # disabled
number_slider_23 = Slider(580, range=0..1000)  # disabled

clean_3 = CleanTree(RemoveNulls=True, RemoveInvalid=True, RemoveEmpty=False, Tree=num_3)  # disabled
clean_4 = CleanTree(RemoveNulls=True, RemoveInvalid=True, RemoveEmpty=False, Tree=num_4)  # disabled
clean_5 = CleanTree(RemoveNulls=True, RemoveInvalid=True, RemoveEmpty=False, Tree=num_5)  # disabled
number_slider_24 = Slider(0.5, range=0.3..1)  # disabled
number_slider_25 = Slider(0.33, range=0.3..0.5)  # disabled
clean_6 = CleanTree(RemoveNulls=True, RemoveInvalid=True, RemoveEmpty=False, Tree=num_6)  # disabled
list_item_2 = ListItem(List=kinect_v1_skeletal_tracker.Points, Index=number_slider_11, Wrap=True)  # disabled
panel_46 = Panel(clean)  # disabled
split_13 = TextSplit(Separators=panel_45)  # disabled
item_2 = ListItem(List=clean, Index=0, Wrap=True)  # -> Item, Item1, Item2; disabled
item_3 = ListItem(List=clean_2, Index=0, Wrap=True)  # -> Item, Item1, Item2; disabled
panel_47 = Panel(split_13)  # disabled
point = Point()  # disabled
item_4 = ListItem(List=clean_3, Index=0, Wrap=True)  # -> Item, Item1, Item2; disabled
item_5 = ListItem(List=clean_4, Index=0, Wrap=True)  # -> Item, Item1, Item2; disabled
custom_preview = CustomPreview(Geometry=pipe, Material=colour_swatch)  # disabled
item_6 = ListItem(List=clean_5, Index=0, Wrap=True)  # -> Item, Item1, Item2; disabled
item_7 = ListItem(List=clean_6, Index=0, Wrap=True)  # -> Item, Item1, Item2; disabled
number_slider_26 = Slider(0, range=0..1)  # disabled
deconstruct = Deconstruct(Point=list_item_2)  # -> XComponent, YComponent, ZComponent; disabled
X = Number(item_2.Item)  # disabled
Y = Number(item_2.Item1)  # disabled
Z = Number(item_2.Item2)  # disabled
X_2 = Number(item_3.Item)  # disabled
Y_2 = Number(item_3.Item1)  # disabled
Z_2 = Number(item_3.Item2)  # disabled
list_item_3 = ListItem(List=kinect_v1_skeletal_tracker.Points, Index=number_slider_12, Wrap=True)  # disabled
list_item_4 = ListItem(List=kinect_v1_skeletal_tracker.Points, Index=number_slider_13, Wrap=True)  # disabled
X_3 = Number(item_4.Item)  # disabled
Y_3 = Number(item_4.Item1)  # disabled
Z_3 = Number(item_4.Item2)  # disabled
X_4 = Number(item_5.Item)  # disabled
Y_4 = Number(item_5.Item1)  # disabled
Z_4 = Number(item_5.Item2)  # disabled
X_5 = Number(item_6.Item)  # disabled
Y_5 = Number(item_6.Item1)  # disabled
Z_5 = Number(item_6.Item2)  # disabled
construct_domain = ConstructDomain(DomainStart=number_slider_19, DomainEnd=number_slider_18)  # disabled
construct_domain_2 = ConstructDomain(DomainStart=number_slider_21, DomainEnd=number_slider_20)  # disabled
X_6 = Number(item_7.Item)  # disabled
Y_6 = Number(item_7.Item1)  # disabled
Z_6 = Number(item_7.Item2)  # disabled
screen_width_2 = Panel("640")  # disabled
screen_heigth_2 = Panel("480")  # disabled
screen_width_3 = Panel("640")  # disabled
screen_heigth_3 = Panel("480")  # disabled

scale_nu = ScaleNU(Geometry=box_rectangle, Plane=volume.Centroid, ScaleX=number_slider_24, ScaleY=number_slider_24, ScaleZ=number_slider_25)  # -> Geometry, Transform; disabled
panel_48 = Panel("45")  # disabled
rotate = Rotate(Geometry=scale_nu.Geometry, Angle=degrees(panel_48), Plane=volume.Centroid)  # -> Geometry, Transform; disabled

number_slider_27 = Slider(5.9, range=0..10)  # disabled
line = Line(StartPoint=list_item_4, EndPoint=list_item_3)  # disabled
screen_heigth_4 = Panel("480")  # disabled
screen_width_4 = Panel("640")  # disabled
screen_heigth_5 = Panel("480")  # disabled
screen_width_5 = Panel("640")  # disabled
screen_width_6 = Panel("640")  # disabled
screen_heigth_6 = Panel("480")  # disabled
screen_width_7 = Panel("640")  # disabled
screen_heigth_7 = Panel("480")  # disabled
ghpython_script = GhPythonScript(LeftHand=list_item_2)  # -> hand; disabled
# ---------- ghpython_script: Python ----------
import rhinoscriptsyntax as rs
import scriptcontext as sc

if refresh:
    leftHand = getLeftHand()
    rightHand = getRightHand()

def getRightHand():
    hand = input[11]
    return hand
    
def getLeftHand():
    hand = input[7]
    return hand
# ---------- end ghpython_script ----------
range = Range(Domain=construct_domain, Steps=number_slider_18)  # disabled
range_2 = Range(Domain=construct_domain_2, Steps=number_slider_20)  # disabled
multiplication = Multiplication(A=screen_width_2, B=X)  # disabled
multiplication_2 = Multiplication(A=screen_heigth_2, B=Y)  # disabled
length = Length(Curve=line)  # disabled
multiplication_3 = Multiplication(A=screen_width_4, B=X_2)  # disabled
multiplication_4 = Multiplication(A=screen_heigth_5, B=Y_2)  # disabled
multiplication_5 = Multiplication(A=screen_width_3, B=X_3)  # disabled
multiplication_6 = Multiplication(A=screen_heigth_3, B=Y_3)  # disabled
multiplication_7 = Multiplication(A=screen_width_5, B=X_4)  # disabled
multiplication_8 = Multiplication(A=screen_heigth_4, B=Y_4)  # disabled
multiplication_9 = Multiplication(A=screen_width_6, B=X_5)  # disabled
multiplication_10 = Multiplication(A=screen_heigth_6, B=Y_5)  # disabled
multiplication_11 = Multiplication(A=screen_width_7, B=X_6)  # disabled
multiplication_12 = Multiplication(A=screen_heigth_7, B=Y_6)  # disabled
subtraction = Subtraction(A=screen_heigth_2, B=multiplication_2)  # disabled
subtraction_2 = Subtraction(A=screen_heigth_3, B=multiplication_6)  # disabled
multiplication_13 = Multiplication(A=deconstruct.XComponent, B=number_slider_27)  # disabled
multiplication_14 = Multiplication(A=deconstruct.YComponent, B=number_slider_27)  # disabled
multiplication_15 = Multiplication(A=deconstruct.ZComponent, B=number_slider_27)  # disabled
subtraction_3 = Subtraction(A=screen_heigth_4, B=multiplication_4)  # disabled
panel_49 = Panel(ghpython_script)  # disabled
cross_reference = CrossReference(ListListA=range, ListListB=range_2, CrossMode=1)  # -> ListListA, ListListB; disabled
subtraction_4 = Subtraction(A=screen_heigth_4, B=multiplication_8)  # disabled
subtraction_5 = Subtraction(A=screen_heigth_6, B=multiplication_10)  # disabled
subtraction_6 = Subtraction(A=screen_heigth_7, B=multiplication_12)  # disabled
panel_50 = Panel(multiplication)  # disabled
panel_51 = Panel("Wrist")  # disabled
pt = ConstructPoint(XCoordinate=multiplication, YCoordinate=subtraction, ZCoordinate=number_slider_26)  # disabled

brepexplode = BrepExplode(Brep=rotate.Geometry)  # -> BrepFaces, BrepEdges, flatten(BrepVertices); disabled

brepexplode_2 = BrepExplode(Brep=box_rectangle)  # -> BrepFaces, BrepEdges, flatten(BrepVertices); disabled

panel_52 = Panel("Wrist")  # disabled
pt_2 = ConstructPoint(XCoordinate=multiplication_5, YCoordinate=subtraction_2, ZCoordinate=number_slider_26)  # disabled
panel_53 = Panel(pt_2)  # disabled
panel_54 = Panel("Waist")  # disabled
panel_55 = Panel("Elbow")  # disabled
panel_56 = Panel("Wrist")  # disabled
panel_57 = Panel("Shoulder")  # disabled
pt_3 = ConstructPoint(XCoordinate=multiplication_3, YCoordinate=subtraction_3, ZCoordinate=number_slider_26)  # disabled
pt_4 = ConstructPoint(XCoordinate=multiplication_7, YCoordinate=subtraction_4, ZCoordinate=number_slider_26)  # disabled
pt_5 = ConstructPoint(XCoordinate=multiplication_9, YCoordinate=subtraction_5, ZCoordinate=number_slider_26)  # disabled
pt_6 = ConstructPoint(XCoordinate=multiplication_11, YCoordinate=subtraction_6, ZCoordinate=number_slider_26)  # disabled
panel_58 = Panel(multiplication_13)  # disabled
panel_59 = Panel(multiplication_14)  # disabled
panel_60 = Panel(multiplication_15)  # disabled
panel_61 = Panel(pt_6)  # disabled
merge = Merge(Data1=cross_reference.ListListA, Data2=cross_reference.ListListB)  # disabled
tag = TextTag3D(Location=pt, Text=panel_51, Size=10, Justification=7)  # disabled

deconstruct_2 = Deconstruct(Point=brepexplode.BrepVertices)  # -> XComponent, YComponent, ZComponent; disabled
bounds = Bounds(Numbers=deconstruct_2.ZComponent)  # disabled
deconstruct_domain = DeconstructDomain(Domain=bounds)  # -> Start, End; disabled
equality = Equality(FirstNumber=deconstruct_2.ZComponent, SecondNumber=deconstruct_domain.Start)  # -> Equality, Inequality; disabled
equality_2 = Equality(FirstNumber=deconstruct_2.ZComponent, SecondNumber=deconstruct_domain.End)  # -> Equality, Inequality; disabled
dispatch = Dispatch(List=brepexplode.BrepVertices, DispatchPattern=equality.Equality)  # -> ListA, ListB; disabled
dispatch_2 = Dispatch(List=brepexplode.BrepVertices, DispatchPattern=equality_2.Equality)  # -> ListA, ListB; disabled
point_2 = Point(dispatch.ListA)  # disabled
point_3 = Point(dispatch_2.ListA)  # disabled

deconstruct_3 = Deconstruct(Point=brepexplode_2.BrepVertices)  # -> XComponent, YComponent, ZComponent; disabled
bounds_2 = Bounds(Numbers=deconstruct_3.ZComponent)  # disabled
deconstruct_domain_2 = DeconstructDomain(Domain=bounds_2)  # -> Start, End; disabled
equality_3 = Equality(FirstNumber=deconstruct_3.ZComponent, SecondNumber=deconstruct_domain_2.Start)  # -> Equality, Inequality; disabled
equality_4 = Equality(FirstNumber=deconstruct_3.ZComponent, SecondNumber=deconstruct_domain_2.End)  # -> Equality, Inequality; disabled
dispatch_3 = Dispatch(List=brepexplode_2.BrepVertices, DispatchPattern=equality_3.Equality)  # -> ListA, ListB; disabled
dispatch_4 = Dispatch(List=brepexplode_2.BrepVertices, DispatchPattern=equality_4.Equality)  # -> ListA, ListB; disabled
point_4 = Point(dispatch_3.ListA)  # disabled
point_5 = Point(dispatch_4.ListA)  # disabled

tag_2 = TextTag3D(Location=pt_2, Text=panel_52, Size=10, Justification=7)  # disabled
tag_3 = TextTag3D(Location=pt_3, Text=panel_54, Size=10, Justification=7)  # disabled
tag_4 = TextTag3D(Location=pt_4, Text=panel_57, Size=10, Justification=7)  # disabled
tag_5 = TextTag3D(Location=pt_5, Text=panel_55, Size=10, Justification=7)  # disabled
tag_6 = TextTag3D(Location=pt_6, Text=panel_56, Size=10, Justification=7)  # disabled
panel_62 = Panel(cross_reference.ListListA)  # disabled
number_slider_28 = Slider(2, range=0..100)
number_slider_29 = Slider(759, range=0..1000)
point_6 = Point(pt)  # disabled
find_similar_member = FindSimilarMember(Data=cross_reference.ListListA)  # -> Hit, Index; disabled
point_7 = Point(pt_2)  # disabled
point_8 = Point(pt_6)  # disabled
number_slider_30 = Slider(309, range=0..1000)  # disabled
number_slider_31 = Slider(287, range=0..1000)  # disabled

panel_63 = Panel("1")  # disabled
circle = Circle(Plane=volume.Centroid, Radius=panel_63)  # disabled
rotate_2 = Rotate(Geometry=circle, Angle=degrees(number_slider_23), Plane=circle)  # -> Geometry, Transform; disabled

data_recorder_3 = DataRecorder(point_6, DataLimit=-10, RecordData=False)  # disabled

panel_64 = Panel("1")  # disabled
circle_2 = Circle(Plane=volume.Centroid, Radius=panel_64)  # disabled
rotate_3 = Rotate(Geometry=circle_2, Angle=degrees(number_slider_22), Plane=circle_2)  # -> Geometry, Transform; disabled

panel_65 = Panel("1")  # disabled
circle_3 = Circle(Plane=volume.Centroid, Radius=panel_65)  # disabled
rotate_4 = Rotate(Geometry=circle_3, Angle=degrees(number_slider_31), Plane=circle_3)  # -> Geometry, Transform; disabled

panel_66 = Panel("1")  # disabled
circle_4 = Circle(Plane=volume.Centroid, Radius=panel_66)  # disabled
rotate_5 = Rotate(Geometry=circle_4, Angle=degrees(number_slider_30), Plane=circle_4)  # -> Geometry, Transform; disabled

data_recorder_4 = DataRecorder(point_7, DataLimit=-10, RecordData=False)  # disabled
data_recorder_5 = DataRecorder(point_8, DataLimit=-10, RecordData=False)  # disabled
multiplication_16 = Multiplication(A=number_slider_28, B="4")
panel_67 = Panel(data_recorder_3)  # disabled
panel_68 = Panel(data_recorder_4)  # disabled
panel_69 = Panel(data_recorder_5)  # disabled
pline = PolyLine(Vertices=[pt_6, pt_5, pt_4, pt_3], Closed=False)  # disabled
dots = DotDisplay(Point=[pt_3, pt_4, pt_5, pt_6], Colour=RGB(0, 0, 0), Size=10)  # disabled

trigger_2 = Trigger(TimerInterval=10, Target=ghpython_script_3)  # disabled
reset_values = BooleanToggle(True)  # disabled
reset_file = BooleanToggle(False)  # disabled
ghpython_script_2 = GhPythonScript()  # -> out, a; disabled
# ---------- ghpython_script_2: Python ----------
__author__ = "shabe"
__version__ = "2021.04.27"

import rhinoscriptsyntax as rs


"""
p1 - 0.20 - 0.90
p2 - 0.20 - 0.90
p3 - 0.20 - 0.90
p4 - 0.20 - 0.90
p5 - (-30) - 30
p6 - (-30) - 30
p7 - 0.8 - 1.5
p8 - 0.5 - 1.5
"""
class vars():
    def __init__(self):

        self.ps = [0.2,0.2,0.2,0.2]
        self.min = [0.2,0.2,0.2,0.2]
        self.ds = [0.1,0.1,0.1,0.1]
        self.mx = [0.9,0.9,0.9,0.9]
    def Increment(self,i = 0,up = False):
        
        if i==len(self.ps)-1: #
            if self.ps[-1]==self.mx[-1]:
                self.ps = None
                return
            else:
                return
        if i==0:
            self.ps[0]+=self.ds[0]
            if self.ps[0]>self.mx[0]:
                self.ps[0] = self.min[0]
                up = True
            else:
                up = False
            self.Increment(i+1,up)
        else:
            if up==True:
                self.ps[i]+=self.ds[i]
                if self.ps[i]>self.mx[i]:
                    self.ps[i] = self.min[i]
                    up = True
                else:
                    up = False
                self.Increment(i+1,up)

a = vars
# ---------- end ghpython_script_2 ----------

ghpython_script_3 = GhPythonScript(vars=ghpython_script_2.a, Run=reset_values)  # -> out, p1, p2, p3, p4, allps, a; disabled
# ---------- ghpython_script_3: Python ----------
__author__ = "shabe"
__version__ = "2021.04.27"

import rhinoscriptsyntax as rs

if Run == True:
    locV.Increment()
    counter+=1
    a = counter
    p1 = locV.ps[0]
    p2 = locV.ps[1]
    p3 = locV.ps[2]
    p4 = locV.ps[3]
    allps = locV.ps
else:
    counter = 0
    locV = vars()
# ---------- end ghpython_script_3 ----------
multiplication_17 = Multiplication(A=ghpython_script_3.p1, B=ghpython_script_3.p2, C=ghpython_script_3.p3, D=ghpython_script_3.p4)  # disabled
multiplication_18 = Multiplication(A=multiplication_17, B="100")
integer = Integer(multiplication_18)
panel_70 = Panel(ghpython_script_3.a)
number_slider_32 = Slider(1.4, range=1.4..1.7)  # disabled

scale_nu_2 = ScaleNU(Geometry=point_4, Plane=rotate_3.Geometry, ScaleX=ghpython_script_3.p1, ScaleY=ghpython_script_3.p2, ScaleZ=1)  # -> Geometry, Transform; disabled
point_9 = Point(scale_nu_2.Geometry)  # disabled

scale_nu_3 = ScaleNU(Geometry=point_5, Plane=rotate_2.Geometry, ScaleX=ghpython_script_3.p3, ScaleY=ghpython_script_3.p4, ScaleZ=1)  # -> Geometry, Transform; disabled
point_10 = Point(scale_nu_3.Geometry)  # disabled

weave = Weave(Pattern=equality_3.Equality, Stream0=point_9, Stream1=point_10, NullGaps=False)  # disabled

# ---- group: Robot settings
list = ValueList({"AA-KR60", "AA-KR30", "AA-KR60_KR30", "AARCH IRB120", "AARCH IRB6620", "Bartlett-IRB120", "Bartlett-IRB1600", "Bartlett-KR6", "Bartlett-KR60", "Bartlett-UR10", "Bigli-KR20", "ETH-Gantry", "Grymsdyke-IRB120", "Grymsdyke-KR210", "iaac-KR150-2_110", "iaac-IRB140", "iaac-IRB120", "EXArchitects-IRB6700", "KULeuven-IRB120", "KULeuven-UR5", "KULeuven-UR10", "IRB4600-205", "UEL IRB6620", "uem-IRB120", "uem-IRB1600", "uem-IRB2600", "uem-IRB1600_IRB2600", "UniMelb-IRB120", "UniMelb-IRB1200"}, selected="iaac-IRB140")  # disabled
xy_2 = XYPlane(Origin=Point(0, 0, 0))  # disabled
load_robot = LoadRobotSystem(Name=list, Base=xy_2)  # disabled
speed = Panel("250")  # disabled
zone = Panel("10")  # disabled

# ----
gripper = Geometry(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)  # disabled

# ---- group: Outside Cut
point_11 = Point(<point referenced from the Rhino model>)  # disabled
brep = Brep(<brep referenced from the Rhino model>)  # disabled
xy_3 = XYPlane(Origin=point_11)  # disabled
mesh_brep = MeshBrep(
    Brep=brep,
    Settings={GridMaxCount=0, GridMinCount=16, JaggedSeams=False, MaxEdgeLength=0, MinEdgeLength=0.0001, MinTolerance=0, Refine=True, RefineAngle=0, RelativeTolerance=0.65, SimplePlanes=True, Tolerance=0})  # -> flatten(Mesh); disabled
panel_73 = Panel("WnC_gripper")  # disabled
pflip = FlipPlane(Plane=xy_3, ReverseX=False, ReverseY=False, SwapAxes=True)  # disabled
mesh = Mesh(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)  # disabled
tool = CreateTool(Name=panel_73, TCP=pflip, Weight=0, Mesh=mesh_brep)  # -> Tool, TCP; disabled

# ---- group: Start and Stop position
number_slider_33 = Slider(90, range=-90..90)  # disabled
elbow = Slider(0, range=-90..90)  # disabled
number_slider_34 = Slider(0, range=-90..90)  # disabled
number_slider_35 = Slider(0, range=-90..90)  # disabled
number_slider_36 = Slider(180, range=-180..180)  # disabled
shoulder = Slider(24, range=-90..90)  # disabled
merge_2 = Merge(
    Data1=number_slider_33,
    Data2=reverse(shoulder),
    Data3=reverse(elbow),
    Data4=number_slider_34,
    Data5=number_slider_35,
    Data6=number_slider_36)  # disabled
degtorad = DegreesToRadians(Degrees=merge_2, RobotSystem=load_robot, MechanicalGroup=0)  # disabled
target = CreateTarget(Joints=degtorad, Tool=tool.Tool, IsCartesian=False)  # disabled

# ----
mesh_2 = Mesh(gripper)  # disabled
swatch = ColourSwatch(SwatchColor=RGBA(30, 0, 36, 137))  # disabled
preview = CustomPreview(Geometry=mesh_2, Shader=swatch)  # disabled

number_slider_37 = Slider(6, range=0..10)  # disabled
point_12 = Point(<point referenced from the Rhino model>)  # disabled
point_13 = Point(pt_6)  # disabled
deconstruct_4 = Deconstruct(Point=point_13)  # -> XComponent, YComponent, ZComponent; disabled
panel_74 = Panel("0 to 640")  # disabled
panel_75 = Panel(" 0 to 1")  # disabled
panel_76 = Panel(" 0 to 1")  # disabled
panel_77 = Panel("0 to 480")  # disabled
remap_numbers = RemapNumbers(Value=deconstruct_4.XComponent, Source=panel_74, Target=panel_75)  # -> Mapped, Clipped; disabled
remap_numbers_2 = RemapNumbers(Value=deconstruct_4.YComponent, Source=panel_77, Target=panel_76)  # -> Mapped, Clipped; disabled
panel_78 = Panel(deconstruct_4.YComponent)  # disabled
negative = Negative(Value=remap_numbers_2.Mapped)  # disabled
panel_79 = Panel(remap_numbers.Mapped)  # disabled
construct_point = ConstructPoint(XCoordinate=panel_79, YCoordinate=remap_numbers_2.Mapped, ZCoordinate=0)  # disabled
surface = Surface(rectangle.Rectangle)  # disabled
curve = Curve(<curve referenced from the Rhino model>)  # disabled
surface_2 = Surface(curve)  # disabled
evaluate_surface = EvaluateSurface(Surface=reparameterize(surface))  # -> Point, Normal, UDirection, VDirection, Frame; disabled
evaluate_surface_2 = EvaluateSurface(Surface=reparameterize(surface_2), Point=construct_point)  # -> Point, Normal, UDirection, VDirection, Frame; disabled
point_14 = Point(<point referenced from the Rhino model>)  # disabled
point_15 = Point(<point referenced from the Rhino model>)  # disabled
point_16 = Point(<point referenced from the Rhino model>)  # disabled
point_17 = Point(<point referenced from the Rhino model>)  # disabled
point_18 = Point(evaluate_surface.Point)  # disabled
list_2 = ValueList({"Joint", "Linear"}, selected="Linear")  # disabled
list_3 = ValueList({"Joint", "Linear"}, selected="Joint")  # disabled
list_4 = ValueList({"Joint", "Linear"}, selected="Joint")  # disabled
list_5 = ValueList({"Joint", "Linear"}, selected="Joint")  # disabled
point_19 = Point(<point referenced from the Rhino model>)  # disabled
panel_80 = Panel("100")  # disabled
panel_81 = Panel("100")  # disabled
panel_82 = Panel("100")  # disabled
panel_83 = Panel("100")  # disabled
panel_84 = Panel("10")  # disabled
panel_85 = Panel("10")  # disabled
panel_86 = Panel("10")  # disabled
panel_87 = Panel("10")  # disabled
list_6 = ValueList({"Joint", "Linear"}, selected="Joint")  # disabled
target_2 = CreateTarget(Plane=point_15, Motion=list_3, Tool=tool.Tool, Speed=panel_81, Zone=panel_85, IsCartesian=True)  # disabled
target_3 = CreateTarget(Plane=point_16, Motion=list_4, Tool=tool.Tool, Speed=panel_82, Zone=panel_86, IsCartesian=True)  # disabled
target_4 = CreateTarget(Plane=point_14, Motion=list_2, Tool=tool.Tool, Speed=panel_80, Zone=panel_84, IsCartesian=True)  # disabled
target_5 = CreateTarget(Plane=point_17, Motion=list_5, Tool=tool.Tool, Speed=panel_83, Zone=panel_87, IsCartesian=True)  # disabled
panel_88 = Panel("100")  # disabled
target_6 = CreateTarget(Motion=list_6, Tool=tool.Tool, Speed=panel_88, Zone=panel_87, IsCartesian=True)  # disabled
merge_3 = Merge(Data1=flatten(target), Data2=target_6, Data3=flatten(target))  # disabled
number_slider_38 = Slider(0.501, range=0..1)  # disabled

# ----
# ROBOT SETUP
panel_89 = Panel("picknplace")  # disabled
program = CreateProgram(Name=panel_89, RobotSystem=load_robot, Targets1=flatten(merge_3), StepSize=1)  # -> Program, Code, Duration, Warnings, Errors; disabled
check_errors = Panel(program.Errors)  # disabled
to_export_code_file_prg = Panel(program.Code)  # disabled
sim = ProgramSimulation(Program=program.Program, Time=number_slider_38, Normalized=True)  # -> SystemMeshes, JointRotations, Plane, Index, Time, Program, Errors; disabled

collisions = CheckCollisions(Program=program.Program, FirstSet=7, SecondSet=4, EnvironmentPlane=-1, LinearStepSize=100, AngularStepSize=0.7853981634)  # -> CollisionFound, TargetIndex, CollidedMeshes; disabled
panel_90 = Panel("7")  # disabled
panel_91 = Panel(collisions.CollisionFound)  # disabled

panel_92 = Panel(sim.Index)  # disabled
time_seconds = Panel(sim.Time)  # disabled

# ---- group: Display simulation
trail = SimpleTrail(Program=sim.Program, Length=500, MechanicalGroup=0)  # disabled
swatch_2 = ColourSwatch(SwatchColor=RGB(255, 0, 0))  # disabled
preview_2 = CustomPreview(Geometry=trail, Shader=swatch_2)  # disabled

# ---- group: to export file
button = Button()  # disabled
txt_7 = Text(flatten(program.Code))  # disabled
path = FilePath("D:\\")  # disabled
file_name = Panel("WirenClay_08")  # disabled
python = GhPythonScript(program=txt_7, path=path, name=file_name, write=button)  # -> out, a; inputs program: list; disabled
# ---------- python: Python ----------
__author__ = "kunal"
__version__ = "2018.10.16"

import rhinoscriptsyntax as rs

if write:
    with open(path + name + '.prg', 'w') as file:
        for line in program:
            file.write(line)
            file.write('\n')
# ---------- end python ----------

# ----
panel_93 = Panel("1.1")  # disabled
# DISPLAY SETUP
split_14 = SplitList(List=sim.SystemMeshes, Index=panel_90)  # -> ListA, ListB; disabled
swatch_3 = ColourSwatch(SwatchColor=RGBA(30, 0, 36, 137))  # disabled
swatch_4 = ColourSwatch(SwatchColor=RGB(71, 71, 71))  # disabled

pedestal = Geometry(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)  # disabled
mesh_3 = Mesh(pedestal)  # disabled
preview_3 = CustomPreview(Geometry=mesh_3, Shader=swatch_4)  # disabled

preview_4 = CustomPreview(Geometry=split_14.ListB, Shader=swatch_4)  # disabled
preview_5 = CustomPreview(Geometry=split_14.ListA, Shader=swatch_3)  # disabled
panel_94 = Panel("4")  # disabled
panel_95 = Panel("4")  # disabled
number_slider_39 = Slider(0, range=0..100)  # disabled
panel_96 = Panel("0,0,1")  # disabled

trigger_3 = Trigger(TimerInterval=10, Target=ghpython_script_5)
reset_values_2 = BooleanToggle(True)
reset_file_2 = BooleanToggle(False)
ghpython_script_4 = GhPythonScript()  # -> out, a
# ---------- ghpython_script_4: Python ----------
__author__ = "shabe"
__version__ = "2021.04.27"

import rhinoscriptsyntax as rs


"""
p1 - 0 - 307199
p2 - 0 - 307199
"""
class vars():
    def __init__(self):

        self.ps = [0,0,0,0]
        self.min = [1,1,1,1]
        self.ds = [1,1,1,1]
        self.mx = [307199,307199,3071999,307199]
    def Increment(self,i = 0,up = False):
        
        if i==len(self.ps)-1: #
            if self.ps[-1]==self.mx[-1]:
                self.ps = None
                return
            else:
                return
        if i==0:
            self.ps[0]+=self.ds[0]
            if self.ps[0]>self.mx[0]:
                self.ps[0] = self.min[0]
                up = True
            else:
                up = False
            self.Increment(i+1,up)
        else:
            if up==True:
                self.ps[i]+=self.ds[i]
                if self.ps[i]>self.mx[i]:
                    self.ps[i] = self.min[i]
                    up = True
                else:
                    up = False
                self.Increment(i+1,up)

a = vars
# ---------- end ghpython_script_4 ----------

# ---- group: 2d grid - Hand
square = Square(Plane=PlaneXY(0, 0, 0), Size=1, ExtentX=screen_width, ExtentY=screen_heigth)  # -> Cells, Points
area = Area(Geometry=square.Cells)  # -> Area, flatten(Centroid)
panel_97 = Panel(area.Centroid)

# ----
reset_file_3 = BooleanToggle(True)

# ---- group: Base
xy_4 = XYPlane(Origin=Point(0, 0, 0))
mesh_with_camera_holder = Mesh(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)
pln = Plane(xy_4)

# ----
ghpython_script_5 = GhPythonScript(vars=ghpython_script_4.a, Run=reset_values_2)  # -> out, p1, p2, allps, a
# ---------- ghpython_script_5: Python ----------
__author__ = "shabe"
__version__ = "2021.04.27"

import rhinoscriptsyntax as rs

if Run == True:
    locV.Increment()
    counter+=1
    a = counter
    p1 = locV.ps[0]
    p2 = locV.ps[0]
    allps = locV.ps
else:
    counter = 0
    locV = vars()
# ---------- end ghpython_script_5 ----------
mesh_4 = Mesh([<mesh referenced from the Rhino model> x9])

# ---- group: Robot work area
curve_2 = Curve(<curve referenced from the Rhino model>)
divide_surface = DivideSurface(Surface=curve_2, UCount="639", VCount="479")  # -> flatten(Points), Normals, Parameters

# ----
number_slider_40 = Slider(0, range=0..0.1)  # disabled
panel_98 = Panel(ghpython_script_5.p2)
panel_99 = Panel(ghpython_script_5.a)
panel_100 = Panel(ghpython_script_5.p1)

# ---- group: Base
scale = Scale(Geometry=mesh_4, Center=Point(0, 0, 0), Factor=".001")  # -> Geometry, Transform
mesh_5 = Mesh(scale.Geometry)

# ----
number_slider_41 = Slider(0.4, range=0..1)  # disabled

# ---- group: Work area data collection
p2 = Slider(0, range=0..301799)
p1 = Slider(0, range=0..301799)

# ----
list_item_5 = ListItem(List=divide_surface.Points, Index=ghpython_script_5.p2, Wrap=True)
list_item_6 = ListItem(List=area.Centroid, Index=ghpython_script_5.p1, Wrap=True)
panel_101 = Panel(list_item_5)
panel_102 = Panel(list_item_6)

# ---- group: Robot setup
number_slider_42 = Slider(-360, range=-360..360)
list_7 = ValueList({"AA-KR60", "AA-KR30", "AA-KR60_KR30", "AARCH IRB120", "AARCH IRB6620", "AAU-Utzon-UR10", "Automata", "Bartlett-IRB120", "Bartlett-IRB1600", "Bartlett-KR6"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}, selected="KULeuven-UR10e")
xy_plane = XYPlane(Origin=Point(0, 0, 0))
load_robot_system = LoadRobotSystem(Name=list_7, Base=xy_plane)

# ---- group: Robot setup / Start and Stop position
merge_4 = Merge(
    Data1=Slider(0, range=-90..90),
    Data2=Slider(-90, range=-90..90),
    Data3=Slider(0, range=-90..90),
    Data4=Slider(0, range=-90..90),
    Data5=Slider(0, range=-90..90),
    Data6=Slider(0, range=-180..180))
degtorad_2 = DegreesToRadians(Degrees=merge_4, RobotSystem=load_robot_system, MechanicalGroup=0)
target_7 = CreateTarget(Joints=degtorad_2, IsCartesian=False)

# ----
flip_plane = FlipPlane(Plane=list_item_5, FlipX=False, FlipY=False, FlipZ=True)  # -> Flipped, ResultBoolean
rotate_plane = RotatePlane(Plane=flip_plane.Flipped, Angle=degrees(Slider(0, range=0..180)))
list_8 = ValueList({"Joint", "Linear"}, selected="Joint")
galapagos = Galapagos()
target_8 = CreateTarget(Plane=rotate_plane, Motion=list_8, Speed="50", Zone="10", IsCartesian=True)
merge_5 = Merge(Data1=target_7, Data2=target_8, Data3=target_7)
create_program = CreateProgram(Name="picknplace", RobotSystem=load_robot_system, Targets1=flatten(merge_5), StepSize=1)  # -> Program, Code, Duration, Warnings, Errors
panel_103 = Panel(create_program.Warnings)
program_simulation = ProgramSimulation(Program=create_program.Program, Time=Slider(0.6657, range=0..1), Normalized=True)  # -> SystemMeshes, JointRotations, Plane, Index, Time, Program, Errors
panel_104 = Panel(program_simulation.JointRotations)
panel_105 = Panel(divide_surface.Points)
list_item_7 = ListItem(List=program_simulation.JointRotations, Index=0, Wrap=True)  # -> Item, Item1, Item2, Item3, Item4, Item5
list_9 = ValueList({"AA-KR60", "AA-KR30", "AA-KR60_KR30", "AARCH IRB120", "AARCH IRB6620", "AAU-Utzon-UR10", "Automata", "Bartlett-IRB120", "Bartlett-IRB1600", "Bartlett-KR6"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}, selected="KULeuven-UR10e")
degrees = Degrees(Radians=list_item_7.Item2)
degrees_2 = Degrees(Radians=list_item_7.Item4)
degrees_3 = Degrees(Radians=list_item_7.Item3)
degrees_4 = Degrees(Radians=list_item_7.Item5)
degrees_5 = Degrees(Radians=list_item_7.Item1)
degrees_6 = Degrees(Radians=list_item_7.Item)
xy_plane_2 = XYPlane(Origin=Point(0, 0, 0))
merge_6 = Merge(Data1=degrees_6, Data2=degrees_5, Data3=degrees, Data4=degrees_3, Data5=degrees_2, Data6=degrees_4)
load_robot_system_2 = LoadRobotSystem(Name=list_9, Base=xy_plane_2)
panel_106 = Panel(merge_6)
degrees_to_radians = DegreesToRadians(Degrees=merge_6, RobotSystem=load_robot_system_2, MechanicalGroup=0)
target_9 = CreateTarget(Joints=degrees_to_radians, IsCartesian=False)
panel_107 = Panel(target_9)
create_program_2 = CreateProgram(Name="robot", RobotSystem=load_robot_system_2, Targets1=flatten(target_9), StepSize=1)  # -> Program, Code, Duration, Warnings, Errors
program_simulation_2 = ProgramSimulation(Program=create_program_2.Program, Time=0, Normalized=True)  # -> SystemMeshes, JointRotations, Plane, Index, Time, Program, Errors
merge_7 = Merge(Data1=list_item_6, Data2=list_item_5, Data3=program_simulation_2.JointRotations)  # -> flatten(Result)

merge_8 = Merge()  # disabled
file_path = FilePath("C:\Users\Arpan\Desktop\Software data collection - test1 (05.05.2021).csv")
ghpython_script_6 = GhPythonScript(reset=reset_file_3, path=file_path, measurements=merge_7, exterior=ghpython_script_5.allps)  # -> out, a; inputs measurements: list, exterior: list
# ---------- ghpython_script_6: Python ----------
__author__ = "shabe"
__version__ = "2021.04.27"

import rhinoscriptsyntax as rs

if reset:
    f = open(path,'w')
    f.close()
else:
    st2 = map(str,measurements)
    st3 = map(str,exterior)
    dLine = (',').join(st2+st3)
    with open(path,'a') as fname:
        fname.write(dLine)
        fname.write('\n')
# ---------- end ghpython_script_6 ----------

panel_108 = Panel(ghpython_script_6.out)
# Hand area coordinates
# Robot area coordinates
# Robot joint angle in radian
# Robot joint angle in radian
# Robot joint angle in radian
# Robot joint angle in radian
# Robot joint angle in radian
# Robot joint angle in radian
panel_109 = Panel(merge_7)

# ----
# Generate Multiple parameters hier
number_of_different_solutions = Slider(10, range=0..10)
random = Random(Range=Domain(0, 1), Number=multiplication_16, Seed=integer)

partition_list = PartitionList(List=random, Size="4")

remap_numbers_3 = RemapNumbers(Value=partition_list, Source=Domain(0, 1), Target="0.80 To 0.95")  # -> Mapped, Clipped
list_item_8 = ListItem(List=remap_numbers_3.Mapped, Index=0, Wrap=True)  # -> Item, Item1, Item2, Item3

panel_110 = Panel(random)
panel_111 = Panel(list_item_8.Item3)  # disabled

scale_nu_4 = ScaleNU(Geometry=point_2, Plane=rotate_5.Geometry, ScaleX=list_item_8.Item, ScaleY=list_item_8.Item1, ScaleZ=number_slider_32)  # -> Geometry, Transform; disabled
point_20 = Point(scale_nu_4.Geometry)  # disabled

scale_nu_5 = ScaleNU(Geometry=point_3, Plane=rotate_4.Geometry, ScaleX=list_item_8.Item2, ScaleY=list_item_8.Item3, ScaleZ=number_slider_32)  # -> Geometry, Transform; disabled
point_21 = Point(scale_nu_5.Geometry)  # disabled

weave_2 = Weave(Pattern=equality.Equality, Stream0=point_20, Stream1=point_21, NullGaps=False)  # disabled

# ---- group: useless stuff
rectanguloid = Geometry(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)  # disabled
rectanguloid_2 = Geometry(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)  # disabled
team_dirt_01 = Geometry(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)  # disabled
gripper_point = Point(Point(575, -3.995, 254.9843858))  # disabled
swatch_5 = ColourSwatch(SwatchColor=RGBA(145, 145, 145, 88))  # disabled
swatch_6 = ColourSwatch(SwatchColor=RGBA(117, 117, 117, 88))  # disabled
number_slider_43 = Slider(17, range=0..100)  # disabled
panel_112 = Panel("0.01 to 0.99")  # disabled
number_slider_44 = Slider(0.5, range=0..1)  # disabled
range_3 = Range(Domain=panel_112, Steps=number_slider_43)  # disabled
pt_7 = ConstructPoint(XCoordinate=range_3, YCoordinate=number_slider_44, ZCoordinate=0)  # disabled
number_slider_45 = Slider(0, range=0..1)  # disabled
number_slider_46 = Slider(322, range=0..1000)  # disabled
panel_113 = Panel("-1")  # disabled
Z_7 = UnitZ(Factor=number_slider_46)  # disabled
number_slider_47 = Slider(100, range=0..100)  # disabled
number_slider_48 = Slider(100, range=0..100)  # disabled
Z_8 = UnitZ(Factor=number_slider_47)  # disabled
list_10 = ValueList({"Joint", "Linear"}, selected="Joint")  # disabled
list_11 = ValueList({"Joint", "Linear"}, selected="Linear")  # disabled
list_12 = ValueList({"Joint", "Linear"}, selected="Joint")  # disabled
list_13 = ValueList({"Joint", "Linear"}, selected="Joint")  # disabled
panel_114 = Panel("100")  # disabled
panel_115 = Panel("10")  # disabled
panel_116 = Panel("100")  # disabled
panel_117 = Panel("100")  # disabled
panel_118 = Panel("10")  # disabled
panel_119 = Panel("10")  # disabled

cylinder = Geometry(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)  # disabled
bbox = BoundingBox(Content=cylinder, Plane=PlaneXY(0, 0, 0), UnionBox=True)  # -> Box, Box_2; disabled
debrep_2 = DeconstructBrep(Brep=bbox.Box)  # -> Faces, Edges, Vertices; disabled
item_8 = ListItem(List=reverse(debrep_2.Faces), Index=0, Wrap=True)  # -> Item, Item1, Item2; disabled
area_2 = Area(Geometry=item_8.Item)  # -> Area, Centroid; disabled
area_3 = Area(Geometry=item_8.Item1)  # -> Area, Centroid; disabled
ln = Line(StartPoint=area_2.Centroid, EndPoint=area_3.Centroid)  # -> reverse(Line); disabled
curvepoint = PointOnCurve(ln, parameter=1)  # disabled
orient = Orient(Geometry=cylinder, Source=curvepoint, Target=gripper_point)  # -> Geometry, Transform; disabled

bbox_2 = BoundingBox(Content=team_dirt_01, Plane=PlaneXY(0, 0, 0), UnionBox=True)  # -> Box, Box_2; disabled
debrep_3 = DeconstructBrep(Brep=bbox_2.Box)  # -> Faces, Edges, Vertices; disabled
item_9 = ListItem(List=reverse(debrep_3.Faces), Index=0, Wrap=True)  # -> Item, Item1, Item2; disabled
area_4 = Area(Geometry=item_9.Item)  # -> Area, Centroid; disabled
area_5 = Area(Geometry=item_9.Item1)  # -> Area, Centroid; disabled
ln_2 = Line(StartPoint=area_4.Centroid, EndPoint=area_5.Centroid)  # -> reverse(Line); disabled
curvepoint_2 = PointOnCurve(ln_2, parameter=0.641)  # disabled
orient_2 = Orient(Geometry=team_dirt_01, Source=curvepoint_2, Target=PlaneXY(0, 0, 0))  # -> Geometry, Transform; disabled

preview_6 = CustomPreview(Geometry=orient.Geometry, Material=swatch_5)  # disabled
preview_7 = CustomPreview(Geometry=orient_2.Geometry, Material=swatch_6)  # disabled
brep_2 = Brep(orient_2.Geometry)  # disabled
debrep_4 = DeconstructBrep(Brep=brep_2)  # -> Faces, Edges, Vertices; disabled
item_10 = ListItem(List=debrep_4.Edges, Index=0, Wrap=True)  # -> Item, Item1; disabled
flip = FlipCurve(Curve=item_10.Item1)  # -> Curve, Flag; disabled
rulesrf = RuledSurface(CurveA=item_10.Item, CurveB=flip.Curve)  # disabled
evalsrf = EvaluateSurface(Surface=reparameterize(rulesrf), Point=pt_7)  # -> Point, Normal, UDirection, VDirection, Frame; disabled
rotate_6 = Rotate(Geometry=evalsrf.Frame, Angle=1.570796327, Plane=evalsrf.Frame)  # -> Geometry, Transform; disabled
deplane = DeconstructPlane(Plane=rotate_6.Geometry)  # -> Origin, XAxis, YAxis, ZAxis; disabled
rev = Reverse(Vector=deplane.ZAxis)  # disabled
devec = DeconstructVector(Vector=rev)  # -> XComponent, YComponent, ZComponent; disabled
vec = VectorXYZ(XComponent=devec.XComponent, YComponent=devec.YComponent, ZComponent=number_slider_45)  # -> Vector, Length; disabled
padjust = AdjustPlane(Plane=rotate_6.Geometry, Normal=vec.Vector)  # disabled
rev_2 = ReverseList(List=padjust)  # disabled
item_11 = ListItem(List=rev_2, Index=panel_113, Wrap=True)  # disabled
item_12 = ListItem(List=rev_2, Index=0, Wrap=True)  # disabled
move = Move(Geometry=item_11, Motion=Z_7)  # -> Geometry, Transform; disabled
deplane_2 = DeconstructPlane(Plane=move.Geometry)  # -> Origin, XAxis, YAxis, ZAxis; disabled
amp = Amplitude(Vector=deplane_2.ZAxis, Amplitude=number_slider_48)  # disabled
move_2 = Move(Geometry=item_12, Motion=Z_8)  # -> Geometry, Transform; disabled
move_3 = Move(Geometry=move.Geometry, Motion=amp)  # -> Geometry, Transform; disabled
target_10 = CreateTarget(Plane=rev_2, Motion=list_11, Tool=tool.Tool, Speed=panel_116, Zone=panel_118, IsCartesian=True)  # disabled
target_11 = CreateTarget(Plane=move_3.Geometry, Motion=list_12, Tool=tool.Tool, Speed=panel_117, Zone=panel_119, IsCartesian=True)  # disabled
target_12 = CreateTarget(Plane=move_2.Geometry, Motion=list_10, Tool=tool.Tool, Speed=panel_114, Zone=panel_115, IsCartesian=True)  # disabled
merge_9 = Merge(
    Data1=flatten(target),
    Data2=flatten(target_12),
    Data3=flatten(target_10),
    Data4=flatten(target_11),
    Data6=flatten(target))  # disabled

# ----
merge_10 = Merge(Data1=list_item_8.Item, Data2=list_item_8.Item1, Data3=list_item_8.Item2, Data4=list_item_8.Item3)  # disabled
file_path_2 = FilePath("D:\Arpan\Personal\IAAC\3rd Semester\Workshop 3.1\Group work\Day 04\Final_2.csv")  # disabled

panel_120 = Panel(merge_10)

panel_121 = Panel("4")  # disabled
partition_list_2 = PartitionList(List=weave_2, Size=panel_121)  # disabled
list_item_9 = ListItem(List=partition_list_2, Index=0, Wrap=True)  # -> Item, Item1, Item2, Item3; disabled
_4point_surface = _4PointSurface(CornerA=list_item_9.Item, CornerB=list_item_9.Item1, CornerC=list_item_9.Item3, CornerD=list_item_9.Item2)  # disabled
_4point_surface_2 = _4PointSurface(CornerA=list_item_9.Item, CornerB=list_item_9.Item1, CornerC=list_item_9.Item2, CornerD=list_item_9.Item3)  # disabled
panel_122 = Panel("-1")  # disabled
panel_123 = Panel("-2")  # disabled

trim_tree = TrimTree(Tree=_4point_surface, Depth=1)  # disabled
trim_tree_2 = TrimTree(Tree=_4point_surface_2, Depth=1)  # disabled

# ---- group: Robot Table display
abb_table_iaac = Geometry(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)  # disabled
swatch_7 = ColourSwatch(SwatchColor=RGBA(255, 255, 255, 9))  # disabled

# ----
mesh_6 = Mesh(abb_table_iaac)  # disabled

# ---- group: Robot Table display (continued)
preview_8 = CustomPreview(Geometry=mesh_6, Shader=swatch_7)  # disabled

# ----
panel_124 = Panel("4")  # disabled
partition_list_3 = PartitionList(List=weave, Size=panel_124)  # disabled
list_item_10 = ListItem(List=partition_list_3, Index=0, Wrap=True)  # -> Item, Item1, Item2, Item3; disabled
_4point_surface_3 = _4PointSurface(CornerA=list_item_10.Item, CornerB=list_item_10.Item1, CornerC=list_item_10.Item2, CornerD=list_item_10.Item3)  # disabled
_4point_surface_4 = _4PointSurface(CornerA=list_item_10.Item, CornerB=list_item_10.Item1, CornerC=list_item_10.Item3, CornerD=list_item_10.Item2)  # disabled
panel_125 = Panel("-1")  # disabled
panel_126 = Panel("-2")  # disabled

trim_tree_3 = TrimTree(Tree=_4point_surface_4, Depth=1)  # disabled
trim_tree_4 = TrimTree(Tree=_4point_surface_3, Depth=1)  # disabled

list_item_11 = ListItem(List=trim_tree_4, Index=0, Wrap=True)  # -> Item, Item1, Item2, Item3, Item4, Item5; disabled
cull_index = CullIndex(List=trim_tree_3, Indices=[panel_126, panel_125], Wrap=True)  # disabled
merge_11 = Merge(Data1=flatten(cull_index), Data2=list_item_11.Item5, Data3=list_item_11.Item4)  # disabled
brep_join = BrepJoin(Breps=merge_11)  # -> Breps, Closed; disabled

brep_3 = Brep(brep_join.Breps)  # disabled
panel_127 = Panel("0,0,1")  # disabled
panel_128 = Panel("0,1,0")  # disabled
panel_129 = Panel("90")  # disabled
rotate_3d = Rotate3D(Geometry=brep_3, Angle=degrees(panel_129), Center=panel_127, Axis=panel_128)  # -> Geometry, Transform; disabled

# ----
# KARAMBA BOUNDING BOX
deconstruct_brep = DeconstructBrep(Brep=rotate_3d.Geometry)  # -> Faces, Edges, Vertices; disabled
number_slider_49 = Slider(0.4, range=0..1)  # disabled
removeduplicatelines = RemoveDuplicateLines(Lines=flatten(deconstruct_brep.Edges), Tolerance=0.01)  # disabled
list_item_12 = ListItem(List=deconstruct_brep.Vertices, Index=0, Wrap=True)  # -> Item, Item1, Item2, Item3, Item4, Item5, Item6, Item7; disabled
point_22 = Point([list_item_12.Item2, list_item_12.Item1, list_item_12.Item4, list_item_12.Item5])  # disabled
cross_section_karamba3d = CrossSectionKaramba3D(
    FamilyNameOfCrossSection="DefaultCroSec",
    Material=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,
    Diameter_cm=number_slider_49,
    WallThickness_cm=expr("x/2", number_slider_49),
    mode="Circular Hollow")  # disabled
material_selection_karamba3d = MaterialSelectionKaramba3D(menu=[dropdown(0), dropdown(1)])  # disabled
line_to_beam_karamba3d = LineToBeamKaramba3D(Line=removeduplicatelines, New=True, Remove=True, LimitDistance_m=0.005)  # -> Element, Points, Info; disabled
loads_karamba3d = LoadsKaramba3D(Vector=Vector(0, 0, -1), mode="Gravity")  # disabled
support_karamba3d = SupportKaramba3D(PosInd=point_22, menu=[buttons(on, on, on, on, on, off)])  # disabled
assemble_model_karamba3d = AssembleModelKaramba3D(
    Elem=line_to_beam_karamba3d.Element,
    Support=support_karamba3d,
    Load=loads_karamba3d,
    CrossSection=cross_section_karamba3d,
    Material=material_selection_karamba3d,
    LimitDistance_m=0.005)  # -> Model, Info, Mass_kg, CenterOfGravity; disabled
analyze_karamba3d = AnalyzeKaramba3D(Model=assemble_model_karamba3d.Model)  # -> CalculatedModel, MaximumDisplacement_cm, ResultingForceOfGravity_kN, ElasticEnergy_kNm; disabled
beam_forces_karamba3d = BeamForcesKaramba3D(
    AnalyzedModel=analyze_karamba3d.CalculatedModel,
    LoadCase="-1",
    MaximumDistanceBetweenResults_m=-1,
    NumberOfResultsPerBeamElement=2)  # -> AnalyzedModel, NormalForce_kN, ShearForceVz_kN, ShearForceVy_kN, BendingMomentMt_kNm, BendingMomentMy_kNm, BendingMomentMz_kNm; disabled
displacement_cm = Panel(analyze_karamba3d.MaximumDisplacement_cm)  # disabled
beam_view_karamba3d = BeamViewKaramba3D(Model=beam_forces_karamba3d.AnalyzedModel)  # -> Model, MeshesOfRenderedBeams, DeformedBeamAxes, LegendColors, LegendTags; disabled
displacement_cm_2 = Panel(beam_forces_karamba3d.NormalForce_kN)  # disabled
displacement_cm_3 = Panel(beam_forces_karamba3d.BendingMomentMy_kNm)  # disabled
legend = Legend(Colour=beam_view_karamba3d.LegendColors, Tags=beam_view_karamba3d.LegendTags, LegendType=1)  # disabled
list_item_13 = ListItem(List=displacement_cm_2, Index=0, Wrap=True)  # -> flatten(Item); disabled
list_item_14 = ListItem(List=displacement_cm_3, Index=0, Wrap=True)  # -> flatten(Item); disabled
data = Data(list_item_14)  # disabled
data_2 = Data(list_item_13)  # disabled

# ---- group: measurements
panel_130 = Panel(".5,.5,.5")  # disabled
deconstruct_brep_2 = DeconstructBrep(Brep=list_item_11.Item4)  # -> Faces, Edges, Vertices; disabled
evaluate_surface_3 = EvaluateSurface(Surface=reparameterize(list_item_11.Item4), Point=panel_130)  # -> Point, Normal, UDirection, VDirection, Frame; disabled
list_item_15 = ListItem(List=deconstruct_brep_2.Vertices, Index=0, Wrap=True)  # -> Item, Item1, Item2, Item3; disabled

panel_131 = Panel(".5,.5,.5")  # disabled
deconstruct_brep_3 = DeconstructBrep(Brep=list_item_11.Item5)  # -> Faces, Edges, Vertices; disabled
evaluate_surface_4 = EvaluateSurface(Surface=reparameterize(list_item_11.Item5), Point=panel_131)  # -> Point, Normal, UDirection, VDirection, Frame; disabled
list_item_16 = ListItem(List=deconstruct_brep_3.Vertices, Index=0, Wrap=True)  # -> Item, Item1, Item2, Item3; disabled

# ----
brep_edges = BrepEdges(Brep=brep_join.Breps)  # -> Naked, Interior, NonManifold; disabled
end_points = EndPoints(Curve=brep_edges.Interior)  # -> Start, End; disabled
deconstruct_5 = Deconstruct(Point=end_points.End)  # -> XComponent, YComponent, ZComponent; disabled
deconstruct_6 = Deconstruct(Point=end_points.Start)  # -> XComponent, YComponent, ZComponent; disabled
equality_5 = Equality(FirstNumber=deconstruct_6.ZComponent, SecondNumber=deconstruct_5.ZComponent)  # -> Equality, Inequality; disabled
dispatch_5 = Dispatch(List=brep_edges.Interior, DispatchPattern=equality_5.Equality)  # -> ListA, ListB; disabled

join_curves = JoinCurves(Curves=dispatch_5.ListA, Preserve=False)  # disabled
list_item_17 = ListItem(List=join_curves, Index=0, Wrap=True)  # -> Item, Item1; disabled
flip_curve = FlipCurve(Curve=list_item_17.Item1)  # -> Curve, Flag; disabled
loft = Loft(
    Curves=[list_item_17.Item, flip_curve.Curve],
    Options={Adjust=False, Closed=False, LoftEnds=0, LoftSimp=0, LoftType=0, Rebuild=10, Refit=0.01})  # disabled
brep_edges_2 = BrepEdges(Brep=loft)  # -> Naked, Interior, NonManifold; disabled
curve_3 = Curve(brep_edges_2.Interior)  # disabled

# ---- group: merge with exterior data
merge_12 = Merge(Data1=data_2, Data2=data)  # disabled

# ----
panel_132 = Panel(merge_12)  # disabled

end_points_2 = EndPoints(Curve=curve_3)  # -> Start, End; disabled
point_23 = Point(end_points_2.Start)  # disabled
point_24 = Point(end_points_2.End)  # disabled

vector_2pt = Vector2Pt(PointA=point_23, PointB=point_24, Unitize=False)  # -> Vector, Length; disabled
panel_133 = Panel(".12")  # disabled
multiplication_19 = Multiplication(A=panel_133, B=panel_93)  # disabled
panel_134 = Panel(".12")  # disabled
multiplication_20 = Multiplication(A=panel_134, B=panel_93)  # disabled
negative_2 = Negative(Value=multiplication_20)  # disabled

amplitude = Amplitude(Vector=vector_2pt.Vector, Amplitude=multiplication_19)  # disabled
amplitude_2 = Amplitude(Vector=vector_2pt.Vector, Amplitude=negative_2)  # disabled

move_4 = Move(Geometry=point_23, Motion=amplitude)  # -> Geometry, Transform; disabled
move_5 = Move(Geometry=point_24, Motion=amplitude_2)  # -> Geometry, Transform; disabled

cull_index_2 = CullIndex(List=trim_tree, Indices=[panel_123, panel_122], Wrap=True)  # -> simplify(List); disabled
list_item_18 = ListItem(List=trim_tree_2, Index=0, Wrap=True)  # -> Item, Item1, Item2, Item3, simplify(Item4), simplify(Item5); disabled
merge_13 = Merge(Data1=cull_index_2, Data2=list_item_18.Item5, Data3=list_item_18.Item4)  # -> flatten(Result); disabled

partition_list_4 = PartitionList(List=merge_13, Size=number_slider_37)  # -> simplify(Chunks); disabled

brep_join_2 = BrepJoin(Breps=partition_list_4)  # -> Breps, Closed; disabled

panel_135 = Panel(brep_join_2.Breps)  # disabled

brep_edges_3 = BrepEdges(Brep=brep_join_2.Breps)  # -> Naked, Interior, NonManifold; disabled
end_points_3 = EndPoints(Curve=brep_edges_3.Interior)  # -> Start, End; disabled
deconstruct_7 = Deconstruct(Point=end_points_3.End)  # -> XComponent, YComponent, ZComponent; disabled
deconstruct_8 = Deconstruct(Point=end_points_3.Start)  # -> XComponent, YComponent, ZComponent; disabled
equality_6 = Equality(FirstNumber=deconstruct_8.ZComponent, SecondNumber=deconstruct_7.ZComponent)  # -> Equality, Inequality; disabled
dispatch_6 = Dispatch(List=brep_edges_3.Interior, DispatchPattern=equality_6.Equality)  # -> ListA, ListB; disabled

join_curves_2 = JoinCurves(Curves=dispatch_6.ListA, Preserve=False)  # disabled
list_item_19 = ListItem(List=join_curves_2, Index=0, Wrap=True)  # -> Item, Item1; disabled
flip_curve_2 = FlipCurve(Curve=list_item_19.Item1)  # -> Curve, Flag; disabled
loft_2 = Loft(
    Curves=[list_item_19.Item, flip_curve_2.Curve],
    Options={Adjust=False, Closed=False, LoftEnds=0, LoftSimp=0, LoftType=0, Rebuild=10, Refit=0.01})  # disabled
brep_edges_4 = BrepEdges(Brep=loft_2)  # -> Naked, simplify(Interior), NonManifold; disabled

end_points_4 = EndPoints(Curve=brep_edges_4.Interior)  # -> Start, End; disabled
point_25 = Point(end_points_4.End)  # disabled
point_26 = Point(end_points_4.Start)  # disabled

vector_2pt_2 = Vector2Pt(PointA=point_26, PointB=point_25, Unitize=False)  # -> Vector, Length; disabled
panel_136 = Panel(".12")  # disabled
multiplication_21 = Multiplication(A=panel_136, B=panel_93)  # disabled
panel_137 = Panel(".12")  # disabled
multiplication_22 = Multiplication(A=panel_137, B=panel_93)  # disabled
negative_3 = Negative(Value=multiplication_22)  # disabled

amplitude_3 = Amplitude(Vector=vector_2pt_2.Vector, Amplitude=negative_3)  # disabled
amplitude_4 = Amplitude(Vector=vector_2pt_2.Vector, Amplitude=multiplication_21)  # disabled

move_6 = Move(Geometry=point_26, Motion=amplitude_4)  # -> Geometry, Transform; disabled
move_7 = Move(Geometry=point_25, Motion=amplitude_3)  # -> Geometry, Transform; disabled

flip_matrix = FlipMatrix(Data=point_26)  # disabled
flip_matrix_2 = FlipMatrix(Data=point_23)  # disabled
flip_matrix_3 = FlipMatrix(Data=move_4.Geometry)  # disabled
flip_matrix_4 = FlipMatrix(Data=point_24)  # disabled
flip_matrix_5 = FlipMatrix(Data=move_5.Geometry)  # disabled

line_2 = Line(StartPoint=point_25, EndPoint=move_7.Geometry)  # disabled
line_3 = Line(StartPoint=flip_matrix_2, EndPoint=flip_matrix_3)  # -> flatten(Line); disabled
line_4 = Line(StartPoint=flip_matrix_4, EndPoint=flip_matrix_5)  # -> flatten(Line); disabled
line_5 = Line(StartPoint=point_26, EndPoint=move_6.Geometry)  # disabled

panel_138 = Panel("-1")  # disabled
panel_139 = Panel("0")  # disabled
panel_140 = Panel("-2")  # disabled
panel_141 = Panel("-3")  # disabled
shift_list = ShiftList(List=line_3, Shift=panel_139, Wrap=True)  # disabled
shift_list_2 = ShiftList(List=line_5, Shift=panel_138, Wrap=True)  # disabled
shift_list_3 = ShiftList(List=line_2, Shift=panel_140, Wrap=True)  # disabled
shift_list_4 = ShiftList(List=line_4, Shift=panel_141, Wrap=True)  # disabled

panel_142 = Panel("1")  # disabled
panel_143 = Panel("0")  # disabled
panel_144 = Panel("2")  # disabled
panel_145 = Panel("3")  # disabled
shift_list_5 = ShiftList(List=line_3, Shift=panel_143, Wrap=True)  # disabled
shift_list_6 = ShiftList(List=line_5, Shift=panel_142, Wrap=True)  # disabled
shift_list_7 = ShiftList(List=line_2, Shift=panel_144, Wrap=True)  # disabled
shift_list_8 = ShiftList(List=line_4, Shift=panel_145, Wrap=True)  # disabled

curve_4 = Curve(shift_list)  # disabled
curve_5 = Curve(shift_list_4)  # disabled
curve_6 = Curve(shift_list_8)  # disabled
curve_7 = Curve(shift_list_5)  # disabled
entwine = Entwine(Branch00=shift_list_4, Branch01=curve_5, FlattenInputs=True)  # disabled
entwine_2 = Entwine(Branch00=shift_list, Branch01=curve_4, FlattenInputs=True)  # disabled
entwine_3 = Entwine(Branch00=shift_list_8, Branch01=curve_6, FlattenInputs=True)  # disabled
entwine_4 = Entwine(Branch00=shift_list_5, Branch01=curve_7, FlattenInputs=True)  # disabled

end_points_5 = EndPoints(Curve=entwine_2)  # -> Start, End; disabled
end_points_6 = EndPoints(Curve=shift_list_3)  # -> Start, End; disabled
end_points_7 = EndPoints(Curve=shift_list_2)  # -> Start, End; disabled
end_points_8 = EndPoints(Curve=entwine)  # -> Start, End; disabled

end_points_9 = EndPoints(Curve=entwine_4)  # -> Start, End; disabled
end_points_10 = EndPoints(Curve=shift_list_6)  # -> Start, End; disabled
end_points_11 = EndPoints(Curve=shift_list_7)  # -> Start, End; disabled
end_points_12 = EndPoints(Curve=entwine_3)  # -> Start, End; disabled

entwine_5 = Entwine(
    Branch00=end_points_5.Start,
    Branch01=end_points_5.End,
    Branch02=end_points_7.Start,
    Branch03=end_points_7.End,
    Branch04=end_points_6.End,
    Branch05=end_points_6.Start,
    Branch06=end_points_8.End,
    Branch07=end_points_8.Start,
    FlattenInputs=True)  # disabled
flip_matrix_6 = FlipMatrix(Data=entwine_5)  # disabled
polyline = PolyLine(Vertices=flip_matrix_6, Closed=False)  # -> flatten(Polyline); disabled

entwine_6 = Entwine(
    Branch00=end_points_9.Start,
    Branch01=end_points_9.End,
    Branch02=end_points_10.Start,
    Branch03=end_points_10.End,
    Branch04=end_points_11.End,
    Branch05=end_points_11.Start,
    Branch06=end_points_12.End,
    Branch07=end_points_12.Start,
    FlattenInputs=True)  # disabled
flip_matrix_7 = FlipMatrix(Data=entwine_6)  # disabled
polyline_2 = PolyLine(Vertices=flip_matrix_7, Closed=False)  # -> flatten(Polyline); disabled

merge_14 = Merge(
    Data1=end_points_9.Start,
    Data2=end_points_9.End,
    Data3=end_points_10.Start,
    Data4=end_points_10.End,
    Data5=end_points_11.End,
    Data6=end_points_11.Start,
    Data7=end_points_12.End,
    Data8=end_points_12.Start)  # disabled
partition_list_5 = PartitionList(List=polyline_2, Size=panel_94)  # disabled
partition_list_6 = PartitionList(List=polyline, Size=panel_95)  # disabled
panel_146 = Panel(merge_14)  # disabled
merge_15 = Merge(Data1=partition_list_5, Data2=partition_list_6)  # -> simplify(Result); disabled
explode = Explode(Curve=merge_15, Recursive=True)  # -> Segments, Vertices; disabled
tree_branch = TreeBranch(Tree=simplify(merge_15), Path=number_slider_39, MaintainPaths=True)  # disabled
end_points_13 = EndPoints(Curve=explode.Segments)  # -> Start, End; disabled
line_6 = Line(StartPoint=end_points_13.Start, EndPoint=end_points_13.End)  # disabled
trim_tree_5 = TrimTree(Tree=line_6, Depth=1)  # disabled
ungroup = Ungroup(Group=merge_15)  # disabled

# ---- group: UNIT W/ FILLETS
number_slider_50 = Slider(0.06, range=-0.5..0.5)  # disabled
fillet = Fillet(Curve=ungroup, Radius=number_slider_50)  # disabled

# ----
panel_147 = Panel("0,1,0")  # disabled
panel_148 = Panel("90")  # disabled
rotate_3d_2 = Rotate3D(Geometry=trim_tree_5, Angle=degrees(panel_148), Center=panel_96, Axis=panel_147)  # -> Geometry, Transform; disabled

end_points_14 = EndPoints(Curve=rotate_3d_2.Geometry)  # -> Start, End; disabled
merge_16 = Merge(Data1=end_points_14.Start, Data2=end_points_14.End)  # disabled
deconstruct_9 = Deconstruct(Point=merge_16)  # -> XComponent, YComponent, ZComponent; disabled
bounds_3 = Bounds(Numbers=deconstruct_9.XComponent)  # disabled
deconstruct_domain_3 = DeconstructDomain(Domain=bounds_3)  # -> Start, End; disabled
equality_7 = Equality(FirstNumber=deconstruct_domain_3.Start, SecondNumber=deconstruct_9.XComponent)  # -> Equality, Inequality; disabled
dispatch_7 = Dispatch(List=merge_16, DispatchPattern=equality_7.Inequality)  # -> ListA, ListB; disabled
point_27 = Point(dispatch_7.ListB)  # disabled
cull_duplicates = CullDuplicates(Points=point_27, Tolerance=0.1, CullMode=1)  # -> Points, Indices, Valence; disabled

end_points_15 = EndPoints(Curve=rotate_3d_2.Geometry)  # -> Start, End; disabled
merge_17 = Merge(Data1=end_points_15.Start, Data2=end_points_15.End)  # disabled
deconstruct_10 = Deconstruct(Point=merge_17)  # -> XComponent, YComponent, ZComponent; disabled
bounds_4 = Bounds(Numbers=deconstruct_10.XComponent)  # disabled
deconstruct_domain_4 = DeconstructDomain(Domain=bounds_4)  # -> Start, End; disabled
equality_8 = Equality(FirstNumber=deconstruct_domain_4.End, SecondNumber=deconstruct_10.XComponent)  # -> Equality, Inequality; disabled
dispatch_8 = Dispatch(List=merge_17, DispatchPattern=equality_8.Inequality)  # -> ListA, ListB; disabled
point_28 = Point(dispatch_8.ListB)  # disabled
cull_duplicates_2 = CullDuplicates(Points=point_28, Tolerance=0.1, CullMode=1)  # -> Points, Indices, Valence; disabled

merge_18 = Merge(Data1=cull_duplicates.Points, Data2=cull_duplicates_2.Points)  # disabled
deconstruct_11 = Deconstruct(Point=merge_18)  # -> XComponent, YComponent, ZComponent; disabled
average = Average(Input=deconstruct_11.ZComponent)  # disabled
smaller_than = SmallerThan(FirstNumber=deconstruct_11.ZComponent, SecondNumber=average)  # -> SmallerThan, OrEqualTo; disabled
dispatch_9 = Dispatch(List=merge_18, DispatchPattern=smaller_than.SmallerThan)  # -> ListA, ListB; disabled
point_29 = Point(dispatch_9.ListB)  # disabled

point_30 = Point(merge_16)  # disabled
remove_duplicate_lines_karamba3d = RemoveDuplicateLinesKaramba3D(Line=rotate_3d_2.Geometry, LimitDistance=0.005)  # -> OutLine, Info, Indexes; disabled
list_length = ListLength(List=point_29)  # disabled
point_31 = Point(cull_duplicates_2.Points)  # disabled
cull_duplicates_3 = CullDuplicates(Points=point_31, Tolerance=0.1, CullMode=1)  # -> Points, Indices, Valence; disabled
division = Division(A=number_slider_40, B=list_length)  # disabled
point_32 = Point(cull_duplicates.Points)  # disabled
removeduplicatelines_2 = RemoveDuplicateLines(Lines=remove_duplicate_lines_karamba3d.OutLine, Tolerance=0.01)  # disabled
unit_z = UnitZ(Factor=division)  # disabled
negative_4 = Negative(Value=unit_z)  # disabled
panel_149 = Panel(removeduplicatelines_2)  # disabled

# ---- group: measurements
# type of recorded data: angle C/A x
# angle C/A y
# angle C/A z
# angle B/D x
# angle B/D y
# angle B/D z
# distance point 0 to center TOP
# distance point 1 to center TOP
# distance point 2 to center TOP
# distance point 3 to center TOP
# distance point 0 to center BASE
# distance point 1 to center BASE
# distance point 2 to center BASE
# distance point 3 to center BASE
# karamba bounding box
# output_1
# output_2
# output3
# output_4
list_item_20 = ListItem(List=cull_index, Index=0, Wrap=True)  # -> Item, Item1, Item2, Item3; disabled
panel_150 = Panel(".5,.5,.5")  # disabled
C = Surface(list_item_20.Item2)  # disabled
A = Surface(list_item_20.Item)  # disabled
B = Surface(list_item_20.Item1)  # disabled
D = Surface(list_item_20.Item3)  # disabled
base = Surface(list_item_11.Item5)  # disabled
recorded_data = Panel("42dimensional vector")  # disabled

evaluate_surface_5 = EvaluateSurface(Surface=reparameterize(A), Point=panel_150)  # -> Point, Normal, UDirection, VDirection, Frame; disabled
deconstruct_plane = DeconstructPlane(Plane=evaluate_surface_5.Frame)  # -> Origin, XAxis, YAxis, ZAxis; disabled

evaluate_surface_6 = EvaluateSurface(Surface=reparameterize(B), Point=panel_150)  # -> Point, Normal, UDirection, VDirection, Frame; disabled
deconstruct_plane_2 = DeconstructPlane(Plane=evaluate_surface_6.Frame)  # -> Origin, XAxis, YAxis, ZAxis; disabled

evaluate_surface_7 = EvaluateSurface(Surface=reparameterize(C), Point=panel_150)  # -> Point, Normal, UDirection, VDirection, Frame; disabled
deconstruct_plane_3 = DeconstructPlane(Plane=evaluate_surface_7.Frame)  # -> Origin, XAxis, YAxis, ZAxis; disabled

evaluate_surface_8 = EvaluateSurface(Surface=reparameterize(D), Point=panel_150)  # -> Point, Normal, UDirection, VDirection, Frame; disabled
deconstruct_plane_4 = DeconstructPlane(Plane=evaluate_surface_8.Frame)  # -> Origin, XAxis, YAxis, ZAxis; disabled

angle = Angle(VectorA=deconstruct_plane.YAxis, VectorB=deconstruct_plane_3.YAxis)  # -> Angle, Reflex; disabled
angle_2 = Angle(VectorA=deconstruct_plane.XAxis, VectorB=deconstruct_plane_3.XAxis)  # -> Angle, Reflex; disabled
angle_3 = Angle(VectorA=deconstruct_plane.ZAxis, VectorB=deconstruct_plane_3.ZAxis)  # -> Angle, Reflex; disabled

angle_4 = Angle(VectorA=deconstruct_plane_2.XAxis, VectorB=deconstruct_plane_4.XAxis)  # -> Angle, Reflex; disabled
angle_5 = Angle(VectorA=deconstruct_plane_2.YAxis, VectorB=deconstruct_plane_4.YAxis)  # -> Angle, Reflex; disabled
angle_6 = Angle(VectorA=deconstruct_plane_2.ZAxis, VectorB=deconstruct_plane_4.ZAxis)  # -> Angle, Reflex; disabled
distance = Distance(PointA=evaluate_surface_4.Point, PointB=list_item_16.Item)  # disabled
distance_2 = Distance(PointA=evaluate_surface_4.Point, PointB=list_item_16.Item1)  # disabled
distance_3 = Distance(PointA=evaluate_surface_4.Point, PointB=list_item_16.Item2)  # disabled
distance_4 = Distance(PointA=evaluate_surface_4.Point, PointB=list_item_16.Item3)  # disabled
distance_5 = Distance(PointA=evaluate_surface_3.Point, PointB=list_item_15.Item)  # disabled
distance_6 = Distance(PointA=evaluate_surface_3.Point, PointB=list_item_15.Item1)  # disabled
distance_7 = Distance(PointA=evaluate_surface_3.Point, PointB=list_item_15.Item3)  # disabled
distance_8 = Distance(PointA=evaluate_surface_3.Point, PointB=list_item_15.Item2)  # disabled

# ----
panel_151 = Panel(angle_4.Angle)  # disabled

# ----
# karamba
material_selection_karamba3d_2 = MaterialSelectionKaramba3D(menu=[dropdown(2), dropdown(1)])  # disabled
cross_section_karamba3d_2 = CrossSectionKaramba3D(
    FamilyNameOfCrossSection="DefaultCroSec",
    Material=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,
    Diameter_cm=number_slider_41,
    WallThickness_cm=expr("x/2", number_slider_41),
    mode="Circular Hollow")  # disabled
line_to_beam_karamba3d_2 = LineToBeamKaramba3D(Line=removeduplicatelines_2, New=True, Remove=True, LimitDistance_m=0.005)  # -> simplify(Element), Points, Info; disabled
loads_karamba3d_2 = LoadsKaramba3D(Vector=Vector(0, 0, -1), mode="Gravity")  # disabled
loads_karamba3d_3 = LoadsKaramba3D(ForceVector=negative_4, Local=False, PosInd=point_29, mode="Point")  # disabled
merge_19 = Merge(Data1=loads_karamba3d_2)  # disabled
series = Series(Start=0, Step=1, Count=number_slider_28)  # disabled

find_similar_member_2 = FindSimilarMember(Data=simplify(point_32), Set=line_to_beam_karamba3d_2.Points)  # -> Hit, Index; disabled
removeduplicatepts = RemoveDuplicatePts(Points=find_similar_member_2.Hit, Tolerance=0.01)  # disabled
find_similar_member_3 = FindSimilarMember(Data=simplify(cull_duplicates_3.Points), Set=line_to_beam_karamba3d_2.Points)  # -> Hit, Index; disabled
removeduplicatepts_2 = RemoveDuplicatePts(Points=find_similar_member_3.Hit, Tolerance=0.01)  # disabled

support_karamba3d_2 = SupportKaramba3D(PosInd=removeduplicatepts, menu=[buttons(on, on, on, on, off, on)])  # disabled
support_karamba3d_3 = SupportKaramba3D(PosInd=removeduplicatepts_2, menu=[buttons(on, on, on, on, off, on)])  # disabled
merge_20 = Merge(Data1=support_karamba3d_2, Data2=support_karamba3d_3)  # -> simplify(Result); disabled
assemble_model_karamba3d_2 = AssembleModelKaramba3D(
    Elem=simplify(line_to_beam_karamba3d_2.Element),
    Support=simplify(merge_20),
    Load=simplify(merge_19),
    CrossSection=simplify(cross_section_karamba3d_2),
    Material=simplify(material_selection_karamba3d_2),
    LimitDistance_m=0.005)  # -> Model, Info, Mass_kg, CenterOfGravity; disabled
analyze_karamba3d_2 = AnalyzeKaramba3D(Model=assemble_model_karamba3d_2.Model)  # -> CalculatedModel, flatten(MaximumDisplacement_cm), ResultingForceOfGravity_kN, ElasticEnergy_kNm; disabled
sort_list = SortList(Keys=analyze_karamba3d_2.MaximumDisplacement_cm, ValuesValuesA=series)  # -> Keys, ValuesValuesA; disabled
panel_152 = Panel(sort_list.ValuesValuesA)  # disabled
beam_view_karamba3d_2 = BeamViewKaramba3D(Model=analyze_karamba3d_2.CalculatedModel)  # -> Model, MeshesOfRenderedBeams, DeformedBeamAxes, LegendColors, LegendTags; disabled
displacement_cm_4 = Panel(analyze_karamba3d_2.MaximumDisplacement_cm)  # disabled
legend_2 = Legend(Colour=beam_view_karamba3d_2.LegendColors, Tags=beam_view_karamba3d_2.LegendTags, LegendType=1)  # disabled

# ---- group: measurements / karamba best unit
# MEASUREMENTS
list_item_21 = ListItem(List=sort_list.ValuesValuesA, Index=0, Wrap=True)  # disabled
output_parameters = TreeBranch(Tree=simplify(partition_list), Path=list_item_21, MaintainPaths=True)  # disabled

# ---- group: measurements (continued)
merge_21 = Merge(
    Data1=flatten(angle_2.Angle),
    Data2=flatten(angle.Angle),
    Data3=flatten(angle_3.Angle),
    Data4=flatten(angle_4.Angle),
    Data5=flatten(angle_5.Angle),
    Data6=flatten(angle_6.Angle),
    Data7=flatten(distance_5),
    Data8=flatten(distance_6),
    Data9=flatten(distance_8),
    Data10=flatten(distance_7),
    Data11=flatten(distance),
    Data12=flatten(distance_2),
    Data13=flatten(distance_3),
    Data14=flatten(distance_4),
    Data15=flatten(merge_12),
    Data16=flatten(output_parameters))  # disabled
panel_153 = Panel(merge_21)  # disabled

# ----
ghpython_script_7 = GhPythonScript(reset=reset_file, path=file_path_2, interior=merge_10, measurements=merge_21, exterior=ghpython_script_3.allps)  # -> out, a; inputs interior: list, measurements: list, exterior: list; disabled
# ---------- ghpython_script_7: Python ----------
__author__ = "shabe"
__version__ = "2021.04.27"

import rhinoscriptsyntax as rs

if reset:
    f = open(path,'w')
    f.close()
else:
    st1 = map(str,interior)
    st2 = map(str,measurements)
    st3 = map(str,exterior)
    dLine = (',').join(st1+st2+st3)
    with open(path,'a') as fname:
        fname.write(dLine)
        fname.write('\n')
# ---------- end ghpython_script_7 ----------

merge_22 = Merge(Data1=merge_10, Data2=merge_21, Data3=ghpython_script_3.allps)  # disabled
panel_154 = Panel(output_parameters)  # disabled
