# Grasshopper definition data colleciton NN - test1.gh (Grasshopper 1.0.7)
# plug-ins: GHMQTT Info, Robots, Firefly.Kinect.V1, Pufferfish

screen_width = Panel("640")
screen_heigth = Panel("480")
rectangle = Rectangle(Plane=PlaneXY(0, 0, 0), XSize=screen_width, YSize=screen_heigth, Radius=0)  # -> Rectangle, Length
xy = XYPlane(Origin=Point(0, 0, 0))
debrep = DeconstructBrep(Brep=rectangle.Rectangle)  # -> Faces, Edges, Vertices
item = ListItem(List=debrep.Vertices, Index=0, Wrap=True)  # -> Item, Item1, Item2, Item3
number_slider = Slider(20, range=0..100)
number_slider_2 = Slider(18, range=0..100)
aligndim = AlignedDimension(Plane=xy, PointA=item.Item3, PointB=item.Item2, Offset=number_slider, Text="Width :640", Size=number_slider_2)
aligndim_2 = AlignedDimension(Plane=xy, PointA=item.Item, PointB=item.Item3, Offset=number_slider, Text="Heigth :480", Size=number_slider_2)

# ----
# Wrist
# Wrist
panel = Panel("mqtt://test.mosquitto.org:1883/right/index")  # disabled
# Wrist
# Wrist
panel_2 = Panel("mqtt://localhost:1883/right/index")  # disabled
panel_3 = Panel("mqtt://test.mosquitto.org:1883/right/index")  # disabled
# Elbow angle
panel_4 = Panel("mqtt://localhost:1883/left/elbowangle")  # disabled
panel_5 = Panel("mqtt://localhost:1883/left/waist")  # disabled
# Shoulder
panel_6 = Panel("mqtt://localhost:1883/left/shoulder")  # disabled
# Elbow
panel_7 = Panel("mqtt://localhost:1883/left/elbow")  # disabled
# Wrist
# Wrist
panel_8 = Panel("mqtt://localhost:1883/left/wrist")  # disabled
panel_9 = Panel("mqtt://localhost:1883/left/wrist")  # disabled
panel_10 = Panel("mqtt://localhost:1883/left/shoulderangle")  # disabled
# Waist
trigger = Trigger(Interval=5, TimerInterval=5, Target=[mqtt_6, mqtt_5, mqtt_7, mqtt_8, mqtt_3, mqtt_4, mqtt_2, mqtt])  # disabled
number_slider_3 = Slider(100, range=0..100)  # disabled
number_slider_4 = Slider(1000, range=0..1000)  # disabled
mqtt = MQTT(BrokerURI=panel)  # -> Value, Payload; disabled
number_slider_5 = Slider(1350, range=0..10000)  # disabled
mqtt_2 = MQTT(BrokerURI=panel_3)  # -> Value, Payload; disabled
boolean_toggle = BooleanToggle(True)  # disabled
boolean_toggle_2 = BooleanToggle(False)  # disabled
mqtt_3 = MQTT(BrokerURI=panel_4)  # -> Value, Payload; disabled
mqtt_4 = MQTT(BrokerURI=panel_10)  # -> Value, Payload; disabled
mqtt_5 = MQTT(BrokerURI=panel_6)  # -> Value, Payload; disabled
mqtt_6 = MQTT(BrokerURI=panel_5)  # -> Value, Payload; disabled
mqtt_7 = MQTT(BrokerURI=panel_7)  # -> Value, Payload; disabled
mqtt_8 = MQTT(BrokerURI=panel_8)  # -> Value, Payload; disabled
mqtt_9 = MQTT(BrokerURI=panel_9)  # -> Value, Payload; disabled
panel_11 = Panel(mqtt.Value)  # disabled
panel_12 = Panel(",")  # disabled
panel_13 = Panel(mqtt.Payload)  # disabled
panel_14 = Panel(mqtt_2.Value)  # disabled
panel_15 = Panel(",")  # disabled
panel_16 = Panel(mqtt_2.Payload)  # disabled
panel_17 = Panel(mqtt_5.Value)  # disabled
panel_18 = Panel(",")  # disabled
panel_19 = Panel(mqtt_6.Value)  # disabled
panel_20 = Panel(",")  # disabled
panel_21 = Panel(mqtt_7.Value)  # disabled
panel_22 = Panel(",")  # disabled
panel_23 = Panel(mqtt_8.Value)  # disabled
panel_24 = Panel(",")  # disabled
panel_25 = Panel(mqtt_9.Payload)  # disabled
panel_26 = Panel(mqtt_3.Payload)  # disabled
panel_27 = Panel(mqtt_3.Value)  # disabled
panel_28 = Panel(mqtt_4.Value)  # disabled
split = TextSplit(Text=mqtt.Payload, Separators=panel_12)  # disabled
panel_29 = Panel(mqtt_4.Payload)  # disabled
split_2 = TextSplit(Text=mqtt_2.Payload, Separators=panel_15)  # disabled
kinect_v1_skeletal_tracker = KinectV1SkeletalTracker(
    StartSkeletonTracker=boolean_toggle,
    SkeletonScaleFactor=number_slider_5,
    TranslateInZAxis=boolean_toggle_2,
    TimerIntervalInMillisecondsForUpdatingEvents=5)  # -> Points, JointID, Bones; disabled
split_3 = TextSplit(Text=mqtt_5.Payload, Separators=panel_18)  # disabled
split_4 = TextSplit(Text=mqtt_6.Payload, Separators=panel_20)  # disabled
split_5 = TextSplit(Text=mqtt_7.Payload, Separators=panel_22)  # disabled
split_6 = TextSplit(Text=mqtt_8.Payload, Separators=panel_24)  # disabled
data_recorder = DataRecorder(split, DataLimit=-10, RecordData=False)  # disabled
data_recorder_2 = DataRecorder(split_2, DataLimit=-10, RecordData=False)  # disabled
number_slider_6 = Slider(13, range=0..19)  # disabled
panel_30 = Panel(split_4)  # disabled
number_slider_7 = Slider(0.35, range=0..10)  # disabled
number_slider_8 = Slider(0.01, range=0..0.01)  # disabled
panel_31 = Panel(data_recorder)  # disabled
txt = Text(data_recorder)  # disabled
txt_2 = Text(split_4)  # disabled
txt_3 = Text(data_recorder_2)  # disabled
txt_4 = Text(split_3)  # disabled
txt_5 = Text(split_5)  # disabled
panel_32 = Panel("""x
y
z
:""")  # disabled
panel_33 = Panel(data_recorder_2)  # disabled
txt_6 = Text(split_6)  # disabled
panel_34 = Panel("""x
y
z
:""")  # disabled
panel_35 = Panel("""x
y
z
:""")  # disabled
panel_36 = Panel("""x
y
z
:""")  # disabled
list_item = ListItem(List=kinect_v1_skeletal_tracker.Bones, Index=number_slider_6, Wrap=True)  # disabled
panel_37 = Panel("""x
y
z
:""")  # disabled
panel_38 = Panel(txt)  # disabled
panel_39 = Panel("""x
y
z
:""")  # disabled
panel_40 = Panel(kinect_v1_skeletal_tracker.Points)  # disabled
panel_41 = Panel(kinect_v1_skeletal_tracker.JointID)  # disabled
split_7 = TextSplit(Text=data_recorder, Separators=panel_32)  # disabled
split_8 = TextSplit(Text=txt_2, Separators=panel_34)  # disabled
panel_42 = Panel(split_8)  # disabled
pipe = Pipe(Curve=kinect_v1_skeletal_tracker.Bones, Radius=number_slider_7, Caps=0)  # -> flatten(Pipe); disabled
number_slider_9 = Slider(7, range=0..19)  # disabled
split_9 = TextSplit(Text=txt_3, Separators=panel_35)  # disabled
split_10 = TextSplit(Text=txt_4, Separators=panel_36)  # disabled
split_11 = TextSplit(Text=txt_5, Separators=panel_37)  # disabled
split_12 = TextSplit(Text=txt_6, Separators=panel_39)  # disabled
num = Number(split_8)  # disabled
panel_43 = Panel(num)  # disabled
num_2 = Number(split_7)  # disabled
num_3 = Number(split_9)  # disabled
num_4 = Number(split_10)  # disabled
num_5 = Number(split_11)  # disabled
num_6 = Number(split_12)  # disabled
colour_swatch = ColourSwatch(SwatchColor=RGB(204, 255, 236))  # disabled
panel_44 = Panel(list_item)  # disabled
number_slider_10 = Slider(15, range=0..19)  # disabled
number_slider_11 = Slider(3, range=0..19)  # disabled
clean = CleanTree(RemoveNulls=True, RemoveInvalid=True, RemoveEmpty=False, Tree=num_2)  # disabled
clean_2 = CleanTree(RemoveNulls=True, RemoveInvalid=True, RemoveEmpty=False, Tree=num)  # disabled
panel_45 = Panel("([]")  # disabled
number_slider_12 = Slider(640, range=0..1000)  # disabled
number_slider_13 = Slider(0, range=0..100)  # disabled
number_slider_14 = Slider(480, range=0..1000)  # disabled
number_slider_15 = Slider(0, range=0..100)  # disabled
clean_3 = CleanTree(RemoveNulls=True, RemoveInvalid=True, RemoveEmpty=False, Tree=num_3)  # disabled
clean_4 = CleanTree(RemoveNulls=True, RemoveInvalid=True, RemoveEmpty=False, Tree=num_4)  # disabled
clean_5 = CleanTree(RemoveNulls=True, RemoveInvalid=True, RemoveEmpty=False, Tree=num_5)  # disabled
clean_6 = CleanTree(RemoveNulls=True, RemoveInvalid=True, RemoveEmpty=False, Tree=num_6)  # disabled
list_item_2 = ListItem(List=kinect_v1_skeletal_tracker.Points, Index=number_slider_9, Wrap=True)  # disabled
panel_46 = Panel(clean)  # disabled
split_13 = TextSplit(Separators=panel_45)  # disabled
item_2 = ListItem(List=clean, Index=0, Wrap=True)  # -> Item, Item1, Item2; disabled
item_3 = ListItem(List=clean_2, Index=0, Wrap=True)  # -> Item, Item1, Item2; disabled
panel_47 = Panel(split_13)  # disabled
point = Point()  # disabled
item_4 = ListItem(List=clean_3, Index=0, Wrap=True)  # -> Item, Item1, Item2; disabled
item_5 = ListItem(List=clean_4, Index=0, Wrap=True)  # -> Item, Item1, Item2; disabled
custom_preview = CustomPreview(Geometry=pipe, Material=colour_swatch)  # disabled
item_6 = ListItem(List=clean_5, Index=0, Wrap=True)  # -> Item, Item1, Item2; disabled
item_7 = ListItem(List=clean_6, Index=0, Wrap=True)  # -> Item, Item1, Item2; disabled
number_slider_16 = Slider(0, range=0..1)  # disabled
deconstruct = Deconstruct(Point=list_item_2)  # -> XComponent, YComponent, ZComponent; disabled
X = Number(item_2.Item)  # disabled
Y = Number(item_2.Item1)  # disabled
Z = Number(item_2.Item2)  # disabled
X_2 = Number(item_3.Item)  # disabled
Y_2 = Number(item_3.Item1)  # disabled
Z_2 = Number(item_3.Item2)  # disabled
list_item_3 = ListItem(List=kinect_v1_skeletal_tracker.Points, Index=number_slider_10, Wrap=True)  # disabled
list_item_4 = ListItem(List=kinect_v1_skeletal_tracker.Points, Index=number_slider_11, Wrap=True)  # disabled
X_3 = Number(item_4.Item)  # disabled
Y_3 = Number(item_4.Item1)  # disabled
Z_3 = Number(item_4.Item2)  # disabled
X_4 = Number(item_5.Item)  # disabled
Y_4 = Number(item_5.Item1)  # disabled
Z_4 = Number(item_5.Item2)  # disabled
X_5 = Number(item_6.Item)  # disabled
Y_5 = Number(item_6.Item1)  # disabled
Z_5 = Number(item_6.Item2)  # disabled
construct_domain = ConstructDomain(DomainStart=number_slider_13, DomainEnd=number_slider_12)  # disabled
construct_domain_2 = ConstructDomain(DomainStart=number_slider_15, DomainEnd=number_slider_14)  # disabled
X_6 = Number(item_7.Item)  # disabled
Y_6 = Number(item_7.Item1)  # disabled
Z_6 = Number(item_7.Item2)  # disabled
screen_width_2 = Panel("640")  # disabled
screen_heigth_2 = Panel("480")  # disabled
screen_width_3 = Panel("640")  # disabled
screen_heigth_3 = Panel("480")  # disabled
number_slider_17 = Slider(5.9, range=0..10)  # disabled
line = Line(StartPoint=list_item_4, EndPoint=list_item_3)  # disabled
screen_heigth_4 = Panel("480")  # disabled
screen_width_4 = Panel("640")  # disabled
screen_heigth_5 = Panel("480")  # disabled
screen_width_5 = Panel("640")  # disabled
screen_width_6 = Panel("640")  # disabled
screen_heigth_6 = Panel("480")  # disabled
screen_width_7 = Panel("640")  # disabled
screen_heigth_7 = Panel("480")  # disabled
ghpython_script = GhPythonScript(LeftHand=list_item_2)  # -> hand; disabled
# ---------- ghpython_script: Python ----------
import rhinoscriptsyntax as rs
import scriptcontext as sc

if refresh:
    leftHand = getLeftHand()
    rightHand = getRightHand()

def getRightHand():
    hand = input[11]
    return hand
    
def getLeftHand():
    hand = input[7]
    return hand
# ---------- end ghpython_script ----------
range = Range(Domain=construct_domain, Steps=number_slider_12)  # disabled
range_2 = Range(Domain=construct_domain_2, Steps=number_slider_14)  # disabled
multiplication = Multiplication(A=screen_width_2, B=X)  # disabled
multiplication_2 = Multiplication(A=screen_heigth_2, B=Y)  # disabled
length = Length(Curve=line)  # disabled
multiplication_3 = Multiplication(A=screen_width_4, B=X_2)  # disabled
multiplication_4 = Multiplication(A=screen_heigth_5, B=Y_2)  # disabled
multiplication_5 = Multiplication(A=screen_width_3, B=X_3)  # disabled
multiplication_6 = Multiplication(A=screen_heigth_3, B=Y_3)  # disabled
multiplication_7 = Multiplication(A=screen_width_5, B=X_4)  # disabled
multiplication_8 = Multiplication(A=screen_heigth_4, B=Y_4)  # disabled
multiplication_9 = Multiplication(A=screen_width_6, B=X_5)  # disabled
multiplication_10 = Multiplication(A=screen_heigth_6, B=Y_5)  # disabled
multiplication_11 = Multiplication(A=screen_width_7, B=X_6)  # disabled
multiplication_12 = Multiplication(A=screen_heigth_7, B=Y_6)  # disabled
subtraction = Subtraction(A=screen_heigth_2, B=multiplication_2)  # disabled
subtraction_2 = Subtraction(A=screen_heigth_3, B=multiplication_6)  # disabled
multiplication_13 = Multiplication(A=deconstruct.XComponent, B=number_slider_17)  # disabled
multiplication_14 = Multiplication(A=deconstruct.YComponent, B=number_slider_17)  # disabled
multiplication_15 = Multiplication(A=deconstruct.ZComponent, B=number_slider_17)  # disabled
subtraction_3 = Subtraction(A=screen_heigth_4, B=multiplication_4)  # disabled
panel_48 = Panel(ghpython_script)  # disabled
cross_reference = CrossReference(ListListA=range, ListListB=range_2, CrossMode=1)  # -> ListListA, ListListB; disabled
subtraction_4 = Subtraction(A=screen_heigth_4, B=multiplication_8)  # disabled
subtraction_5 = Subtraction(A=screen_heigth_6, B=multiplication_10)  # disabled
subtraction_6 = Subtraction(A=screen_heigth_7, B=multiplication_12)  # disabled
panel_49 = Panel(multiplication)  # disabled
panel_50 = Panel("Wrist")  # disabled
pt = ConstructPoint(XCoordinate=multiplication, YCoordinate=subtraction, ZCoordinate=number_slider_16)  # disabled
panel_51 = Panel("Wrist")  # disabled
pt_2 = ConstructPoint(XCoordinate=multiplication_5, YCoordinate=subtraction_2, ZCoordinate=number_slider_16)  # disabled
panel_52 = Panel(pt_2)  # disabled
panel_53 = Panel("Waist")  # disabled
panel_54 = Panel("Elbow")  # disabled
panel_55 = Panel("Wrist")  # disabled
panel_56 = Panel("Shoulder")  # disabled
pt_3 = ConstructPoint(XCoordinate=multiplication_3, YCoordinate=subtraction_3, ZCoordinate=number_slider_16)  # disabled
pt_4 = ConstructPoint(XCoordinate=multiplication_7, YCoordinate=subtraction_4, ZCoordinate=number_slider_16)  # disabled
pt_5 = ConstructPoint(XCoordinate=multiplication_9, YCoordinate=subtraction_5, ZCoordinate=number_slider_16)  # disabled
pt_6 = ConstructPoint(XCoordinate=multiplication_11, YCoordinate=subtraction_6, ZCoordinate=number_slider_16)  # disabled
panel_57 = Panel(multiplication_13)  # disabled
panel_58 = Panel(multiplication_14)  # disabled
panel_59 = Panel(multiplication_15)  # disabled
panel_60 = Panel(pt_6)  # disabled
merge = Merge(Data1=cross_reference.ListListA, Data2=cross_reference.ListListB)  # disabled
tag = TextTag3D(Location=pt, Text=panel_50, Size=10, Justification=7)  # disabled
tag_2 = TextTag3D(Location=pt_2, Text=panel_51, Size=10, Justification=7)  # disabled
tag_3 = TextTag3D(Location=pt_3, Text=panel_53, Size=10, Justification=7)  # disabled
tag_4 = TextTag3D(Location=pt_4, Text=panel_56, Size=10, Justification=7)  # disabled
tag_5 = TextTag3D(Location=pt_5, Text=panel_54, Size=10, Justification=7)  # disabled
tag_6 = TextTag3D(Location=pt_6, Text=panel_55, Size=10, Justification=7)  # disabled
# Generate Multiple parameters hier
panel_61 = Panel(cross_reference.ListListA)  # disabled
point_2 = Point(pt)  # disabled
find_similar_member = FindSimilarMember(Data=cross_reference.ListListA)  # -> Hit, Index; disabled
point_3 = Point(pt_2)  # disabled
point_4 = Point(pt_6)  # disabled
data_recorder_3 = DataRecorder(point_2, DataLimit=-10, RecordData=False)  # disabled
data_recorder_4 = DataRecorder(point_3, DataLimit=-10, RecordData=False)  # disabled
data_recorder_5 = DataRecorder(point_4, DataLimit=-10, RecordData=False)  # disabled
panel_62 = Panel(data_recorder_3)  # disabled
panel_63 = Panel(data_recorder_4)  # disabled
panel_64 = Panel(data_recorder_5)  # disabled
pline = PolyLine(Vertices=[pt_6, pt_5, pt_4, pt_3], Closed=False)  # disabled
dots = DotDisplay(Point=[pt_3, pt_4, pt_5, pt_6], Colour=RGB(0, 0, 0), Size=10)  # disabled

# ---- group: Robot settings
list = ValueList({"AA-KR60", "AA-KR30", "AA-KR60_KR30", "AARCH IRB120", "AARCH IRB6620", "Bartlett-IRB120", "Bartlett-IRB1600", "Bartlett-KR6", "Bartlett-KR60", "Bartlett-UR10", "Bigli-KR20", "ETH-Gantry", "Grymsdyke-IRB120", "Grymsdyke-KR210", "iaac-KR150-2_110", "iaac-IRB140", "iaac-IRB120", "EXArchitects-IRB6700", "KULeuven-IRB120", "KULeuven-UR5", "KULeuven-UR10", "IRB4600-205", "UEL IRB6620", "uem-IRB120", "uem-IRB1600", "uem-IRB2600", "uem-IRB1600_IRB2600", "UniMelb-IRB120", "UniMelb-IRB1200"}, selected="iaac-IRB140")  # disabled
xy_2 = XYPlane(Origin=Point(0, 0, 0))  # disabled
load_robot = LoadRobotSystem(Name=list, Base=xy_2)  # disabled
speed = Panel("250")  # disabled
zone = Panel("10")  # disabled

# ----
gripper = Geometry(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)  # disabled

# ---- group: Outside Cut
point_5 = Point(<point referenced from the Rhino model>)  # disabled
brep = Brep(<brep referenced from the Rhino model>)  # disabled
xy_3 = XYPlane(Origin=point_5)  # disabled
mesh_brep = MeshBrep(
    Brep=brep,
    Settings={GridMaxCount=0, GridMinCount=16, JaggedSeams=False, MaxEdgeLength=0, MinEdgeLength=0.0001, MinTolerance=0, Refine=True, RefineAngle=0, RelativeTolerance=0.65, SimplePlanes=True, Tolerance=0})  # -> flatten(Mesh); disabled
panel_67 = Panel("WnC_gripper")  # disabled
pflip = FlipPlane(Plane=xy_3, ReverseX=False, ReverseY=False, SwapAxes=True)  # disabled
mesh = Mesh(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)  # disabled
tool = CreateTool(Name=panel_67, TCP=pflip, Weight=0, Mesh=mesh_brep)  # -> Tool, TCP; disabled

# ---- group: Start and Stop position
number_slider_18 = Slider(90, range=-90..90)  # disabled
elbow = Slider(0, range=-90..90)  # disabled
number_slider_19 = Slider(0, range=-90..90)  # disabled
number_slider_20 = Slider(0, range=-90..90)  # disabled
number_slider_21 = Slider(180, range=-180..180)  # disabled
shoulder = Slider(24, range=-90..90)  # disabled
merge_2 = Merge(
    Data1=number_slider_18,
    Data2=reverse(shoulder),
    Data3=reverse(elbow),
    Data4=number_slider_19,
    Data5=number_slider_20,
    Data6=number_slider_21)  # disabled
degtorad = DegreesToRadians(Degrees=merge_2, RobotSystem=load_robot, MechanicalGroup=0)  # disabled
target = CreateTarget(Joints=degtorad, Tool=tool.Tool, IsCartesian=False)  # disabled

# ----
mesh_2 = Mesh(gripper)  # disabled
swatch = ColourSwatch(SwatchColor=RGBA(30, 0, 36, 137))  # disabled
preview = CustomPreview(Geometry=mesh_2, Shader=swatch)  # disabled

point_6 = Point(<point referenced from the Rhino model>)  # disabled
point_7 = Point(pt_6)  # disabled
deconstruct_2 = Deconstruct(Point=point_7)  # -> XComponent, YComponent, ZComponent; disabled
panel_68 = Panel("0 to 640")  # disabled
panel_69 = Panel(" 0 to 1")  # disabled
panel_70 = Panel(" 0 to 1")  # disabled
panel_71 = Panel("0 to 480")  # disabled
remap_numbers = RemapNumbers(Value=deconstruct_2.XComponent, Source=panel_68, Target=panel_69)  # -> Mapped, Clipped; disabled
remap_numbers_2 = RemapNumbers(Value=deconstruct_2.YComponent, Source=panel_71, Target=panel_70)  # -> Mapped, Clipped; disabled
panel_72 = Panel(deconstruct_2.YComponent)  # disabled
negative = Negative(Value=remap_numbers_2.Mapped)  # disabled
panel_73 = Panel(remap_numbers.Mapped)  # disabled
construct_point = ConstructPoint(XCoordinate=panel_73, YCoordinate=remap_numbers_2.Mapped, ZCoordinate=0)  # disabled
surface = Surface(rectangle.Rectangle)  # disabled
curve = Curve(<curve referenced from the Rhino model>)  # disabled
surface_2 = Surface(curve)  # disabled
evaluate_surface = EvaluateSurface(Surface=reparameterize(surface))  # -> Point, Normal, UDirection, VDirection, Frame; disabled
evaluate_surface_2 = EvaluateSurface(Surface=reparameterize(surface_2), Point=construct_point)  # -> Point, Normal, UDirection, VDirection, Frame; disabled
point_8 = Point(<point referenced from the Rhino model>)  # disabled
point_9 = Point(<point referenced from the Rhino model>)  # disabled
point_10 = Point(<point referenced from the Rhino model>)  # disabled
point_11 = Point(<point referenced from the Rhino model>)  # disabled
point_12 = Point(evaluate_surface.Point)  # disabled
list_2 = ValueList({"Joint", "Linear"}, selected="Linear")  # disabled
list_3 = ValueList({"Joint", "Linear"}, selected="Joint")  # disabled
list_4 = ValueList({"Joint", "Linear"}, selected="Joint")  # disabled
list_5 = ValueList({"Joint", "Linear"}, selected="Joint")  # disabled
point_13 = Point(<point referenced from the Rhino model>)  # disabled
panel_74 = Panel("100")  # disabled
panel_75 = Panel("100")  # disabled
panel_76 = Panel("100")  # disabled
panel_77 = Panel("100")  # disabled
panel_78 = Panel("10")  # disabled
panel_79 = Panel("10")  # disabled
panel_80 = Panel("10")  # disabled
panel_81 = Panel("10")  # disabled
list_6 = ValueList({"Joint", "Linear"}, selected="Joint")  # disabled
target_2 = CreateTarget(Plane=point_9, Motion=list_3, Tool=tool.Tool, Speed=panel_75, Zone=panel_79, IsCartesian=True)  # disabled
target_3 = CreateTarget(Plane=point_10, Motion=list_4, Tool=tool.Tool, Speed=panel_76, Zone=panel_80, IsCartesian=True)  # disabled
target_4 = CreateTarget(Plane=point_8, Motion=list_2, Tool=tool.Tool, Speed=panel_74, Zone=panel_78, IsCartesian=True)  # disabled
target_5 = CreateTarget(Plane=point_11, Motion=list_5, Tool=tool.Tool, Speed=panel_77, Zone=panel_81, IsCartesian=True)  # disabled
panel_82 = Panel("100")  # disabled
target_6 = CreateTarget(Motion=list_6, Tool=tool.Tool, Speed=panel_82, Zone=panel_81, IsCartesian=True)  # disabled
merge_3 = Merge(Data1=flatten(target), Data2=target_6, Data3=flatten(target))  # disabled
number_slider_22 = Slider(0.501, range=0..1)  # disabled

# ----
# ROBOT SETUP
panel_83 = Panel("picknplace")  # disabled
program = CreateProgram(Name=panel_83, RobotSystem=load_robot, Targets1=flatten(merge_3), StepSize=1)  # -> Program, Code, Duration, Warnings, Errors; disabled
check_errors = Panel(program.Errors)  # disabled
to_export_code_file_prg = Panel(program.Code)  # disabled
sim = ProgramSimulation(Program=program.Program, Time=number_slider_22, Normalized=True)  # -> SystemMeshes, JointRotations, Plane, Index, Time, Program, Errors; disabled

collisions = CheckCollisions(Program=program.Program, FirstSet=7, SecondSet=4, EnvironmentPlane=-1, LinearStepSize=100, AngularStepSize=0.7853981634)  # -> CollisionFound, TargetIndex, CollidedMeshes; disabled
panel_84 = Panel("7")  # disabled
panel_85 = Panel(collisions.CollisionFound)  # disabled

panel_86 = Panel(sim.Index)  # disabled
time_seconds = Panel(sim.Time)  # disabled

# ---- group: Display simulation
trail = SimpleTrail(Program=sim.Program, Length=500, MechanicalGroup=0)  # disabled
swatch_2 = ColourSwatch(SwatchColor=RGB(255, 0, 0))  # disabled
preview_2 = CustomPreview(Geometry=trail, Shader=swatch_2)  # disabled

# ---- group: to export file
button = Button()  # disabled
txt_7 = Text(flatten(program.Code))  # disabled
path = FilePath("D:\\")  # disabled
file_name = Panel("WirenClay_08")  # disabled
python = GhPythonScript(program=txt_7, path=path, name=file_name, write=button)  # -> out, a; inputs program: list; disabled
# ---------- python: Python ----------
__author__ = "kunal"
__version__ = "2018.10.16"

import rhinoscriptsyntax as rs

if write:
    with open(path + name + '.prg', 'w') as file:
        for line in program:
            file.write(line)
            file.write('\n')
# ---------- end python ----------

# ----
# DISPLAY SETUP
split_14 = SplitList(List=sim.SystemMeshes, Index=panel_84)  # -> ListA, ListB; disabled
swatch_3 = ColourSwatch(SwatchColor=RGBA(30, 0, 36, 137))  # disabled
swatch_4 = ColourSwatch(SwatchColor=RGB(71, 71, 71))  # disabled

pedestal = Geometry(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)  # disabled
mesh_3 = Mesh(pedestal)  # disabled
preview_3 = CustomPreview(Geometry=mesh_3, Shader=swatch_4)  # disabled

preview_4 = CustomPreview(Geometry=split_14.ListB, Shader=swatch_4)  # disabled
preview_5 = CustomPreview(Geometry=split_14.ListA, Shader=swatch_3)  # disabled

trigger_2 = Trigger(Interval=10, TimerInterval=10, Target=ghpython_script_3)  # disabled
reset_values = BooleanToggle(True)  # disabled
reset_file = BooleanToggle(False)  # disabled
ghpython_script_2 = GhPythonScript()  # -> out, a; disabled
# ---------- ghpython_script_2: Python ----------
__author__ = "shabe"
__version__ = "2021.04.27"

import rhinoscriptsyntax as rs


"""
p1 - 0.20 - 0.90
p2 - 0.20 - 0.90
p3 - 0.20 - 0.90
p4 - 0.20 - 0.90
p5 - (-30) - 30
p6 - (-30) - 30
p7 - 0.8 - 1.5
p8 - 0.5 - 1.5
"""
class vars():
    def __init__(self):

        self.ps = [0.2,0.2,0.2,0.2]
        self.min = [0.2,0.2,0.2,0.2]
        self.ds = [0.1,0.1,0.1,0.1]
        self.mx = [0.9,0.9,0.9,0.9]
    def Increment(self,i = 0,up = False):
        
        if i==len(self.ps)-1: #
            if self.ps[-1]==self.mx[-1]:
                self.ps = None
                return
            else:
                return
        if i==0:
            self.ps[0]+=self.ds[0]
            if self.ps[0]>self.mx[0]:
                self.ps[0] = self.min[0]
                up = True
            else:
                up = False
            self.Increment(i+1,up)
        else:
            if up==True:
                self.ps[i]+=self.ds[i]
                if self.ps[i]>self.mx[i]:
                    self.ps[i] = self.min[i]
                    up = True
                else:
                    up = False
                self.Increment(i+1,up)

a = vars
# ---------- end ghpython_script_2 ----------

trigger_3 = Trigger(Interval=10, TimerInterval=10, Target=ghpython_script_5)  # disabled
reset_values_2 = BooleanToggle(False)
reset_file_2 = BooleanToggle(False)

# ---- group: 2d grid - Hand
square = Square(Plane=PlaneXY(0, 0, 0), Size=1, ExtentX=screen_width, ExtentY=screen_heigth)  # -> Cells, Points
area = Area(Geometry=square.Cells)  # -> Area, flatten(Centroid)
panel_87 = Panel(area.Centroid)

# ----
ghpython_script_3 = GhPythonScript(vars=ghpython_script_2.a, Run=reset_values)  # -> out, p1, p2, p3, p4, allps, a; disabled
# ---------- ghpython_script_3: Python ----------
__author__ = "shabe"
__version__ = "2021.04.27"

import rhinoscriptsyntax as rs

if Run == True:
    locV.Increment()
    counter+=1
    a = counter
    p1 = locV.ps[0]
    p2 = locV.ps[1]
    p3 = locV.ps[2]
    p4 = locV.ps[3]
    allps = locV.ps
else:
    counter = 0
    locV = vars()
# ---------- end ghpython_script_3 ----------
ghpython_script_4 = GhPythonScript()  # -> out, a
# ---------- ghpython_script_4: Python ----------
__author__ = "shabe"
__version__ = "2021.04.27"

import rhinoscriptsyntax as rs


"""
p1 - 0.20 - 0.90
p2 - 0.20 - 0.90
p3 - 0.20 - 0.90
p4 - 0.20 - 0.90
p5 - (-30) - 30
p6 - (-30) - 30
p7 - 0.8 - 1.5
p8 - 0.5 - 1.5
"""
class vars():
    def __init__(self):

        self.ps = [0,0]
        self.min = [0,0]
        self.ds = [1,1]
        self.mx = [307199, 307199]
    def Increment(self,i = 0,up = False):
        
        if i==len(self.ps): #
            if self.ps[1]==self.mx[1]:
                self.ps = None
                return
            else:
                return
        if i==0:
            self.ps[0]+=self.ds[0]
            self.ps[1]+=self.ds[1]
            if self.ps[0]>self.mx[0]:
                self.ps[0] = self.min[0]
            if self.ps[1]>self.mx[1]:
                self.ps[1] = self.min[1]
                up = True
            else:
                up = False
            self.Increment(i+1,up)

a = vars
# ---------- end ghpython_script_4 ----------
reset_file_3 = BooleanToggle(False)
panel_88 = Panel(ghpython_script_3.a)

# ---- group: Base
xy_4 = XYPlane(Origin=Point(0, 0, 0))
mesh_with_camera_holder = Mesh(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)
pln = Plane(xy_4)

# ----
mesh_4 = Mesh([<mesh referenced from the Rhino model> x9])
ghpython_script_5 = GhPythonScript(vars=ghpython_script_4.a, Run=reset_values_2)  # -> out, p1, p2, allps, a
# ---------- ghpython_script_5: Python ----------
__author__ = "shabe"
__version__ = "2021.04.27"

import rhinoscriptsyntax as rs

if Run == True:
    locV.Increment()
    counter+=1
    a = counter
    p1 = locV.ps[0]
    p2 = locV.ps[1]
    #p3 = locV.ps[2]
    #p4 = locV.ps[3]
    allps = locV.ps
else:
    counter = 0
    locV = vars()
# ---------- end ghpython_script_5 ----------

# ---- group: Robot work area
curve_2 = Curve(<curve referenced from the Rhino model>)
divide_surface = DivideSurface(Surface=curve_2, UCount="639", VCount="479")  # -> flatten(Points), Normals, Parameters

# ---- group: Base
scale = Scale(Geometry=mesh_4, Center=Point(0, 0, 0), Factor=".001")  # -> Geometry, Transform
mesh_5 = Mesh(scale.Geometry)

# ----
panel_89 = Panel(ghpython_script_5.a)
panel_90 = Panel(ghpython_script_5.p1)
panel_91 = Panel(ghpython_script_5.p2)

# ---- group: Work area data collection
p2 = Slider(0, range=0..301799)
p1 = Slider(0, range=0..301799)

# ----
relay = Relay()  # disabled

merge_4 = Merge()  # disabled
file_path = FilePath("D:\Arpan\Personal\IAAC\3rd Semester\Workshop 3.1\Group work\Day 04\Final_2.csv")  # disabled
ghpython_script_6 = GhPythonScript(reset=reset_file, path=file_path, interior=merge_4, measurements=relay, exterior=ghpython_script_3.allps)  # -> out, a; inputs interior: list, measurements: list, exterior: list; disabled
# ---------- ghpython_script_6: Python ----------
__author__ = "shabe"
__version__ = "2021.04.27"

import rhinoscriptsyntax as rs

if reset:
    f = open(path,'w')
    f.close()
else:
    st1 = map(str,interior)
    st2 = map(str,measurements)
    st3 = map(str,exterior)
    dLine = (',').join(st1+st2+st3)
    with open(path,'a') as fname:
        fname.write(dLine)
        fname.write('\n')
# ---------- end ghpython_script_6 ----------

list_item_5 = ListItem(List=divide_surface.Points, Index=ghpython_script_5.p2, Wrap=True)
list_item_6 = ListItem(List=area.Centroid, Index=ghpython_script_5.p1, Wrap=True)
panel_92 = Panel(merge_4)
merge_5 = Merge(Data1=merge_4, Data2=relay, Data3=ghpython_script_3.allps)  # disabled
panel_93 = Panel(list_item_5)
panel_94 = Panel(list_item_6)
deconstruct_3 = Deconstruct(Point=list_item_6)  # -> XComponent, YComponent, ZComponent
deconstruct_4 = Deconstruct(Point=list_item_5)  # -> XComponent, YComponent, ZComponent
panel_95 = Panel(deconstruct_3.ZComponent)
panel_96 = Panel(deconstruct_3.XComponent)
panel_97 = Panel(deconstruct_3.YComponent)

# ---- group: Robot setup
number_slider_23 = Slider(-360, range=-360..360)
list_7 = ValueList({"AA-KR60", "AA-KR30", "AA-KR60_KR30", "AARCH IRB120", "AARCH IRB6620", "AAU-Utzon-UR10", "Automata", "Bartlett-IRB120", "Bartlett-IRB1600", "Bartlett-KR6"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}, selected="KULeuven-UR10e")
xy_plane = XYPlane(Origin=Point(0, 0, 0))
load_robot_system = LoadRobotSystem(Name=list_7, Base=xy_plane)

# ---- group: Robot setup / Start and Stop position
merge_6 = Merge(
    Data1=Slider(0, range=-90..90),
    Data2=Slider(-90, range=-90..90),
    Data3=Slider(0, range=-90..90),
    Data4=Slider(0, range=-90..90),
    Data5=Slider(0, range=-90..90),
    Data6=Slider(0, range=-180..180))
degtorad_2 = DegreesToRadians(Degrees=merge_6, RobotSystem=load_robot_system, MechanicalGroup=0)
target_7 = CreateTarget(Joints=degtorad_2, IsCartesian=False)

# ----
panel_98 = Panel(deconstruct_4.ZComponent)
panel_99 = Panel(deconstruct_4.XComponent)
panel_100 = Panel(deconstruct_4.YComponent)
flip_plane = FlipPlane(Plane=list_item_5, FlipX=False, FlipY=False, FlipZ=True)  # -> Flipped, ResultBoolean
construct_point_2 = ConstructPoint(XCoordinate=panel_96, YCoordinate=panel_97, ZCoordinate=Slider(0, range=0..100))
construct_point_3 = ConstructPoint(XCoordinate=panel_99, YCoordinate=panel_100, ZCoordinate=Slider(0, range=0..100))
rotate_plane = RotatePlane(Plane=flip_plane.Flipped, Angle=degrees(Slider(0, range=0..180)))
list_8 = ValueList({"Joint", "Linear"}, selected="Joint")
target_8 = CreateTarget(Plane=rotate_plane, Motion=list_8, Speed="50", Zone="10", IsCartesian=True)
merge_7 = Merge(Data1=target_7, Data2=target_8, Data3=target_7)
create_program = CreateProgram(Name="picknplace", RobotSystem=load_robot_system, Targets1=flatten(merge_7), StepSize=1)  # -> Program, Code, Duration, Warnings, Errors
panel_101 = Panel(create_program.Warnings)
program_simulation = ProgramSimulation(Program=create_program.Program, Time=Slider(0.6657, range=0..1), Normalized=True)  # -> SystemMeshes, JointRotations, Plane, Index, Time, Program, Errors
panel_102 = Panel(program_simulation.JointRotations)
panel_103 = Panel(divide_surface.Points)
list_item_7 = ListItem(List=program_simulation.JointRotations, Index=0, Wrap=True)  # -> Item, Item1, Item2, Item3, Item4, Item5
list_9 = ValueList({"AA-KR60", "AA-KR30", "AA-KR60_KR30", "AARCH IRB120", "AARCH IRB6620", "AAU-Utzon-UR10", "Automata", "Bartlett-IRB120", "Bartlett-IRB1600", "Bartlett-KR6"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}, selected="KULeuven-UR10e")
degrees = Degrees(Radians=list_item_7.Item2)
degrees_2 = Degrees(Radians=list_item_7.Item4)
degrees_3 = Degrees(Radians=list_item_7.Item3)
degrees_4 = Degrees(Radians=list_item_7.Item5)
degrees_5 = Degrees(Radians=list_item_7.Item1)
degrees_6 = Degrees(Radians=list_item_7.Item)
xy_plane_2 = XYPlane(Origin=Point(0, 0, 0))
merge_8 = Merge(Data1=degrees_6, Data2=degrees_5, Data3=degrees, Data4=degrees_3, Data5=degrees_2, Data6=degrees_4)
load_robot_system_2 = LoadRobotSystem(Name=list_9, Base=xy_plane_2)
panel_104 = Panel(merge_8)
degrees_to_radians = DegreesToRadians(Degrees=merge_8, RobotSystem=load_robot_system_2, MechanicalGroup=0)
target_9 = CreateTarget(Joints=degrees_to_radians, IsCartesian=False)
panel_105 = Panel(target_9)
create_program_2 = CreateProgram(Name="robot", RobotSystem=load_robot_system_2, Targets1=flatten(target_9), StepSize=1)  # -> Program, Code, Duration, Warnings, Errors
program_simulation_2 = ProgramSimulation(Program=create_program_2.Program, Time=0, Normalized=True)  # -> SystemMeshes, JointRotations, Plane, Index, Time, Program, Errors
merge_9 = Merge(Data1=construct_point_2, Data2=construct_point_3, Data3=program_simulation_2.JointRotations)  # -> flatten(Result)

file_path_2 = FilePath("C:\Users\Arpan\Desktop\Software data collection - test1 (05.05.2021).csv")
ghpython_script_7 = GhPythonScript(reset=reset_file_3, path=file_path_2, measurements=merge_9)  # -> out, a; inputs measurements: list, exterior: list
# ---------- ghpython_script_7: Python ----------
__author__ = "shabe"
__version__ = "2021.04.27"

import rhinoscriptsyntax as rs

if reset:
    f = open(path,'w')
    f.close()
else:
    st2 = map(str,measurements)
    st3 = map(str,exterior)
    dLine = (',').join(st2+st3)
    with open(path,'a') as fname:
        fname.write(dLine)
        fname.write('\n')
# ---------- end ghpython_script_7 ----------

panel_106 = Panel(ghpython_script_7.out)

# ----
# Hand area coordinates
# Robot area coordinates
# Robot joint angle in radian
# Robot joint angle in radian
# Robot joint angle in radian
# Robot joint angle in radian
# Robot joint angle in radian
# Robot joint angle in radian
panel_107 = Panel(merge_9)

# ---- group: useless stuff
rectanguloid = Geometry(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)  # disabled
# Input Cell
rectanguloid_2 = Geometry(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)  # disabled
team_dirt_01 = Geometry(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)  # disabled
gripper_point = Point(Point(575, -3.995, 254.9843858))  # disabled
swatch_5 = ColourSwatch(SwatchColor=RGBA(145, 145, 145, 88))  # disabled
swatch_6 = ColourSwatch(SwatchColor=RGBA(117, 117, 117, 88))  # disabled
number_slider_24 = Slider(17, range=0..100)  # disabled
panel_108 = Panel("0.01 to 0.99")  # disabled
number_slider_25 = Slider(0.5, range=0..1)  # disabled
range_3 = Range(Domain=panel_108, Steps=number_slider_24)  # disabled
pt_7 = ConstructPoint(XCoordinate=range_3, YCoordinate=number_slider_25, ZCoordinate=0)  # disabled
number_slider_26 = Slider(0, range=0..1)  # disabled
number_slider_27 = Slider(322, range=0..1000)  # disabled
panel_109 = Panel("-1")  # disabled
Z_7 = UnitZ(Factor=number_slider_27)  # disabled
number_slider_28 = Slider(100, range=0..100)  # disabled
number_slider_29 = Slider(100, range=0..100)  # disabled
Z_8 = UnitZ(Factor=number_slider_28)  # disabled
list_10 = ValueList({"Joint", "Linear"}, selected="Joint")  # disabled
list_11 = ValueList({"Joint", "Linear"}, selected="Linear")  # disabled
list_12 = ValueList({"Joint", "Linear"}, selected="Joint")  # disabled
list_13 = ValueList({"Joint", "Linear"}, selected="Joint")  # disabled
panel_110 = Panel("100")  # disabled
panel_111 = Panel("10")  # disabled
panel_112 = Panel("100")  # disabled
panel_113 = Panel("100")  # disabled
panel_114 = Panel("10")  # disabled
panel_115 = Panel("10")  # disabled

cylinder = Geometry(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)  # disabled
bbox = BoundingBox(Content=cylinder, Plane=PlaneXY(0, 0, 0), UnionBox=True)  # -> Box, Box_2; disabled
debrep_2 = DeconstructBrep(Brep=bbox.Box)  # -> Faces, Edges, Vertices; disabled
item_8 = ListItem(List=reverse(debrep_2.Faces), Index=0, Wrap=True)  # -> Item, Item1, Item2; disabled
area_2 = Area(Geometry=item_8.Item)  # -> Area, Centroid; disabled
area_3 = Area(Geometry=item_8.Item1)  # -> Area, Centroid; disabled
ln = Line(StartPoint=area_2.Centroid, EndPoint=area_3.Centroid)  # -> reverse(Line); disabled
curvepoint = PointOnCurve(ln, parameter=1)  # disabled
orient = Orient(Geometry=cylinder, Source=curvepoint, Target=gripper_point)  # -> Geometry, Transform; disabled

bbox_2 = BoundingBox(Content=team_dirt_01, Plane=PlaneXY(0, 0, 0), UnionBox=True)  # -> Box, Box_2; disabled
debrep_3 = DeconstructBrep(Brep=bbox_2.Box)  # -> Faces, Edges, Vertices; disabled
item_9 = ListItem(List=reverse(debrep_3.Faces), Index=0, Wrap=True)  # -> Item, Item1, Item2; disabled
area_4 = Area(Geometry=item_9.Item)  # -> Area, Centroid; disabled
area_5 = Area(Geometry=item_9.Item1)  # -> Area, Centroid; disabled
ln_2 = Line(StartPoint=area_4.Centroid, EndPoint=area_5.Centroid)  # -> reverse(Line); disabled
curvepoint_2 = PointOnCurve(ln_2, parameter=0.641)  # disabled
orient_2 = Orient(Geometry=team_dirt_01, Source=curvepoint_2, Target=PlaneXY(0, 0, 0))  # -> Geometry, Transform; disabled

preview_6 = CustomPreview(Geometry=orient.Geometry, Material=swatch_5)  # disabled
preview_7 = CustomPreview(Geometry=orient_2.Geometry, Material=swatch_6)  # disabled
brep_2 = Brep(orient_2.Geometry)  # disabled
debrep_4 = DeconstructBrep(Brep=brep_2)  # -> Faces, Edges, Vertices; disabled
item_10 = ListItem(List=debrep_4.Edges, Index=0, Wrap=True)  # -> Item, Item1; disabled
flip = FlipCurve(Curve=item_10.Item1)  # -> Curve, Flag; disabled
rulesrf = RuledSurface(CurveA=item_10.Item, CurveB=flip.Curve)  # disabled
evalsrf = EvaluateSurface(Surface=reparameterize(rulesrf), Point=pt_7)  # -> Point, Normal, UDirection, VDirection, Frame; disabled
rotate = Rotate(Geometry=evalsrf.Frame, Angle=1.570796327, Plane=evalsrf.Frame)  # -> Geometry, Transform; disabled
deplane = DeconstructPlane(Plane=rotate.Geometry)  # -> Origin, XAxis, YAxis, ZAxis; disabled
rev = Reverse(Vector=deplane.ZAxis)  # disabled
devec = DeconstructVector(Vector=rev)  # -> XComponent, YComponent, ZComponent; disabled
vec = VectorXYZ(XComponent=devec.XComponent, YComponent=devec.YComponent, ZComponent=number_slider_26)  # -> Vector, Length; disabled
padjust = AdjustPlane(Plane=rotate.Geometry, Normal=vec.Vector)  # disabled
rev_2 = ReverseList(List=padjust)  # disabled
item_11 = ListItem(List=rev_2, Index=panel_109, Wrap=True)  # disabled
item_12 = ListItem(List=rev_2, Index=0, Wrap=True)  # disabled
move = Move(Geometry=item_11, Motion=Z_7)  # -> Geometry, Transform; disabled
deplane_2 = DeconstructPlane(Plane=move.Geometry)  # -> Origin, XAxis, YAxis, ZAxis; disabled
amp = Amplitude(Vector=deplane_2.ZAxis, Amplitude=number_slider_29)  # disabled
move_2 = Move(Geometry=item_12, Motion=Z_8)  # -> Geometry, Transform; disabled
move_3 = Move(Geometry=move.Geometry, Motion=amp)  # -> Geometry, Transform; disabled
target_10 = CreateTarget(Plane=rev_2, Motion=list_11, Tool=tool.Tool, Speed=panel_112, Zone=panel_114, IsCartesian=True)  # disabled
target_11 = CreateTarget(Plane=move_3.Geometry, Motion=list_12, Tool=tool.Tool, Speed=panel_113, Zone=panel_115, IsCartesian=True)  # disabled
target_12 = CreateTarget(Plane=move_2.Geometry, Motion=list_10, Tool=tool.Tool, Speed=panel_110, Zone=panel_111, IsCartesian=True)  # disabled
merge_10 = Merge(
    Data1=flatten(target),
    Data2=flatten(target_12),
    Data3=flatten(target_10),
    Data4=flatten(target_11),
    Data6=flatten(target))  # disabled

# ---- group: Robot Table display
abb_table_iaac = Geometry(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)  # disabled
swatch_7 = ColourSwatch(SwatchColor=RGBA(255, 255, 255, 9))  # disabled

# ----
mesh_6 = Mesh(abb_table_iaac)  # disabled

# ---- group: Robot Table display (continued)
preview_8 = CustomPreview(Geometry=mesh_6, Shader=swatch_7)  # disabled
