# Grasshopper definition training_validation_code.gh (Grasshopper 1.0.7)
# plug-ins: Bifocals, Owl.GH, Owl.Accord.GH

path = FilePath("C:\Users\Arpan\Desktop\Data collection for NN - test1 05.05.21 - Copy\fewpoints.csv")
file = ReadFile(File=path, PerLineParse=True)
split = TextSplit(Text=file, Separators=",")
list_item = ListItem(List=split, Index="0", Wrap=True)
list_item_2 = ListItem(List=split, Index="1", Wrap=True)
list_item_3 = ListItem(List=split, Index="3", Wrap=True)
list_item_4 = ListItem(List=split, Index="2", Wrap=True)
list_item_5 = ListItem(List=split, Index="4", Wrap=True)
list_item_6 = ListItem(List=split, Index="5", Wrap=True)
construct_point = ConstructPoint(XCoordinate=list_item_3, YCoordinate=list_item_5, ZCoordinate=list_item_6)
construct_point_2 = ConstructPoint(XCoordinate=list_item, YCoordinate=list_item_2, ZCoordinate=list_item_4)
panel = Panel("""0
1
2
3
4
5""")
cull_index = CullIndex(List=split, Indices=panel, Wrap=True)
merge = Merge(Data1=construct_point_2, Data2=construct_point)
panel_2 = Panel("""6
7
8
9
10
11""")
panel_3 = Panel("""0
1
2
3
4
5""")
panel_4 = Panel(file)
item = ListItem(List=split, Index=panel_3, Wrap=True)
item_2 = ListItem(List=split, Index=panel_2, Wrap=True)
panel_5 = Panel(item_2)
tensor = ConstructTensor(Values=merge)
tensor_2 = ConstructTensor(Values=item_2)
feature_tensorset = FeatureTensorSet(Feature0=flatten(tensor_2))
feature_tensorset_2 = FeatureTensorSet(Feature0=flatten(tensor))
list_length = ListLength(List=flatten(tensor))
list_length_2 = ListLength(List=flatten(tensor_2))
lng = ListLength()  # -> flatten(Length); disabled
merge_2 = Merge(Data1=list_length, Data2="26", Data3=list_length_2)
item_3 = ListItem(List=lng, Index=0, Wrap=True)  # disabled
panel_6 = Panel(feature_tensorset_2)
panel_7 = Panel(feature_tensorset)
network = ConstructNetwork(Layers=merge_2, Activation=0, Alpha=Slider(0.5, range=0..5), Seed=123)
panel_8 = Panel(merge_2)
backpropagation = Backpropagation(
    ActivationNetwork=network,
    Input=feature_tensorset_2,
    Output=feature_tensorset,
    LearningRate=0.01,
    Momentum=0.001,
    Epoch=10,
    Iterations=100)  # -> ActivationNetwork, Error
panel_9 = Panel("1")  # disabled
panel_10 = Panel("D:\Arpan\Personal\IAAC\3rd Semester\Software III\Project\06.05.2021\test_NN")
panel_11 = Panel(backpropagation.Error)
galapagos = Galapagos(fitness=num)
num = Number(backpropagation.Error)  # disabled
branch = TreeBranch(Tree=tensor, Path=panel_9, MaintainPaths=True)  # disabled
network_2 = SaveNetwork(ActivationNetwork=backpropagation.ActivationNetwork, FilePath=panel_10)

panel_12 = Panel("D:\Arpan\Personal\IAAC\3rd Semester\Workshop 3.1\Group work\Day 04\Final_ML_Model")  # disabled
network_3 = LoadNetwork(FilePath=panel_12)  # disabled
compute = Compute(ActivationNetwork=network_3, Input=branch)  # disabled
detset = DeconstructTensorSet(TensorSet=compute)  # disabled
detensor = DeconstructTensor(Tensor=detset)  # disabled
panel_13 = Panel(detensor)  # disabled

network_preview = NetworkPreview(Network=network, Lines=Domain(1, 5), Radius=5)
_2dpreview = NetworkPreview(Network=backpropagation.ActivationNetwork, Lines=Domain(1, 5), Radius=5)  # disabled
