# Grasshopper definition 20210414_mediapipe-mqtt-gh.gh (Grasshopper 1.0.7)
# plug-ins: GHMQTT Info, Robots

screen_width = Panel("640")
screen_heigth = Panel("480")
rectangle = Rectangle(Plane=PlaneXY(0, 0, 0), XSize=screen_width, YSize=screen_heigth, Radius=0)  # -> Rectangle, Length
xy = XYPlane(Origin=Point(0, 0, 0))
debrep = DeconstructBrep(Brep=rectangle.Rectangle)  # -> Faces, Edges, Vertices
item = ListItem(List=debrep.Vertices, Index=0, Wrap=True)  # -> Item, Item1, Item2, Item3
number_slider = Slider(20, range=0..100)
number_slider_2 = Slider(18, range=0..100)
aligndim = AlignedDimension(Plane=xy, PointA=item.Item3, PointB=item.Item2, Offset=number_slider, Text="Width :640", Size=number_slider_2)
aligndim_2 = AlignedDimension(Plane=xy, PointA=item.Item, PointB=item.Item3, Offset=number_slider, Text="Heigth :480", Size=number_slider_2)

# ----
# Elbow angle
panel = Panel("mqtt://localhost:1883/left/elbowangle")  # disabled
# Waist
panel_2 = Panel("mqtt://localhost:1883/left/waist")
# Shoulder
panel_3 = Panel("mqtt://localhost:1883/left/shoulder")
# Elbow
panel_4 = Panel("mqtt://localhost:1883/left/elbow")
# Wrist
# Wrist
panel_5 = Panel("mqtt://localhost:1883/left/wrist")
panel_6 = Panel("mqtt://localhost:1883/left/shoulderangle")  # disabled
trigger = Trigger(TimerInterval=1000, Target=[mqtt_4, mqtt_3, mqtt_5, mqtt_6, mqtt, mqtt_2])
mqtt = MQTT(BrokerURI=panel)  # -> Value, Payload; disabled
mqtt_2 = MQTT(BrokerURI=panel_6)  # -> Value, Payload; disabled
mqtt_3 = MQTT(BrokerURI=panel_3)  # -> Value, Payload
mqtt_4 = MQTT(BrokerURI=panel_2)  # -> Value, Payload
mqtt_5 = MQTT(BrokerURI=panel_4)  # -> Value, Payload
mqtt_6 = MQTT(BrokerURI=panel_5)  # -> Value, Payload
mqtt_7 = MQTT(BrokerURI="mqtt://localhost:1883/left/wrist")  # -> Value, Payload
panel_7 = Panel(mqtt_3.Value)
panel_8 = Panel(mqtt_4.Value)
panel_9 = Panel(mqtt_5.Value)
panel_10 = Panel(mqtt_6.Value)
panel_11 = Panel(mqtt_7.Payload)
panel_12 = Panel(mqtt.Payload)  # disabled
panel_13 = Panel(mqtt.Value)  # disabled
panel_14 = Panel(mqtt_2.Value)  # disabled
panel_15 = Panel(mqtt_2.Payload)  # disabled
split = TextSplit(Text=mqtt_3.Payload, Separators=",")
split_2 = TextSplit(Text=mqtt_4.Payload, Separators=",")
split_3 = TextSplit(Text=mqtt_5.Payload, Separators=",")
split_4 = TextSplit(Text=mqtt_6.Payload, Separators=",")
panel_16 = Panel(split_2)
txt = Text(split_2)
txt_2 = Text(split)
txt_3 = Text(split_3)
txt_4 = Text(split_4)
panel_17 = Panel("""x
y
z
:""")
panel_18 = Panel("""x
y
z
:""")
panel_19 = Panel("""x
y
z
:""")
panel_20 = Panel("""x
y
z
:""")
split_5 = TextSplit(Text=txt, Separators=panel_17)
panel_21 = Panel(split_5)
split_6 = TextSplit(Text=txt_2, Separators=panel_18)
split_7 = TextSplit(Text=txt_3, Separators=panel_19)
split_8 = TextSplit(Text=txt_4, Separators=panel_20)
num = Number(split_5)
panel_22 = Panel(num)
num_2 = Number(split_6)
num_3 = Number(split_7)
num_4 = Number(split_8)
clean = CleanTree(RemoveNulls=True, RemoveInvalid=True, RemoveEmpty=False, Tree=num)
clean_2 = CleanTree(RemoveNulls=True, RemoveInvalid=True, RemoveEmpty=False, Tree=num_2)
clean_3 = CleanTree(RemoveNulls=True, RemoveInvalid=True, RemoveEmpty=False, Tree=num_3)
clean_4 = CleanTree(RemoveNulls=True, RemoveInvalid=True, RemoveEmpty=False, Tree=num_4)
item_2 = ListItem(List=clean, Index=0, Wrap=True)  # -> Item, Item1, Item2
point = Point()  # disabled
item_3 = ListItem(List=clean_2, Index=0, Wrap=True)  # -> Item, Item1, Item2
item_4 = ListItem(List=clean_3, Index=0, Wrap=True)  # -> Item, Item1, Item2
item_5 = ListItem(List=clean_4, Index=0, Wrap=True)  # -> Item, Item1, Item2
number_slider_3 = Slider(0, range=0..1)
X = Number(item_2.Item)
Y = Number(item_2.Item1)
Z = Number(item_2.Item2)
X_2 = Number(item_3.Item)
Y_2 = Number(item_3.Item1)
Z_2 = Number(item_3.Item2)
X_3 = Number(item_4.Item)
Y_3 = Number(item_4.Item1)
Z_3 = Number(item_4.Item2)
X_4 = Number(item_5.Item)
Y_4 = Number(item_5.Item1)
Z_4 = Number(item_5.Item2)
screen_heigth_2 = Panel("480")
screen_width_2 = Panel("640")
screen_heigth_3 = Panel("480")
screen_width_3 = Panel("640")
screen_width_4 = Panel("640")
screen_heigth_4 = Panel("480")
screen_width_5 = Panel("640")
screen_heigth_5 = Panel("480")
multiplication = Multiplication(A=screen_width_2, B=X)
multiplication_2 = Multiplication(A=screen_heigth_3, B=Y)
multiplication_3 = Multiplication(A=screen_width_3, B=X_2)
multiplication_4 = Multiplication(A=screen_heigth_2, B=Y_2)
multiplication_5 = Multiplication(A=screen_width_4, B=X_3)
multiplication_6 = Multiplication(A=screen_heigth_4, B=Y_3)
multiplication_7 = Multiplication(A=screen_width_5, B=X_4)
multiplication_8 = Multiplication(A=screen_heigth_5, B=Y_4)
subtraction = Subtraction(A=screen_heigth_2, B=multiplication_2)
subtraction_2 = Subtraction(A=screen_heigth_2, B=multiplication_4)
subtraction_3 = Subtraction(A=screen_heigth_4, B=multiplication_6)
subtraction_4 = Subtraction(A=screen_heigth_5, B=multiplication_8)
pt = ConstructPoint(XCoordinate=multiplication, YCoordinate=subtraction, ZCoordinate=number_slider_3)
pt_2 = ConstructPoint(XCoordinate=multiplication_3, YCoordinate=subtraction_2, ZCoordinate=number_slider_3)
pt_3 = ConstructPoint(XCoordinate=multiplication_5, YCoordinate=subtraction_3, ZCoordinate=number_slider_3)
pt_4 = ConstructPoint(XCoordinate=multiplication_7, YCoordinate=subtraction_4, ZCoordinate=number_slider_3)
panel_23 = Panel(pt_4)
tag = TextTag3D(Location=pt, Text="Waist", Size=10, Justification=7)
tag_2 = TextTag3D(Location=pt_2, Text="Shoulder", Size=10, Justification=7)
tag_3 = TextTag3D(Location=pt_3, Text="Elbow", Size=10, Justification=7)
tag_4 = TextTag3D(Location=pt_4, Text="Wrist", Size=10, Justification=7)
point_2 = Point(pt_4)
data_recorder = DataRecorder(point_2, DataLimit=-10, RecordData=False)
panel_24 = Panel(data_recorder)
pline = PolyLine(Vertices=[pt_4, pt_3, pt_2, pt], Closed=False)
dots = DotDisplay(Point=[pt, pt_2, pt_3, pt_4], Colour=RGB(0, 0, 0), Size=10)
panel_25 = Panel(mqtt.Payload)
panel_26 = Panel(mqtt_2.Payload)

# ---- group: Robot settings
list = ValueList({"AA-KR60", "AA-KR30", "AA-KR60_KR30", "AARCH IRB120", "AARCH IRB6620", "Bartlett-IRB120", "Bartlett-IRB1600", "Bartlett-KR6", "Bartlett-KR60", "Bartlett-UR10", "Bigli-KR20", "ETH-Gantry", "Grymsdyke-IRB120", "Grymsdyke-KR210", "iaac-KR150-2_110", "iaac-IRB140", "iaac-IRB120", "EXArchitects-IRB6700", "KULeuven-IRB120", "KULeuven-UR5", "KULeuven-UR10", "IRB4600-205", "UEL IRB6620", "uem-IRB120", "uem-IRB1600", "uem-IRB2600", "uem-IRB1600_IRB2600", "UniMelb-IRB120", "UniMelb-IRB1200"}, selected="iaac-IRB140")
xy_2 = XYPlane(Origin=Point(0, 0, 0))
load_robot = LoadRobotSystem(Name=list, Base=xy_2)
speed = Panel("250")
zone = Panel("10")

# ----
gripper = Geometry(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)

# ---- group: Outside Cut
point_3 = Point(<point referenced from the Rhino model>)
brep = Brep(<brep referenced from the Rhino model>)
xy_3 = XYPlane(Origin=point_3)
mesh_brep = MeshBrep(
    Brep=brep,
    Settings={GridMaxCount=0, GridMinCount=16, JaggedSeams=False, MaxEdgeLength=0, MinEdgeLength=0.0001, MinTolerance=0, Refine=True, RefineAngle=0, RelativeTolerance=0.65, SimplePlanes=True, Tolerance=0})  # -> flatten(Mesh)
pflip = FlipPlane(Plane=xy_3, ReverseX=False, ReverseY=False, SwapAxes=True)
mesh = Mesh(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)  # disabled
tool = CreateTool(Name="WnC_gripper", TCP=pflip, Weight=0, Mesh=mesh_brep)  # -> Tool, TCP

# ---- group: Start and Stop position
elbow = Slider(0, range=-90..90)
shoulder = Slider(24, range=-90..90)
merge = Merge(
    Data1=Slider(90, range=-90..90),
    Data2=reverse(shoulder),
    Data3=reverse(elbow),
    Data4=Slider(0, range=-90..90),
    Data5=Slider(0, range=-90..90),
    Data6=Slider(180, range=-180..180))
degtorad = DegreesToRadians(Degrees=merge, RobotSystem=load_robot, MechanicalGroup=0)
target = CreateTarget(Joints=degtorad, Tool=tool.Tool, IsCartesian=False)

# ----
mesh_2 = Mesh(gripper)
preview = CustomPreview(Geometry=mesh_2, Shader=ColourSwatch(SwatchColor=RGBA(30, 0, 36, 137)))

point_4 = Point(<point referenced from the Rhino model>)
point_5 = Point(pt_4)
deconstruct = Deconstruct(Point=point_5)  # -> XComponent, YComponent, ZComponent
panel_27 = Panel(deconstruct.YComponent)
remap_numbers = RemapNumbers(Value=deconstruct.YComponent, Source="0 to 480", Target=" 0 to 1")  # -> Mapped, Clipped
remap_numbers_2 = RemapNumbers(Value=deconstruct.XComponent, Source="0 to 640", Target=" 0 to 1")  # -> Mapped, Clipped
negative = Negative(Value=remap_numbers.Mapped)
panel_28 = Panel(remap_numbers_2.Mapped)
construct_point = ConstructPoint(XCoordinate=panel_28, YCoordinate=remap_numbers.Mapped, ZCoordinate=0)
surface = Surface(rectangle.Rectangle)
curve = Curve(<curve referenced from the Rhino model>)
surface_2 = Surface(curve)
evaluate_surface = EvaluateSurface(Surface=reparameterize(surface))  # -> Point, Normal, UDirection, VDirection, Frame
evaluate_surface_2 = EvaluateSurface(Surface=reparameterize(surface_2), Point=construct_point)  # -> Point, Normal, UDirection, VDirection, Frame
point_6 = Point(<point referenced from the Rhino model>)  # disabled
point_7 = Point(<point referenced from the Rhino model>)  # disabled
point_8 = Point(<point referenced from the Rhino model>)  # disabled
point_9 = Point(<point referenced from the Rhino model>)  # disabled
point_10 = Point(evaluate_surface.Point)
list_2 = ValueList({"Joint", "Linear"}, selected="Linear")  # disabled
list_3 = ValueList({"Joint", "Linear"}, selected="Joint")  # disabled
list_4 = ValueList({"Joint", "Linear"}, selected="Joint")  # disabled
list_5 = ValueList({"Joint", "Linear"}, selected="Joint")  # disabled
point_11 = Point(<point referenced from the Rhino model>)
panel_29 = Panel("100")  # disabled
panel_30 = Panel("100")  # disabled
panel_31 = Panel("100")  # disabled
panel_32 = Panel("10")  # disabled
panel_33 = Panel("10")  # disabled
panel_34 = Panel("10")  # disabled
list_6 = ValueList({"Joint", "Linear"}, selected="Joint")
target_2 = CreateTarget(Plane=point_7, Motion=list_3, Tool=tool.Tool, Speed=panel_30, Zone=panel_33, IsCartesian=True)  # disabled
target_3 = CreateTarget(Plane=point_8, Motion=list_4, Tool=tool.Tool, Speed=panel_31, Zone=panel_34, IsCartesian=True)  # disabled
target_4 = CreateTarget(Plane=point_6, Motion=list_2, Tool=tool.Tool, Speed=panel_29, Zone=panel_32, IsCartesian=True)  # disabled
target_5 = CreateTarget(Plane=point_9, Motion=list_5, Tool=tool.Tool, Speed="100", Zone="10", IsCartesian=True)  # disabled
target_6 = CreateTarget(Plane=evaluate_surface_2.Point, Motion=list_6, Tool=tool.Tool, Speed="100", Zone="10", IsCartesian=True)
merge_2 = Merge(Data1=flatten(target), Data2=target_6, Data3=flatten(target))

# ----
# ROBOT SETUP
panel_35 = Panel("picknplace")
program = CreateProgram(Name=panel_35, RobotSystem=load_robot, Targets1=flatten(merge_2), StepSize=1)  # -> Program, Code, Duration, Warnings, Errors
check_errors = Panel(program.Errors)
to_export_code_file_prg = Panel(program.Code)
sim = ProgramSimulation(Program=program.Program, Time=Slider(0.501, range=0..1), Normalized=True)  # -> SystemMeshes, JointRotations, Plane, Index, Time, Program, Errors

collisions = CheckCollisions(Program=program.Program, FirstSet=7, SecondSet=4, EnvironmentPlane=-1, LinearStepSize=100, AngularStepSize=0.7853981634)  # -> CollisionFound, TargetIndex, CollidedMeshes
panel_36 = Panel(collisions.CollisionFound)

panel_37 = Panel(sim.Index)
time_seconds = Panel(sim.Time)

# ---- group: Display simulation
trail = SimpleTrail(Program=sim.Program, Length=500, MechanicalGroup=0)
preview_2 = CustomPreview(Geometry=trail, Shader=ColourSwatch(SwatchColor=RGB(255, 0, 0)))

# ---- group: to export file
txt_5 = Text(flatten(program.Code))
path = FilePath("D:\\")
file_name = Panel("WirenClay_08")
python = GhPythonScript(program=txt_5, path=path, name=file_name, write=Button())  # -> out, a; inputs program: list
# ---------- python: Python ----------
__author__ = "kunal"
__version__ = "2018.10.16"

import rhinoscriptsyntax as rs

if write:
    with open(path + name + '.prg', 'w') as file:
        for line in program:
            file.write(line)
            file.write('\n')
# ---------- end python ----------

# ----
# DISPLAY SETUP
split_9 = SplitList(List=sim.SystemMeshes, Index="7")  # -> ListA, ListB
swatch = ColourSwatch(SwatchColor=RGB(71, 71, 71))

pedestal = Geometry(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)
mesh_3 = Mesh(pedestal)
preview_3 = CustomPreview(Geometry=mesh_3, Shader=swatch)

preview_4 = CustomPreview(Geometry=split_9.ListB, Shader=swatch)
preview_5 = CustomPreview(Geometry=split_9.ListA, Shader=ColourSwatch(SwatchColor=RGBA(30, 0, 36, 137)))

# ---- group: useless stuff
rectanguloid = Geometry(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)
rectanguloid_2 = Geometry(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)
team_dirt_01 = Geometry(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)
gripper_point = Point(Point(575, -3.995, 254.9843858))
range = Range(Domain="0.01 to 0.99", Steps=Slider(17, range=0..100))
pt_5 = ConstructPoint(XCoordinate=range, YCoordinate=Slider(0.5, range=0..1), ZCoordinate=0)
Z_5 = UnitZ(Factor=Slider(322, range=0..1000))
Z_6 = UnitZ(Factor=Slider(100, range=0..100))
list_7 = ValueList({"Joint", "Linear"}, selected="Joint")
list_8 = ValueList({"Joint", "Linear"}, selected="Linear")
list_9 = ValueList({"Joint", "Linear"}, selected="Joint")
list_10 = ValueList({"Joint", "Linear"}, selected="Joint")

cylinder = Geometry(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)
bbox = BoundingBox(Content=cylinder, Plane=PlaneXY(0, 0, 0), UnionBox=True)  # -> Box, Box_2
debrep_2 = DeconstructBrep(Brep=bbox.Box)  # -> Faces, Edges, Vertices
item_6 = ListItem(List=reverse(debrep_2.Faces), Index=0, Wrap=True)  # -> Item, Item1, Item2
area = Area(Geometry=item_6.Item)  # -> Area, Centroid
area_2 = Area(Geometry=item_6.Item1)  # -> Area, Centroid
ln = Line(StartPoint=area.Centroid, EndPoint=area_2.Centroid)  # -> reverse(Line)
curvepoint = PointOnCurve(ln, parameter=1)
orient = Orient(Geometry=cylinder, Source=curvepoint, Target=gripper_point)  # -> Geometry, Transform

bbox_2 = BoundingBox(Content=team_dirt_01, Plane=PlaneXY(0, 0, 0), UnionBox=True)  # -> Box, Box_2
debrep_3 = DeconstructBrep(Brep=bbox_2.Box)  # -> Faces, Edges, Vertices
item_7 = ListItem(List=reverse(debrep_3.Faces), Index=0, Wrap=True)  # -> Item, Item1, Item2
area_3 = Area(Geometry=item_7.Item)  # -> Area, Centroid
area_4 = Area(Geometry=item_7.Item1)  # -> Area, Centroid
ln_2 = Line(StartPoint=area_3.Centroid, EndPoint=area_4.Centroid)  # -> reverse(Line)
curvepoint_2 = PointOnCurve(ln_2, parameter=0.641)
orient_2 = Orient(Geometry=team_dirt_01, Source=curvepoint_2, Target=PlaneXY(0, 0, 0))  # -> Geometry, Transform

preview_6 = CustomPreview(Geometry=orient.Geometry, Material=ColourSwatch(SwatchColor=RGBA(145, 145, 145, 88)))
preview_7 = CustomPreview(Geometry=orient_2.Geometry, Material=ColourSwatch(SwatchColor=RGBA(117, 117, 117, 88)))
brep_2 = Brep(orient_2.Geometry)
debrep_4 = DeconstructBrep(Brep=brep_2)  # -> Faces, Edges, Vertices
item_8 = ListItem(List=debrep_4.Edges, Index=0, Wrap=True)  # -> Item, Item1
flip = FlipCurve(Curve=item_8.Item1)  # -> Curve, Flag
rulesrf = RuledSurface(CurveA=item_8.Item, CurveB=flip.Curve)
evalsrf = EvaluateSurface(Surface=reparameterize(rulesrf), Point=pt_5)  # -> Point, Normal, UDirection, VDirection, Frame
rotate = Rotate(Geometry=evalsrf.Frame, Angle=1.570796327, Plane=evalsrf.Frame)  # -> Geometry, Transform
deplane = DeconstructPlane(Plane=rotate.Geometry)  # -> Origin, XAxis, YAxis, ZAxis
rev = Reverse(Vector=deplane.ZAxis)
devec = DeconstructVector(Vector=rev)  # -> XComponent, YComponent, ZComponent
vec = VectorXYZ(XComponent=devec.XComponent, YComponent=devec.YComponent, ZComponent=Slider(0, range=0..1))  # -> Vector, Length
padjust = AdjustPlane(Plane=rotate.Geometry, Normal=vec.Vector)
rev_2 = ReverseList(List=padjust)
item_9 = ListItem(List=rev_2, Index="-1", Wrap=True)
item_10 = ListItem(List=rev_2, Index=0, Wrap=True)
move = Move(Geometry=item_9, Motion=Z_5)  # -> Geometry, Transform
deplane_2 = DeconstructPlane(Plane=move.Geometry)  # -> Origin, XAxis, YAxis, ZAxis
amp = Amplitude(Vector=deplane_2.ZAxis, Amplitude=Slider(100, range=0..100))
move_2 = Move(Geometry=item_10, Motion=Z_6)  # -> Geometry, Transform
move_3 = Move(Geometry=move.Geometry, Motion=amp)  # -> Geometry, Transform
target_7 = CreateTarget(Plane=rev_2, Motion=list_8, Tool=tool.Tool, Speed="100", Zone="10", IsCartesian=True)
target_8 = CreateTarget(Plane=move_3.Geometry, Motion=list_9, Tool=tool.Tool, Speed="100", Zone="10", IsCartesian=True)
target_9 = CreateTarget(Plane=move_2.Geometry, Motion=list_7, Tool=tool.Tool, Speed="100", Zone="10", IsCartesian=True)
merge_3 = Merge(Data1=flatten(target), Data2=flatten(target_9), Data3=flatten(target_7), Data4=flatten(target_8), Data6=flatten(target))

# ---- group: Robot Table display
abb_table_iaac = Geometry(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)

# ----
mesh_4 = Mesh(abb_table_iaac)

# ---- group: Robot Table display (continued)
preview_8 = CustomPreview(Geometry=mesh_4, Shader=ColourSwatch(SwatchColor=RGBA(255, 255, 255, 9)))
