# Grasshopper definition NN mapping - test1.gh (Grasshopper 1.0.7)
# plug-ins: Robots, AstarPathFinder, Owl.GH, Owl.Accord.GH, Anemone

# ---- group: Simulation and data
crv = Curve(<curve referenced from the Rhino model>)
arrrec = RectangularArray(Geometry=crv, Cell=crv, XCount="-15", YCount="-20")  # -> Geometry, Transform
area = Area(Geometry=arrrec.Geometry)  # -> Area, Centroid
preview = CustomPreview(Geometry=arrrec.Geometry, Material=ColourSwatch(SwatchColor=RGB(171, 171, 171)))
points = PointList(Points=area.Centroid, Size=8)

crv_2 = Curve(<curve referenced from the Rhino model>)
arrrec_2 = RectangularArray(Geometry=crv_2, Cell=crv_2, XCount="-15", YCount="-20")  # -> Geometry, Transform
area_2 = Area(Geometry=arrrec_2.Geometry)  # -> Area, Centroid
points_2 = PointList(Points=area_2.Centroid)
preview_2 = CustomPreview(Geometry=arrrec_2.Geometry, Material=ColourSwatch(SwatchColor=RGB(171, 171, 171)))

# ---- group: Simulation and data / Robot
elbow = Slider(0, range=-90..90)
shoulder = Slider(-90, range=-90..90)
point = Point(<point referenced from the Rhino model>)
mesh = Mesh(<mesh referenced from the Rhino model>)
list = ValueList({"AA-KR60", "AA-KR30", "AA-KR60_KR30", "AARCH IRB120", "AARCH IRB6620", "AAU-Utzon-UR10", "Automata", "Bartlett-IRB120", "Bartlett-IRB1600", "Bartlett-KR6"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}, selected="KULeuven-UR10e")
xy = XYPlane(Origin=point)
xy_2 = XYPlane(Origin=Point(0, 0, 0))
merge = Merge(
    Data1=Slider(0, range=-90..90),
    Data2=reverse(shoulder),
    Data3=reverse(elbow),
    Data4=Slider(0, range=-90..90),
    Data5=Slider(0, range=-90..90),
    Data6=Slider(0, range=-180..180))
load_robot_system = LoadRobotSystem(Name=list, Base=xy_2)
pflip = FlipPlane(Plane=xy, ReverseX=False, ReverseY=False, SwapAxes=True)
degtorad = DegreesToRadians(Degrees=merge, RobotSystem=load_robot_system, MechanicalGroup=0)
tool = CreateTool(Name="WnC_gripper", TCP=pflip, Weight=0, Mesh=mesh)  # -> Tool, TCP
target = CreateTarget(Joints=degtorad, Tool=tool.Tool, IsCartesian=False)

# ---- group: YPR
path = FilePath("D:\Arpan\Personal\IAAC\Practice\Gh\Studio data 18.05.21 - NN mapping\New folder\Yaw pitch roll.csv")

# ---- group: Hand Area Coordinates
path_2 = FilePath("D:\Arpan\Personal\IAAC\Practice\Gh\Studio data 18.05.21 - NN mapping\New folder\Hand grid coordinates.csv")
file = ReadFile(File=path_2, PerLineParse=True)  # -> graft(Content)

# ---- group: Grid number
path_3 = FilePath("D:\Arpan\Personal\IAAC\Practice\Gh\Studio data 18.05.21 - NN mapping\New folder\Grid No.csv")
file_2 = ReadFile(File=path_3, PerLineParse=True)  # -> graft(Content)

# ---- group: Robot Joints
path_4 = FilePath("D:\Arpan\Personal\IAAC\Practice\Gh\Studio data 18.05.21 - NN mapping\New folder\Robot joints.csv")
file_3 = ReadFile(File=path_4, PerLineParse=True)
cluster = Cluster_3(list=file_3, list_2=file_3, list_3=file_3, list_4=file_3, list_5=file_3, list_6=file_3)  # -> i, i_2, i_3, i_4, i_5, i_6

# ---- group: Robot Area Coordinates
path_5 = FilePath("D:\Arpan\Personal\IAAC\Practice\Gh\Studio data 18.05.21 - NN mapping\csv\split dataset for NN\Robot grid coordinates.csv")
file_4 = ReadFile(File=path_5, PerLineParse=True)
deconstruct = Deconstruct(Point=file_4)  # -> XComponent, YComponent, ZComponent

# ---- group: YPR / Read File
file_5 = ReadFile(File=path, PerLineParse=True)
cluster_2 = Cluster_4(list=file_5, list_2=file_5, list_3=file_5)  # -> graft(i), graft(i_2), graft(i_3)

# ----
deconstruct_2 = Deconstruct(Point=file)  # -> XComponent, YComponent, ZComponent
flip_matrix = FlipMatrix(Data=deconstruct_2.XComponent)
flip_matrix_2 = FlipMatrix(Data=deconstruct_2.YComponent)
bounds = Bounds(Numbers=flip_matrix)
bounds_2 = Bounds(Numbers=flip_matrix_2)
remap_numbers = RemapNumbers(Value=deconstruct_2.XComponent, Source=bounds, Target=Domain(0, 1))  # -> Mapped, Clipped
remap_numbers_2 = RemapNumbers(Value=deconstruct_2.YComponent, Source=bounds_2, Target=Domain(0, 1))  # -> Mapped, Clipped

flip_matrix_3 = FlipMatrix(Data=cluster_2.i_2)
flip_matrix_4 = FlipMatrix(Data=cluster_2.i)
flip_matrix_5 = FlipMatrix(Data=cluster_2.i_3)
bounds_3 = Bounds(Numbers=flip_matrix_3)
bounds_4 = Bounds(Numbers=flip_matrix_4)
bounds_5 = Bounds(Numbers=flip_matrix_5)
remap_numbers_3 = RemapNumbers(Value=cluster_2.i_2, Source=bounds_3, Target=Domain(0, 1))  # -> Mapped, Clipped
remap_numbers_4 = RemapNumbers(Value=cluster_2.i, Source=bounds_4, Target=Domain(0, 1))  # -> Mapped, Clipped
remap_numbers_5 = RemapNumbers(Value=cluster_2.i_3, Source=bounds_5, Target=Domain(0, 1))  # -> Mapped, Clipped

panel = Panel(deconstruct_2.XComponent)
panel_2 = Panel(remap_numbers_5.Mapped)
remap_numbers_6 = RemapNumbers(Value=remap_numbers.Mapped, Source=remap_numbers.Mapped, Target=deconstruct_2.XComponent)  # -> Mapped, Clipped

# ---- group: Simulation and data
# ROBOT SETUP
# DISPLAY SETUP
read_file = ReadFile(File="G:\firefox download\full_q1\bag1,2,3-combined.csv", PerLineParse=True)
panel_3 = Panel(read_file)
panel_4 = Panel("""X: 
Y: 
Z: 
Pitch:
Roll:
Yaw: """)
panel_5 = Panel("""9
14
19
28
36
43""")  # disabled
text_split = TextSplit(Text=read_file, Separators=panel_4)
list_item = ListItem(List=text_split, Index=0, Wrap=True)
deconstruct_3 = Deconstruct(Point=area.Centroid)  # -> XComponent, YComponent, ZComponent
tree_statistics = TreeStatistics(Tree=list_item)  # -> Paths, Length, Count
panel_6 = Panel(list_item)
flip_matrix_6 = FlipMatrix(Data=deconstruct_3.XComponent)
flip_matrix_7 = FlipMatrix(Data=deconstruct_3.ZComponent)
flip_matrix_8 = FlipMatrix(Data=deconstruct_3.YComponent)
cull_index = CullIndex(List=tree_statistics.Paths, Indices="0", Wrap=True)
bounds_6 = Bounds(Numbers=deconstruct_3.XComponent)
bounds_7 = Bounds(Numbers=deconstruct_3.ZComponent)
bounds_8 = Bounds(Numbers=deconstruct_3.YComponent)
tree_branch = TreeBranch(Tree=list_item, Path=cull_index, MaintainPaths=True)
text_split_2 = TextSplit(Text=tree_branch, Separators=",")
list_item_2 = ListItem(List=text_split_2, Index="2", Wrap=True)  # -> flatten(Item)
custom_preview = CustomPreview(
    Geometry=mesh,
    Material={diffuse=RGB(221, 160, 221), emission=RGB(66, 48, 66), shine=0.5, specular=RGB(255, 255, 255), transparency=0})
panel_7 = Panel(target)
point_2 = Point(<point referenced from the Rhino model>)
plane = Plane(point_2)
flip_plane = FlipPlane(Plane=plane, ReverseX=False, ReverseY=False, SwapAxes=True)
mesh_2 = Mesh(<mesh referenced from the Rhino model>)
surface = Surface(arrrec.Geometry)  # disabled
list_2 = ValueList({"Joint", "Linear"}, selected="Joint")  # disabled
panel_8 = Panel("100")  # disabled
list_3 = ValueList({"Joint", "Linear"}, selected="Joint")
path_6 = FilePath("D:\\")
file_name = Panel("WirenClay_08")
panel_9 = Panel("""6
7
8
9
10
11""")  # disabled
panel_10 = Panel("1")  # disabled
panel_11 = Panel("""3
4
5""")  # disabled
panel_12 = Panel("2")  # disabled

# ---- group: Simulation and data / XYZ YPR Controller
list_item_3 = ListItem(List=list_item_2, Index=Slider(84, range=0..84), Wrap=True)

# ---- group: Simulation and data / YPR
panel_13 = Panel("""24
32
39""")
list_item_4 = ListItem(List=text_split, Index=panel_13, Wrap=True)
tree_statistics_2 = TreeStatistics(Tree=list_item_4)  # -> Paths, Length, Count
cull_index_2 = CullIndex(List=tree_statistics_2.Paths, Indices="0", Wrap=True)
tree_branch_2 = TreeBranch(Tree=list_item_4, Path=cull_index_2, MaintainPaths=True)
tree_statistics_3 = TreeStatistics(Tree=tree_branch_2)  # -> Paths, Length, Count
list_item_5 = ListItem(List=tree_statistics_3.Paths, Index=list_item_3, Wrap=True)
tree_branch_3 = TreeBranch(Tree=list_item_4, Path=list_item_5, MaintainPaths=True)
list_item_6 = ListItem(List=tree_branch_3, Index=0, Wrap=True)  # -> Item, Item1, Item2

# ---- group: Simulation and data / XYZ
panel_14 = Panel("""5
10
15""")
list_item_7 = ListItem(List=text_split, Index=panel_14, Wrap=True)
tree_statistics_4 = TreeStatistics(Tree=list_item_7)  # -> Paths, Length, Count
cull_index_3 = CullIndex(List=tree_statistics_4.Paths, Indices="0", Wrap=True)
tree_branch_4 = TreeBranch(Tree=list_item_7, Path=cull_index_3, MaintainPaths=True)
tree_statistics_5 = TreeStatistics(Tree=tree_branch_4)  # -> Paths, Length, Count
list_item_8 = ListItem(List=tree_statistics_5.Paths, Index=list_item_3, Wrap=True)
tree_branch_5 = TreeBranch(Tree=list_item_7, Path=list_item_8, MaintainPaths=True)
list_item_9 = ListItem(List=tree_branch_5, Index=0, Wrap=True)  # -> Item, Item1, Item2

# ----
panel_15 = Panel(tree_branch_4)

# ---- group: Simulation and data
panel_16 = Panel(list_item_9.Item)
panel_17 = Panel(list_item_9.Item1)
panel_18 = Panel(list_item_9.Item2)

panel_19 = Panel(list_item_6.Item1)
panel_20 = Panel(list_item_6.Item)
panel_21 = Panel(list_item_6.Item2)

# ---- group: Simulation and data / matrix from YPR
creatematrixfromyawpitchroll = CreateMatrixFromYawPitchRoll(Yaw=panel_20, Pitch=panel_19, Roll=panel_21)
display_matrix = DisplayMatrix(creatematrixfromyawpitchroll)

# ---- group: Simulation and data / Robot plane rotation
list_item_10 = ListItem(List=area_2.Centroid, Index=list_item_3, Wrap=True)
plane_2 = Plane(list_item_10)
cluster_3 = Cluster(
    geometry=plane_2,
    angle=panel_21,
    center=list_item_10,
    angle_2=panel_19,
    center_2=list_item_10,
    angle_3=panel_20,
    center_3=list_item_10)

# ---- group: Simulation and data (continued)
list_item_11 = ListItem(List=area.Centroid, Index=list_item_3, Wrap=True)
panel_22 = Panel(tree_branch_2)
flip_matrix_9 = FlipMatrix(Data=tree_branch_4)
list_item_12 = ListItem(List=bounds_7, Index=list_item_3, Wrap=True)
list_item_13 = ListItem(List=bounds_8, Index=list_item_3, Wrap=True)
list_item_14 = ListItem(List=bounds_6, Index=list_item_3, Wrap=True)
bounds_9 = Bounds(Numbers=flip_matrix_9)
list_item_15 = ListItem(List=flatten(bounds_9), Index=0, Wrap=True)  # -> Item, Item1, Item2
construct_point = ConstructPoint(XCoordinate=panel_16, YCoordinate=panel_17, ZCoordinate=panel_18)
deconstruct_4 = Deconstruct(Point=construct_point)  # -> XComponent, YComponent, ZComponent
remap_numbers_7 = RemapNumbers(Value=deconstruct_4.XComponent, Source=list_item_15.Item, Target=bounds_6)  # -> Mapped, Clipped
remap_numbers_8 = RemapNumbers(Value=deconstruct_4.YComponent, Source=list_item_15.Item1, Target=bounds_8)  # -> Mapped, Clipped
remap_numbers_9 = RemapNumbers(Value=deconstruct_4.ZComponent, Source=list_item_15.Item2, Target=bounds_7)  # -> Mapped, Clipped
construct_point_2 = ConstructPoint(XCoordinate=remap_numbers_7.Mapped, YCoordinate=remap_numbers_8.Mapped, ZCoordinate=remap_numbers_9.Mapped)
orient = Orient(Geometry=mesh_2, Source=flip_plane, Target=construct_point)  # -> Geometry, Transform
plane_3 = Plane(construct_point)
merge_2 = Merge(Data1=plane_3, Data2=orient.Geometry)
orient_2 = Orient(Geometry=merge_2, Source=plane_3, Target=construct_point_2)  # -> Geometry, Transform
list_item_16 = ListItem(List=surface, Index=list_item_3, Wrap=True)  # disabled
evaluate_surface = EvaluateSurface(Surface=reparameterize(list_item_16), Point=construct_point_2)  # -> Point, Normal, UDirection, VDirection, Frame; disabled
panel_23 = Panel(construct_point_2)  # disabled
point_3 = Point(construct_point_2)  # disabled
# Simulation and data
target_2 = CreateTarget(Plane=point_3, Motion=list_2, Tool=tool.Tool, Speed=panel_8, IsCartesian=True)  # disabled
target_3 = CreateTarget(Plane=cluster_3, Motion=list_3, Tool=tool.Tool, Speed="100", IsCartesian=True)
merge_3 = Merge(Data1=flatten(target), Data2=target_3, Data3=flatten(target))
program = CreateProgram(Name="Studio", RobotSystem=load_robot_system, Targets1=flatten(merge_3), StepSize=1)  # -> Program, Code, Duration, Warnings, Errors
check_errors = Panel(program.Errors)
to_export_code_file_prg = Panel(program.Code)
sim = ProgramSimulation(Program=program.Program, Time=Slider(1, range=0..1), Normalized=True)  # -> SystemMeshes, JointRotations, Plane, Index, Time, Program, Errors
collisions = CheckCollisions(Program=program.Program, FirstSet=7, SecondSet=4, EnvironmentPlane=-1, LinearStepSize=100, AngularStepSize=0.7853981634)  # -> CollisionFound, TargetIndex, CollidedMeshes
list_item_17 = ListItem(List=sim.SystemMeshes, Index=Slider(7, range=0..10), Wrap=True)  # disabled
preview_3 = CustomPreview(Geometry=list_item_17, Shader=ColourSwatch(SwatchColor=RGB(0, 0, 0)))  # disabled
trail = SimpleTrail(Program=sim.Program, Length=500, MechanicalGroup=0)
panel_24 = Panel(collisions.CollisionFound)
panel_25 = Panel(sim.Index)
time_seconds = Panel(sim.Time)
txt = Text(flatten(program.Code))
split = SplitList(List=sim.SystemMeshes, Index="7")  # -> ListA, ListB
python = GhPythonScript(program=txt, path=path_6, name=file_name, write=Button())  # -> out, a; inputs program: list
# ---------- python: Python ----------
__author__ = "kunal"
__version__ = "2018.10.16"

import rhinoscriptsyntax as rs

if write:
    with open(path + name + '.prg', 'w') as file:
        for line in program:
            file.write(line)
            file.write('\n')
# ---------- end python ----------
preview_4 = CustomPreview(Geometry=trail, Shader=ColourSwatch(SwatchColor=RGB(255, 0, 0)))
preview_5 = CustomPreview(Geometry=split.ListB, Shader=ColourSwatch(SwatchColor=RGB(71, 71, 71)))
preview_6 = CustomPreview(Geometry=split.ListA, Shader=ColourSwatch(SwatchColor=RGBA(30, 0, 36, 137)))
entwine = Entwine(
    Branch00=list_item_3,
    Branch01=list_item_10,
    Branch02=construct_point_2,
    Branch03=panel_21,
    Branch04=panel_19,
    Branch05=panel_20,
    Branch06=sim.JointRotations,
    FlattenInputs=True)  # -> flatten(Result)
list_item_18 = ListItem(List=entwine, Index=0, Wrap=True)  # disabled
list_item_19 = ListItem(List=entwine, Index=panel_10, Wrap=True)  # disabled
list_item_20 = ListItem(List=entwine, Index=panel_12, Wrap=True)  # disabled
list_item_21 = ListItem(List=entwine, Index=panel_11, Wrap=True)  # disabled
list_item_22 = ListItem(List=entwine, Index=panel_9, Wrap=True)  # disabled
data_recorder = DataRecorder(list_item_19, DataLimit=-10, RecordData=False)  # disabled
data_recorder_2 = DataRecorder(list_item_21, DataLimit=-10, RecordData=False)  # disabled
data_recorder_3 = DataRecorder(list_item_20, DataLimit=-10, RecordData=False)  # disabled
data_recorder_4 = DataRecorder(list_item_18, DataLimit=-10, RecordData=False)  # disabled
data_recorder_5 = DataRecorder(list_item_22, DataLimit=-10, RecordData=False)  # disabled
robot_grid_point = Panel(list_item_22)  # disabled
s_no = Panel(data_recorder_4)  # disabled
robot_grid_point_2 = Panel(data_recorder)  # disabled
hand_grid_point = Panel(data_recorder_3)  # disabled
ypr = Panel(data_recorder_2)  # disabled
robot_joints = Panel(data_recorder_5)  # disabled

# ----
panel_26 = Panel(remap_numbers_9.Mapped)

# ---- group: Simulation and data / hand area plane rotation
cluster_4 = Cluster_2(
    geometry=orient_2.Geometry,
    angle=panel_21,
    center=construct_point_2,
    angle_2=panel_19,
    center_2=construct_point_2,
    angle_3=panel_20,
    center_3=construct_point_2)

# ---- group: Simulation and data (continued)
custom_preview_2 = CustomPreview(Geometry=cluster_4, Material=ColourSwatch(SwatchColor=RGB(99, 125, 111)))

# ---- group: Simulation and data / All inputs
panel_27 = Panel(entwine)  # disabled

# ----
graft_tree = GraftTree(Tree=cluster.i, IncludeEmptyLists=True, IncludeNullItems=True)
graft_tree_2 = GraftTree(Tree=cluster.i_2, IncludeEmptyLists=True, IncludeNullItems=True)
graft_tree_3 = GraftTree(Tree=cluster.i_4, IncludeEmptyLists=True, IncludeNullItems=True)
graft_tree_4 = GraftTree(Tree=cluster.i_5, IncludeEmptyLists=True, IncludeNullItems=True)
graft_tree_5 = GraftTree(Tree=cluster.i_3, IncludeEmptyLists=True, IncludeNullItems=True)
graft_tree_6 = GraftTree(Tree=cluster.i_6, IncludeEmptyLists=True, IncludeNullItems=True)
degrees = Degrees(Radians=graft_tree_4)
degrees_2 = Degrees(Radians=graft_tree_3)
degrees_3 = Degrees(Radians=graft_tree_6)
degrees_4 = Degrees(Radians=graft_tree_2)
degrees_5 = Degrees(Radians=graft_tree_5)
degrees_6 = Degrees(Radians=graft_tree)
flip_matrix_10 = FlipMatrix(Data=degrees_6)
flip_matrix_11 = FlipMatrix(Data=degrees_4)
flip_matrix_12 = FlipMatrix(Data=degrees_5)
flip_matrix_13 = FlipMatrix(Data=degrees_2)
flip_matrix_14 = FlipMatrix(Data=degrees_3)
flip_matrix_15 = FlipMatrix(Data=degrees)
bounds_10 = Bounds(Numbers=flip_matrix_10)
bounds_11 = Bounds(Numbers=flip_matrix_11)
bounds_12 = Bounds(Numbers=flip_matrix_12)
bounds_13 = Bounds(Numbers=flip_matrix_13)
bounds_14 = Bounds(Numbers=flip_matrix_14)
bounds_15 = Bounds(Numbers=flip_matrix_15)
remap_numbers_10 = RemapNumbers(Value=degrees_6, Source="-90 To 90", Target=Domain(0, 1))  # -> Mapped, Clipped
remap_numbers_11 = RemapNumbers(Value=degrees_4, Source="-180 To 0", Target=Domain(0, 1))  # -> Mapped, Clipped
remap_numbers_12 = RemapNumbers(Value=degrees_5, Source="-90 To 90", Target=Domain(0, 1))  # -> Mapped, Clipped
remap_numbers_13 = RemapNumbers(Value=degrees_3, Source="-90 To 90", Target=Domain(0, 1))  # -> Mapped, Clipped
remap_numbers_14 = RemapNumbers(Value=degrees, Source="-90 To 90", Target=Domain(0, 1))  # -> Mapped, Clipped
remap_numbers_15 = RemapNumbers(Value=degrees_2, Source="-90 To 90", Target=Domain(0, 1))  # -> Mapped, Clipped
feature_tensorset = FeatureTensorSet(
    Feature0=flatten(remap_numbers_10.Mapped),
    Feature1=flatten(remap_numbers_11.Mapped),
    Feature2=flatten(remap_numbers_12.Mapped),
    Feature3=flatten(remap_numbers_15.Mapped),
    Feature4=flatten(remap_numbers_14.Mapped),
    Feature5=flatten(remap_numbers_13.Mapped))
feature_tensorset_2 = FeatureTensorSet(
    Feature0=cluster.i,
    Feature1=cluster.i_2,
    Feature2=cluster.i_3,
    Feature3=cluster.i_4,
    Feature4=cluster.i_5,
    Feature5=cluster.i_6)
merge_4 = Merge(Data1=remap_numbers.Mapped, Data2=remap_numbers_2.Mapped, Data3=remap_numbers_4.Mapped, Data4=remap_numbers_3.Mapped)
feature_tensorset_3 = FeatureTensorSet(
    Feature0=flatten(remap_numbers.Mapped),
    Feature1=flatten(remap_numbers_2.Mapped),
    Feature2=flatten(remap_numbers_4.Mapped),
    Feature3=flatten(remap_numbers_3.Mapped),
    Feature4=flatten(remap_numbers_5.Mapped))
panel_28 = Panel(feature_tensorset)
panel_29 = Panel(feature_tensorset_2)
number_slider = Slider(4, range=0..10)
merge_5 = Merge(Data1="5", Data2=number_slider, Data3="6")
network = ConstructNetwork(Layers=merge_5, Activation=0, Alpha=Slider(2, range=0..5), Seed=123)
# Neural Network
panel_30 = Panel(network)
loop_start = LoopStart(Repeat=Slider(500, range=0..1000), Trigger=Button(), Data=network)  # -> port, Counter, Data, Data_2
panel_31 = Panel(loop_start.Counter)
galapagos = Galapagos(fitness=number, gene=number_slider)
number_slider_2 = Slider(21, range=0..83)
deconstruct_tensorset = DeconstructTensorSet(TensorSet=feature_tensorset_3)
panel_32 = Panel("D:\Arpan\Personal\IAAC\Practice\Gh\Studio data 18.05.21 - NN mapping\NN\1st-19.05.21\NN-studio-1st")
merge_6 = Merge(Data1=graft_tree, Data2=graft_tree_2, Data3=graft_tree_5, Data4=graft_tree_3, Data5=graft_tree_4, Data6=graft_tree_6)
list_item_23 = ListItem(List=merge_6, Index=number_slider_2, Wrap=True)
list_item_24 = ListItem(List=deconstruct_tensorset, Index=number_slider_2, Wrap=True)
panel_33 = Panel("D:\Arpan\Personal\IAAC\Practice\Gh\Studio data 18.05.21 - NN mapping\NN\1st-19.05.21\NN-studio-1st")
panel_34 = Panel(merge_6)
construct_tensorset = ConstructTensorSet(Tensors=list_item_24)
network_2 = LoadNetwork(FilePath=panel_33)
compute = Compute(ActivationNetwork=network_2, Input=construct_tensorset)
tensorset_display = TensorSetDisplay(TensorSet=compute, Range=Domain(0, 1))
detset = DeconstructTensorSet(TensorSet=compute)
panel_35 = Panel("-180 To 0")
panel_36 = Panel("-90 To 90")
detensor = DeconstructTensor(Tensor=detset)
panel_41 = Panel(detensor)
list_item_25 = ListItem(List=panel_41, Index=0, Wrap=True)  # -> Item, Item1, Item2, Item3, Item4, Item5

flip_matrix_16 = FlipMatrix(Data=graft_tree)
flip_matrix_17 = FlipMatrix(Data=graft_tree_2)
flip_matrix_18 = FlipMatrix(Data=graft_tree_5)
flip_matrix_19 = FlipMatrix(Data=graft_tree_3)
flip_matrix_20 = FlipMatrix(Data=graft_tree_4)
flip_matrix_21 = FlipMatrix(Data=graft_tree_6)
bounds_16 = Bounds(Numbers=flip_matrix_18)
bounds_17 = Bounds(Numbers=flip_matrix_19)
bounds_18 = Bounds(Numbers=flip_matrix_16)
bounds_19 = Bounds(Numbers=flip_matrix_17)
bounds_20 = Bounds(Numbers=flip_matrix_21)
bounds_21 = Bounds(Numbers=flip_matrix_20)
remap_numbers_16 = RemapNumbers(Value=graft_tree_2, Source=bounds_19, Target=Domain(0, 1))  # -> Mapped, Clipped
remap_numbers_17 = RemapNumbers(Value=graft_tree_5, Source=bounds_16, Target=Domain(0, 1))  # -> Mapped, Clipped
remap_numbers_18 = RemapNumbers(Value=graft_tree_6, Source=bounds_20, Target=Domain(0, 1))  # -> Mapped, Clipped
remap_numbers_19 = RemapNumbers(Value=graft_tree, Source=bounds_18, Target=Domain(0, 1))  # -> Mapped, Clipped
remap_numbers_20 = RemapNumbers(Value=graft_tree_4, Source=bounds_21, Target=Domain(0, 1))  # -> Mapped, Clipped
remap_numbers_21 = RemapNumbers(Value=graft_tree_3, Source=bounds_17, Target=Domain(0, 1))  # -> Mapped, Clipped
panel_42 = Panel(remap_numbers_10.Mapped)
feature_tensorset_4 = FeatureTensorSet(
    Feature0=flatten(remap_numbers_19.Mapped),
    Feature1=flatten(remap_numbers_16.Mapped),
    Feature2=flatten(remap_numbers_17.Mapped),
    Feature3=flatten(remap_numbers_21.Mapped),
    Feature4=flatten(remap_numbers_20.Mapped),
    Feature5=flatten(remap_numbers_18.Mapped))
panel_43 = Panel(remap_numbers_19.Mapped)

backpropagation = Backpropagation(
    ActivationNetwork=loop_start.Data,
    Input=feature_tensorset_3,
    Output=feature_tensorset_4,
    LearningRate=0.01,
    Momentum=0.001,
    Epoch=10,
    Iterations=100)  # -> ActivationNetwork, Error
merge_7 = Merge(Data1=loop_start.Data_2, Data2=backpropagation.Error)
panel_44 = Panel(backpropagation.Error)
number = Number(backpropagation.Error)
_2dpreview = NetworkPreview(Network=backpropagation.ActivationNetwork, Lines=Domain(1, 5), Radius=5)
network_3 = SaveNetwork(ActivationNetwork=backpropagation.ActivationNetwork, FilePath=panel_32)
remap_numbers_22 = RemapNumbers(Value=list_item_25.Item, Source=Domain(0, 1), Target=bounds_18)  # -> Mapped, Clipped
remap_numbers_23 = RemapNumbers(Value=list_item_25.Item1, Source=Domain(0, 1), Target=bounds_19)  # -> Mapped, Clipped
remap_numbers_24 = RemapNumbers(Value=list_item_25.Item2, Source=Domain(0, 1), Target=bounds_16)  # -> Mapped, Clipped
remap_numbers_25 = RemapNumbers(Value=list_item_25.Item5, Source=Domain(0, 1), Target=bounds_20)  # -> Mapped, Clipped
remap_numbers_26 = RemapNumbers(Value=list_item_25.Item3, Source=Domain(0, 1), Target=bounds_17)  # -> Mapped, Clipped
remap_numbers_27 = RemapNumbers(Value=list_item_25.Item4, Source=Domain(0, 1), Target=bounds_21)  # -> Mapped, Clipped

loop_end = LoopEnd(
    port=loop_start.port,
    Exit=False,
    Data=backpropagation.ActivationNetwork,
    Data_2=merge_7,
    TimeOutVal=0,
    pausedState=False,
    state="Constant output")  # -> Data, D1

panel_45 = Panel(loop_end.Data)

panel_46 = Panel(remap_numbers_27.Mapped)

number_slider_3 = Slider(0, range=-90..90)
number_slider_4 = Slider(19, range=-90..90)
elbow_2 = Slider(0, range=-90..90)
number_slider_5 = Slider(0, range=-90..90)
number_slider_6 = Slider(0, range=-180..180)
point_4 = Point(<point referenced from the Rhino model>)
shoulder_2 = Slider(-90, range=-90..90)
mesh_3 = Mesh(<mesh referenced from the Rhino model>)
list_4 = ValueList({"AA-KR60", "AA-KR30", "AA-KR60_KR30", "AARCH IRB120", "AARCH IRB6620", "AAU-Utzon-UR10", "Automata", "Bartlett-IRB120", "Bartlett-IRB1600", "Bartlett-KR6"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}, selected="KULeuven-UR10e")
xy_3 = XYPlane(Origin=point_4)
xy_4 = XYPlane(Origin=Point(0, 0, 0))
merge_8 = Merge(
    Data1=remap_numbers_22.Mapped,
    Data2=remap_numbers_23.Mapped,
    Data3=remap_numbers_24.Mapped,
    Data4=remap_numbers_26.Mapped,
    Data5=remap_numbers_27.Mapped,
    Data6=remap_numbers_25.Mapped)
load_robot_system_2 = LoadRobotSystem(Name=list_4, Base=xy_4)
pflip_2 = FlipPlane(Plane=xy_3, ReverseX=False, ReverseY=False, SwapAxes=True)
tool_2 = CreateTool(Name="WnC_gripper", TCP=pflip_2, Weight=0, Mesh=mesh_3)  # -> Tool, TCP

degrees_7 = Degrees(Radians=merge_8)

degtorad_2 = DegreesToRadians(Degrees=degrees_7, RobotSystem=load_robot_system_2, MechanicalGroup=0)
target_4 = CreateTarget(Joints=degtorad_2, Tool=tool_2.Tool, IsCartesian=False)

merge_9 = Merge(Data1=flatten(target_4), Data3=flatten(target_4))
program_2 = CreateProgram(Name="Studio", RobotSystem=load_robot_system, Targets1=flatten(merge_9), StepSize=1)  # -> Program, Code, Duration, Warnings, Errors
panel_47 = Panel(program_2.Errors)
sim_2 = ProgramSimulation(Program=program_2.Program, Time=Slider(1, range=0..1), Normalized=True)  # -> SystemMeshes, JointRotations, Plane, Index, Time, Program, Errors

# ==== cluster Cluster
unit_z = UnitZ(Factor=1)
geometry = ClusterInput()
angle = ClusterInput()
center = ClusterInput()
rotate_3d = Rotate3D(Geometry=geometry, Angle=degrees(angle), Center=center, Axis=unit_z)  # -> Geometry, Transform
unit_y = UnitY(Factor=1)
angle_2 = ClusterInput()
center_2 = ClusterInput()
rotate_3d_2 = Rotate3D(Geometry=rotate_3d.Geometry, Angle=degrees(angle_2), Center=center_2, Axis=unit_y)  # -> Geometry, Transform
unit_x = UnitX(Factor=1)
angle_3 = ClusterInput()
center_3 = ClusterInput()
rotate_3d_3 = Rotate3D(Geometry=rotate_3d_2.Geometry, Angle=degrees(angle_3), Center=center_3, Axis=unit_x)  # -> Geometry, Transform
geometry_2 = ClusterOutput(rotate_3d_3.Geometry)

# ==== cluster Cluster_2
unit_z = UnitZ(Factor=1)
unit_y = UnitY(Factor=1)
geometry = ClusterInput()
angle = ClusterInput()
center = ClusterInput()
rotate_3d = Rotate3D(Geometry=geometry, Angle=degrees(angle), Center=center, Axis=unit_z)  # -> Geometry, Transform
unit_x = UnitX(Factor=1)
angle_2 = ClusterInput()
center_2 = ClusterInput()
rotate_3d_2 = Rotate3D(Geometry=rotate_3d.Geometry, Angle=degrees(angle_2), Center=center_2, Axis=unit_y)  # -> Geometry, Transform
angle_3 = ClusterInput()
center_3 = ClusterInput()
rotate_3d_3 = Rotate3D(Geometry=rotate_3d_2.Geometry, Angle=degrees(angle_3), Center=center_3, Axis=unit_x)  # -> Geometry, Transform
geometry_2 = ClusterOutput(rotate_3d_3.Geometry)

# ==== cluster Cluster_3
ghpython_script = GhPythonScript()  # -> out, a
# ---------- ghpython_script: Python ----------
__author__ = "Arpan"
__version__ = "2021.05.19"

import rhinoscriptsyntax as rs

y = range(0,504)
#print(y)
x = 0

while x in y:
    print(x)
    x += 6
# ---------- end ghpython_script ----------
ghpython_script_2 = GhPythonScript()  # -> out, a
# ---------- ghpython_script_2: Python ----------
__author__ = "Arpan"
__version__ = "2021.05.19"

import rhinoscriptsyntax as rs

y = range(0,504)
#print(y)
x = 1

while x in y:
    print(x)
    x += 6
# ---------- end ghpython_script_2 ----------
ghpython_script_3 = GhPythonScript()  # -> out, a
# ---------- ghpython_script_3: Python ----------
__author__ = "Arpan"
__version__ = "2021.05.19"

import rhinoscriptsyntax as rs

y = range(0,504)
#print(y)
x = 2

while x in y:
    print(x)
    x += 6
# ---------- end ghpython_script_3 ----------
ghpython_script_4 = GhPythonScript()  # -> out, a
# ---------- ghpython_script_4: Python ----------
__author__ = "Arpan"
__version__ = "2021.05.19"

import rhinoscriptsyntax as rs

y = range(0,504)
#print(y)
x = 3

while x in y:
    print(x)
    x += 6
# ---------- end ghpython_script_4 ----------
ghpython_script_5 = GhPythonScript()  # -> out, a
# ---------- ghpython_script_5: Python ----------
__author__ = "Arpan"
__version__ = "2021.05.19"

import rhinoscriptsyntax as rs

y = range(0,504)
#print(y)
x = 4

while x in y:
    print(x)
    x += 6
# ---------- end ghpython_script_5 ----------
ghpython_script_6 = GhPythonScript()  # -> out, a
# ---------- ghpython_script_6: Python ----------
__author__ = "Arpan"
__version__ = "2021.05.19"

import rhinoscriptsyntax as rs

y = range(0,504)
#print(y)
x = 5

while x in y:
    print(x)
    x += 6
# ---------- end ghpython_script_6 ----------
list = ClusterInput()
list_2 = ClusterInput()
list_3 = ClusterInput()
list_4 = ClusterInput()
list_5 = ClusterInput()
list_6 = ClusterInput()
list_item = ListItem(List=list, Index=ghpython_script.out, Wrap=True)
list_item_2 = ListItem(List=list_2, Index=ghpython_script_2.out, Wrap=True)
list_item_3 = ListItem(List=list_3, Index=ghpython_script_3.out, Wrap=True)
list_item_4 = ListItem(List=list_4, Index=ghpython_script_4.out, Wrap=True)
list_item_5 = ListItem(List=list_5, Index=ghpython_script_5.out, Wrap=True)
list_item_6 = ListItem(List=list_6, Index=ghpython_script_6.out, Wrap=True)
i = ClusterOutput(list_item)
i_2 = ClusterOutput(list_item_2)
i_3 = ClusterOutput(list_item_3)
i_4 = ClusterOutput(list_item_4)
i_5 = ClusterOutput(list_item_5)
i_6 = ClusterOutput(list_item_6)

# ==== cluster Cluster_4
ghpython_script = GhPythonScript()  # -> out, a
# ---------- ghpython_script: Python ----------
__author__ = "Arpan"
__version__ = "2021.05.19"

import rhinoscriptsyntax as rs

y = range(0,252)
#print(y)
x = 1

while x in y:
    print(x)
    x += 3
# ---------- end ghpython_script ----------
ghpython_script_2 = GhPythonScript()  # -> out, a
# ---------- ghpython_script_2: Python ----------
__author__ = "Arpan"
__version__ = "2021.05.19"

import rhinoscriptsyntax as rs

y = range(0,252)
#print(y)
x = 0

while x in y:
    print(x)
    x += 3
# ---------- end ghpython_script_2 ----------
ghpython_script_3 = GhPythonScript()  # -> out, a
# ---------- ghpython_script_3: Python ----------
__author__ = "Arpan"
__version__ = "2021.05.19"

import rhinoscriptsyntax as rs

y = range(0,252)
#print(y)
x = 2

while x in y:
    print(x)
    x += 3
# ---------- end ghpython_script_3 ----------
list = ClusterInput()
list_2 = ClusterInput()
list_3 = ClusterInput()
list_item = ListItem(List=list, Index=ghpython_script_2.out, Wrap=True)
list_item_2 = ListItem(List=list_2, Index=ghpython_script.out, Wrap=True)
list_item_3 = ListItem(List=list_3, Index=ghpython_script_3.out, Wrap=True)
i = ClusterOutput(list_item)
i_2 = ClusterOutput(list_item_2)
i_3 = ClusterOutput(list_item_3)
