# Grasshopper definition test.gh (Grasshopper 1.0.7)
# plug-ins: GHMQTT Info

timer = Timer(TimerInterval=50, Target=[mqtt_2, mqtt, mqtt_3, mqtt_4])
mqtt = MQTT(BrokerURI="mqtt://test.mosquitto.org:1883/right/shoulder")  # -> Value, Payload
mqtt_2 = MQTT(BrokerURI="mqtt://test.mosquitto.org:1883/right/waist")  # -> Value, Payload
mqtt_3 = MQTT(BrokerURI="mqtt://test.mosquitto.org:1883/right/elbow")  # -> Value, Payload
mqtt_4 = MQTT(BrokerURI="mqtt://test.mosquitto.org:1883/right/wrist")  # -> Value, Payload
panel = Panel(mqtt_3.Value)
panel_2 = Panel(mqtt_4.Value)
panel_3 = Panel(mqtt.Value)
panel_4 = Panel(mqtt_2.Value)
split = TextSplit(Text=mqtt_2.Payload, Separators=",")
panel_5 = Panel(mqtt.Payload)
panel_6 = Panel(mqtt_3.Payload)
panel_7 = Panel(mqtt_4.Payload)
panel_8 = Panel(split)
panel_9 = Panel("""x
y
z
:""")
panel_10 = Panel("""x
y
z
:""")
panel_11 = Panel("""x
y
z
:""")
panel_12 = Panel("""x
y
z
:""")
text = Text(panel_5)
text_2 = Text(panel_6)
text_3 = Text(panel_7)
split_2 = TextSplit(Text=text, Separators=panel_9)
text_4 = Text(panel_8)
split_3 = TextSplit(Text=text_2, Separators=panel_10)
split_4 = TextSplit(Text=text_3, Separators=panel_12)
panel_13 = Panel("""False
False
True
False
False
True
False
False
True
False
False
True
False""")
split_5 = TextSplit(Text=text_4, Separators=panel_11)
panel_14 = Panel(split_2)
panel_15 = Panel("""False
False
True
False
False
True
False
False
True
False
False
True
False""")
panel_16 = Panel("""False
False
True
False
False
True
False
False
True
False
False
True
False""")
panel_17 = Panel(split_3)
panel_18 = Panel(split_4)
panel_19 = Panel("""False
False
True
False
False
True
False
False
True
False
False
True
False""")
panel_20 = Panel(split_5)
cull_pattern = CullPattern(List=panel_14, CullPattern=panel_13)
cull_pattern_2 = CullPattern(List=panel_17, CullPattern=panel_15)
cull_pattern_3 = CullPattern(List=panel_18, CullPattern=panel_16)
cull_pattern_4 = CullPattern(List=panel_20, CullPattern=panel_19)
panel_21 = Panel(cull_pattern)
panel_22 = Panel(cull_pattern_2)
panel_23 = Panel(cull_pattern_3)
panel_24 = Panel(cull_pattern_4)
list_item = ListItem(List=cull_pattern, Index=0, Wrap=True)  # -> Item, Item1, Item2, Item3
list_item_2 = ListItem(List=cull_pattern_2, Index=0, Wrap=True)  # -> Item, Item1, Item2, Item3
list_item_3 = ListItem(List=cull_pattern_3, Index=0, Wrap=True)  # -> Item, Item1, Item2, Item3
list_item_4 = ListItem(List=cull_pattern_4, Index=0, Wrap=True)  # -> Item, Item1, Item2, Item3
vector_xyz = VectorXYZ(XComponent=list_item.Item, YComponent=list_item.Item1, ZComponent=list_item.Item2)  # -> Vector, Length
vector_xyz_2 = VectorXYZ(XComponent=list_item_2.Item, YComponent=list_item_2.Item1, ZComponent=list_item_2.Item2)  # -> Vector, Length
vector_xyz_3 = VectorXYZ(XComponent=list_item_3.Item, YComponent=list_item_3.Item1, ZComponent=list_item_3.Item2)  # -> Vector, Length
vector_xyz_4 = VectorXYZ(XComponent=list_item_4.Item, YComponent=list_item_4.Item1, ZComponent=list_item_4.Item2)  # -> Vector, Length
multiplication = Multiplication(A=vector_xyz_3.Vector, B=Slider(1, range=0..10))
multiplication_2 = Multiplication(A=vector_xyz_2.Vector, B=Slider(1, range=0..10))
move = Move(Geometry=vector_xyz_3.Vector, Motion=multiplication)  # -> Geometry, Transform
move_2 = Move(Geometry=vector_xyz_2.Vector, Motion=multiplication_2)  # -> Geometry, Transform
