# Grasshopper definition exp1-env.gh (Grasshopper 1.0.7)
# plug-ins: GHMQTT Info, Machina, Robots, Kangaroo2 Components, Pufferfish

trigger = Trigger(Interval=200, TimerInterval=200, Target=mqtt)  # disabled
filter = StreamFilter(Gate=Toggle(True), Stream0="mqtt://test.mosquitto.org:1883/LM", Stream1="None")
python = GhPythonScript()  # -> out, a; unedited script template
mqtt = MQTT(BrokerURI=filter)  # -> Value, Payload
number_slider = Slider(200, range=0..1000)
number_slider_2 = Slider(100, range=20..100)
panel = Panel(mqtt.Value)
pt = Point(Point(0, 0, 0))
panel_2 = Panel(mqtt.Payload)
python_2 = GhPythonScript(x=mqtt.Payload, y=Button(), z=Slider(100, range=0..1000))  # -> out, a
# ---------- python_2: Python ----------
__author__ = "shabe"
__version__ = "2021.04.21"

import rhinoscriptsyntax as rs
import Rhino.Geometry as rg
if y:
    pts = [0 for i in range(21)]
else:
    vars = x.split("|")
    for i,t in enumerate(vars):
        vals = t.split(",")
        vals = map(float,vals)
        
        newPt = rg.Point3d(vals[0],vals[1],0)
        
        if pts[i] ==0:
            pts[i] = newPt
            continue
        
        if rs.Distance(newPt,pts[i])<z: pts[i] = newPt
        
a = pts
# ---------- end python_2 ----------
pdecon = Deconstruct(Point=python_2.a)  # -> XComponent, YComponent, ZComponent
avr = Average(Input=python_2.a)
graph = QuickGraph(pdecon.XComponent, SortOrder=0)
vec2pt = Vector2Pt(PointA=avr, PointB=pt, Unitize=False)  # -> Vector, Length
move = Move(Geometry=python_2.a, Motion=vec2pt.Vector)  # -> Geometry, Transform
pt_2 = Point(python_2.a)
con = DelaunayEdges(Points=python_2.a, Plane=PlaneXY(0, 0, 0))  # -> Connectivity, Edges
item = ListItem(List=pt_2, Index="8", Wrap=True)
crv = Curve(con.Edges)
rec = DataRecorder(item, DataLimit=-10, RecordData=True)
getplane = GetPlane()
# A simple program that traces a vertical line in space
lng = ListLength(List=rec)
pline = PolyLine(Vertices=rec, Closed=False)
panel_3 = Panel(lng)
duppt = RemoveDuplicatePts(Points=rec, Tolerance=0.01)  # disabled
panel_4 = Panel("""-18
-93
93
-104
-90
17""")
X = UnitX(Factor="-1100")
xy = XYPlane(Origin=duppt)
Z = UnitZ(Factor=Slider(200, range=0..1000))
addition = Addition(A=Z, B=X)
item_2 = ListItem(List=panel_4, Index=0, Wrap=True)  # -> Item, Item1, Item2, Item3, Item4, Item5
move_2 = Move(Geometry=xy, Motion=addition)  # -> Geometry, Transform
deplane = DeconstructPlane(Plane=move_2.Geometry)  # -> Origin, XAxis, YAxis, ZAxis
avr_2 = Average(Input=deplane.Origin)

# ---- group: Go back to a 'home' position using joint rotation values directly
axesto = AxesTo(A1=item_2.Item, A2=item_2.Item1, A3=item_2.Item2, A4=item_2.Item3, A5=item_2.Item4, A6=item_2.Item5, Relative=False)

# ----
flippln = FlipPlane(Plane=move_2.Geometry, FlipX=False, FlipY=False, FlipZ=True)  # -> Flipped, R

# ---- group: Set initial Speed
number_slider_3 = Slider(100, range=0..100)
speedto = SpeedTo(Speed=Slider(100, range=0..100), Relative=False)

# ----
scale = Scale(Geometry=flippln.Flipped, Center=avr_2, Factor=Slider(3, range=0..10))  # -> Geometry, Transform

# ---- group: Transform to base plane (inverted to match robot's TCP orientation)
number_slider_4 = Slider(200, range=0..1000)  # disabled
number_slider_5 = Slider(500, range=0..1000)  # disabled
construct_point = ConstructPoint(XCoordinate=Slider(400, range=0..1000), YCoordinate=number_slider_4, ZCoordinate=number_slider_5)  # disabled
xy_plane = XYPlane(Origin=construct_point)  # disabled
deconstruct_plane = DeconstructPlane(Plane=xy_plane)  # -> Origin, XAxis, YAxis, ZAxis; disabled
panel_5 = Panel("180")  # disabled
rotate_3d = Rotate3D(Geometry=xy_plane, Angle=degrees(panel_5), Center=deconstruct_plane.Origin, Axis=deconstruct_plane.YAxis)  # -> Geometry, Transform; disabled
transformto = TransformTo(Plane=scale.Geometry, Relative=False)

# ----
precisionto = PrecisionTo(Radius=Slider(10, range=0..10), Relative=False)

# ---- group: Merge actions into a list and display them
merge = Merge(Data1=flatten(axesto), Data2=flatten(speedto), Data3=flatten(precisionto), Data4=transformto, Data9=flatten(axesto))  # -> flatten(Result)
panel_6 = Panel(merge)

# ---- group: Stream the program directly to the robot via the Machina Bridge
# Check these tutorials on how to set up real-time control with your machine: https://www.youtube.com/playlist?list=PLvxxYImPCApXj3tHVKmpTS_AuMPngnA47
connect_to_bridge = BooleanToggle(True)
send_program_to_bridge = Button()
connect = Connect(URL="ws://127.0.0.1:6999/Bridge", Name="GH", Connect=connect_to_bridge)  # -> Status, Bridge
panel_7 = Panel(connect.Status)
listen = Listen(Bridge=connect.Bridge, Autoupdate=True, Interval=66)
send = Send(Bridge=connect.Bridge, Actions=merge, Send=send_program_to_bridge)  # -> Sent, Instructions
panel_8 = Panel(send.Sent)
panel_9 = Panel(send.Instructions)
actionexecuted = ActionExecuted(BridgeMessage=listen)  # -> LastAction, ActionTCP, ActionAxes, ActionExternalAxes, PendingActions, PendingActionsOnDevice
panel_10 = Panel(actionexecuted.LastAction)
data_recorder = DataRecorder(actionexecuted.ActionTCP, DataLimit=-10, RecordData=True)
panel_11 = Panel(actionexecuted.PendingActions)
plane = Plane(data_recorder)

# ---- group: Create a new Robot
createrobot = CreateRobot(Name="VerticalLine", Brand="ABB")

# ---- group: Generate native Robot Program from a list of Actions
compileprogram = CompileProgram(Robot=createrobot, Actions=merge, InLineTargets=Toggle(True), Comments=Toggle(True))

# ---- group: Visualize the Program in native code
displayprogram = DisplayProgram(RobotProgram=compileprogram)
panel_12 = Panel(displayprogram)

# ---- group: Save the Robot Program to this definition's folder
c_script = CSharpScript()  # -> out, here
# ---------- c_script: C# usings ----------
using System.IO;
# ---------- c_script: C# ----------
    string targetFolder = "";

    GH_Document gh_d = owner.OnPingDocument();
    if (gh_d.IsFilePathDefined)
    {
      string ghFilePath = gh_d.FilePath;
      targetFolder = Path.GetDirectoryName(ghFilePath);
    }
    else
    {
      Print("No local folder found, please save your file locally.");
    }

    here = targetFolder;
# ---------- end c_script ----------
saveprogram = SaveProgram(Robot=createrobot, RobotProgram=compileprogram, Path=c_script.here)
panel_13 = Panel(saveprogram)
