# Grasshopper definition mqtt ghcpython.gh (Grasshopper 1.0.7)
# plug-ins: GH_CPython

gh_cpython = GH_CPython()  # -> output; inputs input: list
# ---------- gh_cpython: Python ----------
# -*- coding: utf-8 -*-
""" 
Python Script
Created on  Wednesday April 2021 07:17:38 
@author:  shabe 

[desc]
Description of the plugin Here
Write here any thing... 
[/desc]

ARGUMENTS:
----------
<inp> 
    _input :[required] - [type = int] - [default = None] 
    Descripe your input here 
        * bullet point.
        * bullet point
</inp>
<inp>
    Other inputs go here ...
</inp>

RETURN:
----------
    <out>
        output_ : indicate your output description here. \n refers to a new line.
    </out>

"""
# ---------- end gh_cpython ----------
