# Grasshopper definition mqtt+IMU.gh (Grasshopper 1.0.7)
# plug-ins: GHMQTT Info, Robots, Pufferfish

panel = Panel("mqtt://10.3.141.1/IMU1/q0")
panel_2 = Panel("""q0
q1
q2
q3""")
panel_3 = Panel("""IMU1
IMU2""")
python = GhPythonScript(host="mqtt://10.3.141.1", Topics=panel_3, subTopics=panel_2)  # -> out, graft(a); inputs Topics: list, subTopics: list
#   port a: s The a output variable
# ---------- python: Python ----------
"""Provides a scripting component.
    Inputs:
        x: The x script variable
        y: The y script variable
    Output: s
        a: The a output variable"""

__author__ = "shabe"
__version__ = "2021.04.14"

import rhinoscriptsyntax as rs

outSubs = []

for top in Topics:
    for sub in subTopics:
        t =host+"/" +top+"/"+sub
        outSubs.append(t)
        
        
        

a= outSubs
# ---------- end python ----------
trigger = Trigger(
    Interval=50,
    TimerInterval=50,
    Target=[mqtt_sub, mqtt_sub_3, mqtt_sub_2, mqtt_sub_5, mqtt_sub_4, mqtt_sub_6, mqtt_sub_7, mqtt_sub_8])
filter = StreamFilter(Gate=Toggle(True), Stream1=python.a)
trigger_2 = Trigger(Interval=100, TimerInterval=100)
bang = ExplodeTree(Data=filter)  # -> Branch0, Branch1, Branch2, Branch3, Branch4, Branch5, Branch6, Branch7
mqtt_sub = MQTT_Sub(BrokerURI=bang.Branch1)  # -> Topic, Payload
panel_4 = Panel(mqtt_sub.Topic)
mqtt_sub_2 = MQTT_Sub(BrokerURI=bang.Branch2)  # -> Topic, Payload
panel_5 = Panel(mqtt_sub_2.Topic)
mqtt_sub_3 = MQTT_Sub(BrokerURI=bang.Branch0)  # -> Topic, Payload
panel_6 = Panel(mqtt_sub_3.Topic)
mqtt_sub_4 = MQTT_Sub(BrokerURI=bang.Branch4)  # -> Topic, Payload
panel_7 = Panel(mqtt_sub_4.Topic)
mqtt_sub_5 = MQTT_Sub(BrokerURI=bang.Branch3)  # -> Topic, Payload
panel_8 = Panel(mqtt_sub_5.Topic)
mqtt_sub_6 = MQTT_Sub(BrokerURI=bang.Branch5)  # -> Topic, Payload
panel_9 = Panel(mqtt_sub_6.Topic)
mqtt_sub_7 = MQTT_Sub(BrokerURI=bang.Branch6)  # -> Topic, Payload
panel_10 = Panel(mqtt_sub_7.Topic)
mqtt_sub_8 = MQTT_Sub(BrokerURI=bang.Branch7)  # -> Topic, Payload
panel_11 = Panel(mqtt_sub_8.Topic)
merge = Merge(Data1=mqtt_sub_4.Payload, Data2=mqtt_sub_6.Payload, Data3=mqtt_sub_7.Payload, Data4=mqtt_sub_8.Payload)  # -> flatten(Result)
number_slider = Slider(0, range=0..1)
number_slider_2 = Slider(0, range=0..1)
sqrt = SquareRoot(Value=2)
merge_2 = Merge(Data1=mqtt_sub_3.Payload, Data2=mqtt_sub.Payload, Data3=mqtt_sub_2.Payload, Data4=mqtt_sub_5.Payload)  # -> flatten(Result)
panel_12 = Panel(merge)
one_over_x = OneOverX(Value=sqrt)
python_2 = GhPythonScript(x=Button(), p1=merge_2, p2=merge)  # -> out, a, ar, vv; inputs p1: list, p2: list of Boolean
# ---------- python_2: Python ----------
__author__ = "shabe"
__version__ = "2021.04.14"

import rhinoscriptsyntax as rs
import math
"""
struct Quaternion {
    double w, x, y, z;
};

struct EulerAngles {
    double roll, pitch, yaw;
};

EulerAngles ToEulerAngles(Quaternion q) {
    EulerAngles angles;

    // roll (x-axis rotation)
    double sinr_cosp = 2 * (q.w * q.x + q.y * q.z);
    double cosr_cosp = 1 - 2 * (q.x * q.x + q.y * q.y);
    angles.roll = std::atan2(sinr_cosp, cosr_cosp);

    // pitch (y-axis rotation)
    double sinp = 2 * (q.w * q.y - q.z * q.x);
    if (std::abs(sinp) >= 1)
        angles.pitch = std::copysign(M_PI / 2, sinp); // use 90 degrees if out of range
    else
        angles.pitch = std::asin(sinp);

    // yaw (z-axis rotation)
    double siny_cosp = 2 * (q.w * q.z + q.x * q.y);
    double cosy_cosp = 1 - 2 * (q.y * q.y + q.z * q.z);
    angles.yaw = std::atan2(siny_cosp, cosy_cosp);

    return angles;
}
"""
class quat():
    def __init__(self):
        self.w= 0
        self.x = 0
        self.y = 0
        self.z = 0
        self.prev  = [0,0,0]
        self.flag = False
    def update(self,w,x,y,z):
        self.w = w
        self.x = x
        self.y = y
        self.z = z
    def ToEueler(self):
        roll = 0
        yaw = 0
        pitch = 0
        sinr_cosp = 2 * (self.w * self.x + self.y * self.z)
        cosr_cosp = 1 - 2*(self.x * self.x + self.y * self.y)
        roll =math.atan2(sinr_cosp,cosr_cosp)

        sinp = 2*(self.w*self.y - self.z*self.x)
        if abs(sinp)>=1:
            pitch = math.copysign(math.pi/2,sinp)
        else:
            pitch = math.asin(sinp)
        
        
        siny_cosp = 2*(self.w*self.z+self.x*self.y)
        cosy_cosp = 1-2*(self.y*self.y + self.z*self.z)
        yaw = math.atan2(siny_cosp,cosy_cosp)
        print (self.flag)
        if self.flag ==False:
            self.flag = True
            self.prev = [roll,yaw,pitch]
        else:
            
            print('i')
            roll -=self.prev[0]
            yaw  -=self.prev[1]
            pitch -=self.prev[2]
            self.prev = [roll,yaw,pitch]
        
        return roll,yaw,pitch
    def toMatrix(self):
        q0 = self.w
        q1 = self.x
        q2  =self.y
        q3 = self.z
        R = 9*[0]
        R[0] = 1 -2*(q2**2+q3**2)
        R[1] = 2*(q1*q2-q0*q3)
        R[2] = 2*(q0*q2+q1*q3)
        R[3] = 2*(q1*q2+q0*q3)
        R[4] = 1-2*(q1**2+q3**2)
        R[5] = 2*(q2*q3+q0*q1)
        R[6] = 2*(q1*q3-q0*q2)
        R[7] = 2*(q0*q1+q2*q3)
        R[8] = 1-2*(q1**2+q2**2)
        return R

if x:
    imu1 = quat()
    imu2 = quat()
else:
    imu1.update(p1[0],p1[1],p1[2],p1[3])
    imu2.update(p2[0],p2[1],p2[2],p2[3])
    a = imu1.ToEueler()
    ar =imu1.toMatrix()
    vv = imu2.ToEueler()
# ---------- end python_2 ----------
panel_13 = Panel(merge_2)
number_slider_3 = Slider(30, range=0..100)
merge_3 = Merge(Data1=one_over_x, Data2=Slider(0, range=0..1), Data3=Slider(0, range=0..1), Data4=one_over_x)
python_3 = GhPythonScript(q=merge_2)  # -> out, a, axis; inputs q: list
# ---------- python_3: Python ----------
__author__ = "shabe"
__version__ = "2021.04.14"

import rhinoscriptsyntax as rs
import Rhino.Geometry as rg
import math
v = [0,0,0]
a = 0

q = [t/100 for t in q]
q = [q[0],q[1],q[2],q[3]]

a  = math.acos(q[0])*2 #
print (math.degrees(a))
if not a==0:

    v[0] = q[1]/math.sin(a/2)    #v1 = q1/(sin(a/2))
    v[1] = q[2]/math.sin(a/2)    #v1 = q1/(sin(a/2))
    v[2] = q[3]/math.sin(a/2)    #v1 = q1/(sin(a/2))
else:
    print ('e')
    v = [0,0,0]
print v
axis = rg.Vector3d(v[0],v[1],v[2])
# ---------- end python_3 ----------
xy = XYPlane(Origin=Point(0, 0, 0))
deg = Degrees(Radians=python_3.a)
panel_14 = Panel(deg)
python_4 = GhPythonScript(q=merge)  # -> out, a, axis; inputs q: list
# ---------- python_4: Python ----------
__author__ = "shabe"
__version__ = "2021.04.14"

import rhinoscriptsyntax as rs
import Rhino.Geometry as rg
import math
v = [0,0,0]
a = 0

q = [t/100 for t in q]

q = [q[0],q[1],q[2],q[3]]
a  = math.acos(q[0])*2 #
print (math.degrees(a))
if not a==0:
    v[0] = q[1]/math.sin(a/2)    #v1 = q1/(sin(a/2))
    v[1] = q[2]/math.sin(a/2)    #v1 = q1/(sin(a/2))
    v[2] = -q[3]/math.sin(a/2)    #v1 = q1/(sin(a/2))
else:
    print ('e')
    v = [0,0,0]
print v
axis = rg.Vector3d(v[0],v[1],v[2])
# ---------- end python_4 ----------
panel_15 = Panel("cos(a/2) || v1*sin(a/2) || v2*sin(a/2) || v3*sin(a/2)")
mirror = Mirror(Geometry=python_3.axis, Plane=xy)  # -> Geometry, Transform

X = UnitX(Factor=1)
pt = Point(Point(0, 0, 0))
line = LineSDL(Start=pt, Direction=X, Length=Slider(350, range=0..1000))
Y = UnitY(Factor=1)
end = EndPoints(Curve=line)  # -> Start, End
Z = UnitZ(Factor=1)
number_slider_4 = Slider(100, range=0..100)
line_2 = LineSDL(Start=end.End, Direction=Z, Length=number_slider_4)
line_3 = LineSDL(Start=end.End, Direction=Y, Length=number_slider_4)
yz = YZPlane(Origin=end.End)
join = JoinCurves(Curves=[line_3, line_2], Preserve=False)

unit = UnitVector(Vector=expr("-x", python_3.axis))
rot3d = Rotate3D(Angle=python_3.a, Center=Point(0, 0, 0), Axis=unit)  # -> Geometry, Transform
transform = Transform(Geometry=line, Transform=rot3d.Transform)
end_2 = EndPoints(Curve=transform)  # -> Start, End
vec2pt = Vector2Pt(PointA=end_2.Start, PointB=end_2.End, Unitize=False)  # -> Vector, Length

unit_2 = UnitVector(Vector=python_4.axis)
rot3d_2 = Rotate3D(Angle=python_4.a, Center=Point(0, 0, 0), Axis=unit_2)  # -> Geometry, Transform
transform_2 = Transform(Geometry=line, Transform=rot3d_2.Transform)
end_3 = EndPoints(Curve=transform_2)  # -> Start, End
vec2pt_2 = Vector2Pt(PointA=end_3.Start, PointB=end_3.End, Unitize=False)  # -> Vector, Length

transform_3 = Transform(Geometry=[line, join, yz], Transform=rot3d.Transform)
transform_4 = Transform(Geometry=yz, Transform=rot3d.Transform)

X_2 = UnitX(Factor=1)
pt_2 = Point(Point(0, 0, 0))
line_4 = LineSDL(Start=pt_2, Direction=X_2, Length=Slider(350, range=0..1000))
Y_2 = UnitY(Factor=1)
end_4 = EndPoints(Curve=line_4)  # -> Start, End
Z_2 = UnitZ(Factor=1)
number_slider_5 = Slider(100, range=0..100)
line_5 = LineSDL(Start=end_4.End, Direction=Z_2, Length=number_slider_5)
line_6 = LineSDL(Start=end_4.End, Direction=Y_2, Length=number_slider_5)
yz_2 = YZPlane(Origin=end_4.End)
join_2 = JoinCurves(Curves=[line_6, line_5], Preserve=False)
transform_5 = Transform(Geometry=[line_4, join_2, yz_2], Transform=rot3d_2.Transform)
transform_6 = Transform(Geometry=yz_2, Transform=rot3d_2.Transform)
move2pt = MoveToPoint(Geometry=transform_3, PointA=pt, PointB=transform_6)  # -> Moved, Vector, Transform
move2pt_2 = MoveToPoint(Geometry=transform_4, PointA=pt, PointB=transform_6)  # -> Moved, Vector, Transform

addition = Addition(A=vec2pt.Vector, B=vec2pt_2.Vector)

pt_3 = Point(Point(0, 0, 0))
line_7 = LineSDL(Start=pt_3, Direction=addition, Length=Slider(441, range=0..10000))
end_5 = EndPoints(Curve=line_7)  # -> Start, End

end_6 = EndPoints(Curve=transform)  # -> Start, End
rec = DataRecorder(end_6.End, DataLimit=-10, RecordData=False)
pline = PolyLine(Vertices=rec, Closed=False)
X_3 = UnitX(Factor=Slider(1000, range=0..1000))
move = Move(Geometry=pline, Motion=X_3)  # -> Geometry, Transform

end_7 = EndPoints(Curve=transform_2)  # -> Start, End
rec_2 = DataRecorder(end_7.End, DataLimit=-10, RecordData=False)
pline_2 = PolyLine(Vertices=rec_2, Closed=False)

python_5 = GhPythonScript(x=move2pt_2.Moved, y=Button())  # -> out, a; inputs x: Point3d
# ---------- python_5: Python ----------
__author__ = "shabe"
__version__ = "2021.04.15"

import rhinoscriptsyntax as rs
if y:
    t = []
else:
    t.append(x)
    if len(t)>20:
        t.pop(0)
a = t
# ---------- end python_5 ----------
flippln = FlipPlane(Plane=move2pt_2.Moved, FlipX=False, FlipY=False, FlipZ=Toggle(False))  # -> Flipped, R

list = ValueList({"AA-KR60", "AA-KR30", "AA-KR60_KR30", "AARCH IRB120", "AARCH IRB6620", "AAU-Utzon-UR10", "Automata", "Bartlett-IRB120", "Bartlett-IRB1600", "Bartlett-KR6"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}, selected="iaac-IRB120")
list_2 = ValueList({"Joint", "Linear"}, selected="Linear")
load_robot = LoadRobotSystem(Name=list, Base=PlaneXY(0, 0, 0))
target = CreateTarget(Plane=flippln.Flipped, Motion=list_2, IsCartesian=True)
program = CreateProgram(Name="DefaultProgram", RobotSystem=load_robot, Targets1=target, StepSize=1)  # -> Program, Code, Duration, Warnings, Errors
sim = ProgramSimulation(Program=program.Program, Time=0, Normalized=True)  # -> SystemMeshes, JointRotations, Plane, Index, Time, Program, Errors
