# Grasshopper definition 20210513_Ceramic Crack.gh (Grasshopper 1.0.7)
# plug-ins: Firefly.Core, CloseCurve, Pufferfish

# ---- group: 01 HTC VIVE TRACKER
websocket_client_start = WebsocketClientStart(Address="ws://192.168.10.186:9090", InitalMessage="Hello World", Reset=Button())
subscribe = Subscribe(Topic="/LHR_478352EA")  # -> R
# ---------- subscribe: Python ----------
import json


data = {
"op":"subscribe",
"topic":Topic
}

R = json.dumps(data)
# ---------- end subscribe ----------
websocket_client_sender = WebsocketClientSender(WebsocketObjects=websocket_client_start, Message=subscribe)
websocket_client_receiver = WebsocketClientReceiver(WebsocketObjects=websocket_client_start, AutoUpdate=True)  # -> Message, Status
panel = Panel(websocket_client_receiver.Message)
parse_string = ParseString(M=websocket_client_receiver.Message)  # -> data
# ---------- parse_string: Python ----------
import json

try:
    jsonObj = json.loads(M)["msg"];
    
    data = jsonObj["data"]
except:
    data = None
# ---------- end parse_string ----------
split = TextSplit(Text=parse_string, Separators=" ")
panel_2 = Panel("""3
6
9
12
15
18""")
item = ListItem(List=split, Index=panel_2, Wrap=True)
item_2 = ListItem(List=item, Index=0, Wrap=True)  # -> Item, Item1, Item2, Item3, Item4, Item5
rad = Radians(Degrees=item_2.Item3)
rad_2 = Radians(Degrees=item_2.Item4)
rad_3 = Radians(Degrees=item_2.Item5)
pt = ConstructPoint(XCoordinate=item_2.Item, YCoordinate=item_2.Item2, ZCoordinate=item_2.Item1)
python = GhPythonScript(x=pt, reset=Button(), trail=Slider(1, range=0..10))  # -> out, a; inputs x: Plane
# ---------- python: Python ----------
__author__ = "user"
__version__ = "2021.05.12"

import rhinoscriptsyntax as rs
if reset ==True:
    pts = []
else:
    pts.append(x)
    if len(pts)>trail:
        pts.pop(0)
a = pts
# ---------- end python ----------

# ----
toggle = BooleanToggle(True)
com = Integer(45)
open_port = OpenClosePort(OpenClosePort=toggle, PortNumber=com, BaudRate="115200")
trigger = Trigger(Interval=10, TimerInterval=10, Target=read)
port_status = Panel(open_port)
read = SerialReadGeneric(StartReadingValues=toggle, PortNumber=com)  # -> SerialOutput, StatusMessage
python_2 = GhPythonScript(x=read.SerialOutput, reset=Button(), trail=Slider(1, range=0..10))  # -> out, a
# ---------- python_2: Python ----------
__author__ = "user"
__version__ = "2021.05.12"

import rhinoscriptsyntax as rs
if reset ==True:
    num = []
else:
    num.append(x)
    if len(num)>trail:
        num.pop(0)
a = num
# ---------- end python_2 ----------
panel_3 = Panel(python_2.a)
int = Integer(python_2.a)
abs = Absolute(Value=int)
subtraction = Subtraction(A=abs, B="0")
dom = ConstructDomain(DomainStart=0, DomainEnd="100")
dom_2 = ConstructDomain(DomainStart=0, DomainEnd="10")
remap = RemapNumbers(Value=subtraction, Source=dom, Target=dom_2)  # -> Mapped, Clipped

# ---- group: 00 MEDIAPIPE
screen_width = Panel("640")
screen_heigth = Panel("480")
rectangle = Rectangle(Plane=PlaneXY(0, 0, 0), XSize=screen_width, YSize=screen_heigth, Radius=0)  # -> Rectangle, Length
xy = XYPlane(Origin=Point(0, 0, 0))
debrep = DeconstructBrep(Brep=rectangle.Rectangle)  # -> Faces, Edges, Vertices
item_3 = ListItem(List=debrep.Vertices, Index=0, Wrap=True)  # -> Item, Item1, Item2, Item3
number_slider = Slider(20, range=0..100)
number_slider_2 = Slider(18, range=0..100)
aligndim = AlignedDimension(Plane=xy, PointA=item_3.Item3, PointB=item_3.Item2, Offset=number_slider, Text="Width :640", Size=number_slider_2)
aligndim_2 = AlignedDimension(Plane=xy, PointA=item_3.Item, PointB=item_3.Item3, Offset=number_slider, Text="Heigth :480", Size=number_slider_2)

# ----
fragments = Slider(35, range=1..500)
angle = Slider(0.25, range=0..0.99)
edge = Slider(0.096, range=0..0.99)
rec = Rectangle({Plane=PlaneXY(-22, -22, 0), Size=Domain2(u=0..54, v=0..43)})
srf = Surface(rec)
c_script = CSharpScript(S=srf, Edge_Variance_Ex=edge, Angle_Variance_Ax=angle, N=fragments)  # -> out, P; inputs S: Brep, Edge_Variance_Ex: Double, Angle_Variance_Ax: Double, N: Int32
# ---------- c_script: C# ----------
    if (N < 1)
      throw new ArgumentException("N must be larger than or equal to one");

    if (N == 1)
    {
      P = S;
      return;
    }

    List<Fragment> fragments = new List<Fragment>(N);
    fragments.Add(new Fragment(S));

    Interval edgeRange = new Interval(0.5 * -Ex, 0.5 * Ex);
    Interval angleRange = new Interval(0, 0);

    Random random = new Random(1);
    while (fragments.Count < N)
    {
      Fragment currentFragment = fragments[0];
      fragments.RemoveAt(0);

      Fragment[] fs = currentFragment.Break(random, edgeRange, angleRange);
      fragments.AddRange(fs);
      fragments.Sort(FragmentComparison);
    }

    List<Brep> breps = new List<Brep>(fragments.Count);
    foreach (Fragment f in fragments)
      breps.Add(f.Shard);

    P = breps;
# ---------- c_script: C# additional code ----------
  private int FragmentComparison(Fragment f0, Fragment f1)
  {
    return f1.Area.CompareTo(f0.Area);
  }

  private class Fragment
  {
    private readonly Brep _shard;
    private readonly double _area;

    public Fragment(Brep shard)
    {
      if (shard == null)
        throw new ArgumentNullException("shard");

      if (shard.Faces.Count > 1)
        throw new ArgumentException("Shard needs to have exactly one face");

      if (shard.Edges.Count < 2)
        throw new ArgumentException("Shard needs to have at least two edges");

      _shard = shard;
      _area = shard.GetArea();
    }

    public Brep Shard
    {
      get { return _shard; }
    }
    public double Area
    {
      get { return _area; }
    }

    /// <summary>
    /// Break this fragment into two smaller fragments.
    /// </summary>
    /// <param name="random"></param>
    /// <param name="edgeRange"></param>
    /// <param name="angleRange"></param>
    /// <returns></returns>
    public Fragment[] Break(Random random, Interval edgeRange, Interval angleRange)
    {
      BrepEdge edge1, edge2;
      RelevantEdges(out edge1, out edge2);

      double param1 = 0.5 + edgeRange.ParameterAt(random.NextDouble());
      double param2 = 0.5 + edgeRange.ParameterAt(random.NextDouble());

      Point3d point1, point2;
      Vector3d normal1, normal2;
      Vector3d dir1, dir2;

      FractureSeed(edge1, param1, out point1, out normal1, out dir1);
      FractureSeed(edge2, param2, out point2, out normal2, out dir2);

      Curve breakLine = FractureLine(point1, dir1, point2, dir2);

      BrepFace face = _shard.Faces[0];
      Brep result = face.Split(new Curve[]{breakLine}, 1e-3);

      Fragment frag1 = new Fragment(result.Faces[0].DuplicateFace(false));
      Fragment frag2 = new Fragment(result.Faces[1].DuplicateFace(false));

      return new Fragment[]{frag1, frag2};
    }

    /// <summary>
    /// Find the two longest edges in the shape.
    /// </summary>
    /// <param name="edge1">Longest edge.</param>
    /// <param name="edge2">Second longest edge.</param>
    private void RelevantEdges(out BrepEdge edge1, out BrepEdge edge2)
    {
      edge1 = null;
      edge2 = null;
      double length1 = double.MinValue;
      double length2 = double.MinValue;

      while (edge1 == null || edge2 == null)
      {
        foreach (BrepEdge edge in _shard.Edges )
        {
          double edgeLength = edge.GetLength();
          if (edgeLength > length1)
          {
            length1 = edgeLength;
            edge1 = edge;
            continue;
          }
          if (edgeLength > length2)
          {
            if (edge1 != edge)
            {
              length2 = edgeLength;
              edge2 = edge;
              continue;
            }
          }
        }
      }

      if (edge1 == edge2)
        throw new InvalidOperationException("Cannot find distinct edges");
    }
    /// <summary>
    /// Compute the relevant data for a fracture terminus.
    /// </summary>
    /// <param name="edge"></param>
    /// <param name="parameter"></param>
    /// <param name="point"></param>
    /// <param name="normal"></param>
    /// <param name="direction"></param>
    /// <returns></returns>
    private void FractureSeed(BrepEdge edge, double parameter, out Point3d point, out Vector3d normal, out Vector3d direction)
    {
      point = edge.PointAtNormalizedLength(parameter);
      edge.ClosestPoint(point, out parameter);
      direction = edge.TangentAt(parameter);

      double u, v;
      _shard.Faces[0].ClosestPoint(point, out u, out v);
      normal = _shard.Faces[0].NormalAt(u, v);

      direction.Rotate(0.5 * Math.PI, normal);

      Point3d p1 = point + direction;
      Point3d p2 = point - direction;

      double d1 = p1.DistanceTo(_shard.ClosestPoint(p1));
      double d2 = p2.DistanceTo(_shard.ClosestPoint(p2));
      if (d1 > d2)
        direction.Reverse();
    }
    /// <summary>
    /// Create a fracture line curve.
    /// </summary>
    /// <param name="point1"></param>
    /// <param name="direction1"></param>
    /// <param name="point2"></param>
    /// <param name="direction2"></param>
    /// <returns></returns>
    private Curve FractureLine(Point3d point1, Vector3d direction1, Point3d point2, Vector3d direction2)
    {
      direction1.Unitize();
      direction2.Unitize();
      double span = point1.DistanceTo(point2);
      direction1 *= 0.25 * span;
      direction2 *= 0.25 * span;

      Point3d p0 = point1;
      Point3d p1 = point1 + direction1;
      Point3d p2 = point2 + direction2;
      Point3d p3 = point2;

      Curve curve = Curve.CreateControlPointCurve(new Point3d[]{p0, p1, p2, p3}, 3);
      Curve[] result = curve.PullToBrepFace(_shard.Faces[0], 1e-4);
      return result[0];
    }
  }
# ---------- end c_script ----------

pt_2 = Point(Point(-0.4607307613, -2.594693184, -2.472433805))
pt_3 = Point(Point(-0.6493880749, -2.204782724, -2.473755121))
pt_4 = Point(Point(-0.9073395729, -2.336309433, -2.476823092))
pt_5 = Point(Point(-0.7247228622, -2.710293531, -2.472811222))

# ---- group: 01
pt_6 = Point(pt_3)

# ---- group: 02
pt_7 = Point(pt_2)

# ---- group: 03
pt_8 = Point(pt_4)

# ---- group: 04
pt_9 = Point(pt_5)

# ---- group: 01
pt_10 = Point(Point(1122.000467, 411, 735))

# ---- group: 02
pt_11 = Point(Point(702, 411, 735))

# ---- group: 03
pt_12 = Point(Point(1122.000467, 114, 735))

# ---- group: 04
pt_13 = Point(Point(702, 114, 735))

# ----
srf4pt = _4PointSurface(CornerA=pt_6, CornerB=pt_8, CornerC=pt_9, CornerD=pt_7)

srf4pt_2 = _4PointSurface(CornerA=pt_10, CornerB=pt_12, CornerC=pt_13, CornerD=pt_11)

area = Area(Geometry=srf4pt_2)  # -> Area, Centroid
ln = Line(StartPoint=pt_10, EndPoint=pt_12)
ln_2 = Line(StartPoint=pt_13, EndPoint=pt_12)
len = Length(Curve=ln)
len_2 = Length(Curve=ln_2)
recmap = RectangleMapping(Source=srf4pt, Target=srf4pt_2)  # -> Geometry, Transform
transform = Transform(Geometry=python.a, Transform=recmap.Transform)
pt_14 = Point(Point(954.0002448, 188.2500088, 735))
P = Plane(pt_13)
planesrf = PlaneSurface(Plane=P, XSize=len_2, YSize=len)
scale = Scale(Geometry=planesrf, Center=area.Centroid, Factor=Slider(1.2, range=0..10))  # -> Geometry, Transform
cir = Circle(Plane=pt_14, Radius=Slider(80, range=0..1000))
number_slider_3 = Slider(10, range=0..100)
dom_3 = ConstructDomain(DomainStart=expr("-x", number_slider_3), DomainEnd=number_slider_3)
button = Button()

unityslider = UnitySlider(num=Slider(47, range=0..100), init=button)  # -> out, Value; inputs num: Double, init: Boolean
# ---------- unityslider: C# usings ----------
using Grasshopper.Kernel.Special;
using Grasshopper.GUI.Canvas;
# ---------- unityslider: C# ----------
    if(num != prevVal){
      prevVal = num;
      sliderVal = num;
    }

    var inputs = Component.Params.Input;
    var finput = inputs[0];
    if(finput.SourceCount > 0){
      var slicomp = finput.Sources[0];
      if(slicomp.GetType() == typeof(GH_NumberSlider)){
        var slider = (GH_NumberSlider) slicomp;
        double min = Convert.ToDouble(slider.Slider.Minimum);
        double max = Convert.ToDouble(slider.Slider.Maximum);
        double val = Convert.ToDouble(slider.Slider.Value);
        var name = slider.NickName;
        int decim = slider.Slider.DecimalPlaces;
        int type = (int) slider.Slider.Type;
        Print(forceUpdate.ToString());

        if(forceUpdate || min != prevMin || max != prevMax || name != prevName || decim != prevDecim || type != prevType || init){
          using(var args = new Rhino.Runtime.NamedParametersEventArgs()){
            Component.PingDocument -= OnPingDocument;
            Component.PingDocument += OnPingDocument;
            Component.ObjectChanged -= OnObjectChanged;
            Component.ObjectChanged += OnObjectChanged;
            Grasshopper.Instances.ActiveCanvas.DocumentChanged -= OnDocumentChanged;
            Grasshopper.Instances.ActiveCanvas.DocumentChanged += OnDocumentChanged;

            args.Set("id", Component.InstanceGuid.ToString());
            args.Set("name", name);
            args.Set("min", min);
            args.Set("max", max);
            args.Set("decimal", decim);
            args.Set("value", val);
            args.Set("type", type);
            Rhino.Runtime.HostUtils.ExecuteNamedCallback("FromGHClearUI", args);
            Rhino.Runtime.HostUtils.ExecuteNamedCallback("FromGHCreateSlider", args);

            Register(Component);
          }

          prevMin = min;
          prevMax = max;
          prevName = name;
          prevDecim = decim;
          prevType = type;
          forceUpdate = false;
        }
      }
    }


    Value = sliderVal;
# ---------- unityslider: C# additional code ----------
  double sliderVal = 0.0;
  double prevVal = 0.0;
  IGH_Component comp = null;

  double prevMin = double.PositiveInfinity;
  double prevMax = double.PositiveInfinity;
  string prevName = "";
  int prevDecim = -1;
  int prevType = -1;
  bool forceUpdate = false;

  void Register(IGH_Component component)
  {
    Rhino.Runtime.HostUtils.RegisterNamedCallback("ToGH_Slider_" + Component.InstanceGuid.ToString(), ToGrasshopper);

    comp = component;
  }

  void ToGrasshopper(object sender, Rhino.Runtime.NamedParametersEventArgs args)
  {
    double val;
    if (args.TryGetDouble("sliderValue", out val)){
      sliderVal = val;

      if(Component.Params.Input[0].SourceCount > 0){
        var c = Component.Params.Input[0].Sources[0];
        if(c.GetType() == typeof(Grasshopper.Kernel.Special.GH_NumberSlider)){
          var slider = (Grasshopper.Kernel.Special.GH_NumberSlider) c;
          slider.SetSliderValue(Convert.ToDecimal(sliderVal));
        }
      }
    }

    comp.ExpireSolution(true);
  }

  public void OnPingDocument(object sender, GH_PingDocumentEventArgs e){
    if(e.Document == null){
      using(var args = new Rhino.Runtime.NamedParametersEventArgs()){
        args.Set("id", comp.InstanceGuid.ToString());
        Rhino.Runtime.HostUtils.ExecuteNamedCallback("FromGHClearUI", args);
      }
    }
  }

  public void OnObjectChanged(object sender, GH_ObjectChangedEventArgs e){
    if(e.Type == GH_ObjectEventType.Enabled){
      if(comp.Locked){
        using(var args = new Rhino.Runtime.NamedParametersEventArgs()){
          forceUpdate = true;
          args.Set("id", comp.InstanceGuid.ToString());
          Rhino.Runtime.HostUtils.ExecuteNamedCallback("FromGHClearUI", args);
        }
      }
    }

    comp.ExpireSolution(true);
  }

  public void OnDocumentChanged(object sender, GH_CanvasDocumentChangedEventArgs e){
    using(var args = new Rhino.Runtime.NamedParametersEventArgs()){
      args.Set("id", comp.InstanceGuid.ToString());
      Rhino.Runtime.HostUtils.ExecuteNamedCallback("FromGHClearUI", args);

      forceUpdate = true;

      if(comp != null){
        comp.ExpireSolution(true);
      }
    }
  }
# ---------- end unityslider ----------

divide = DivideCurve(Curve=cir, Count=unityslider.Value, Kinks=False)  # -> Points, Tangents, Parameters
random = Random(Range=dom_3, Number=unityslider.Value, Seed=223)
random_2 = Random(Range=dom_3, Number=unityslider.Value, Seed=277)
pt_15 = ConstructPoint(XCoordinate=random_2, YCoordinate=random, ZCoordinate=0)
move = Move(Geometry=divide.Points, Motion=pt_15)  # -> Geometry, Transform

unityslider_2 = UnitySlider(num=Slider(219, range=0..1000), init=button)  # -> out, Value; inputs num: Double, init: Boolean; same code as unityslider

pop2d = Populate2D(Region=scale.Geometry, Count=unityslider_2.Value, Seed=1)
vec2pt = Vector2Pt(PointA=pop2d, PointB=pt_14, Unitize=False)  # -> Vector, Length
bnd = Bounds(Numbers=vec2pt.Length)
panel_4 = Panel(bnd)
dedomain = DeconstructDomain(Domain=bnd)  # -> Start, End
division = Division(A=vec2pt.Length, B=dedomain.End)
graph = GraphMapper(division, x0=0, x1=1, y0=0, y1=1, container_name="Bezier", cpx=[0, 1, 0.1295811534, 1], cpy=[1, 1, 0, 0])
multiplication = Multiplication(A=vec2pt.Vector, B=graph)
move_2 = Move(Geometry=pop2d, Motion=multiplication)  # -> Geometry, Transform
srf_cp = SurfaceClosestPoint(Point=move_2.Geometry, Surface=srf4pt_2)  # -> Point, UVPoint, Distance
equals = Equality(FirstNumber=srf_cp.Distance, SecondNumber=0)  # -> Equality, Inequality
cull = CullPattern(List=srf_cp.Point, CullPattern=invert(equals.Equality))

unityslider_3 = UnitySlider(num=Slider(0.005, range=0..0.015), init=button)  # -> out, Value; inputs num: Double, init: Boolean; same code as unityslider

unityslider_4 = UnitySlider(num=Slider(12.647, range=0..20), init=button)  # -> out, Value; inputs num: Double, init: Boolean; same code as unityslider

merge = Merge(Data1=move.Geometry, Data2=cull)
intcrv = Interpolate(Vertices=move.Geometry, Degree=3, Periodic=Toggle(True), KnotStyle=1)  # -> Curve, Length, Domain
vorgroup = VoronoiGroups(Boundary=planesrf, Generation1=move.Geometry, Generation2=merge)  # -> Diagram1, Diagram2
crv = Curve(vorgroup.Diagram2)
null = NullItem(Item=crv)  # -> NullFlags, InvalidFlags, Description
cull_2 = CullPattern(List=crv, CullPattern=invert(null.NullFlags))
pcen = PolygonCenter(Polyline=cull_2)  # -> CenterV, CenterE, CenterA
dist = Distance(PointA=pt_14, PointB=pcen.CenterV)
vec2pt_2 = Vector2Pt(PointA=pt_14, PointB=pcen.CenterV, Unitize=True)  # -> Vector, Length
sort = SortList(Keys=dist)  # -> reverse(Keys), ValuesA
xprod = CrossProduct(VectorA="0,0,1", VectorB=vec2pt_2.Vector, Unitize=False)  # -> Vector, Length
vdis = VectorDisplay(Anchor=pcen.CenterV, Vector=vec2pt_2.Vector)
item_4 = ListItem(List=sort.Keys, Index=0, Wrap=True)
subtraction_2 = Subtraction(A=item_4, B=dist)
division_2 = Division(A=subtraction_2, B=item_4)
neg = Negative(Value=unityslider_4.Value)
graph_2 = GraphMapper(division_2, x0=0, x1=1, y0=0, y1=1, container_name="Bezier", cpx=[0, 0.8101806641, 1, 1], cpy=[0, 0, 0, 1])
lng = ListLength(List=xprod.Vector)
dom_4 = ConstructDomain(DomainStart=neg, DomainEnd=unityslider_4.Value)
random_3 = Random(Range=dom_4, Number=lng, Seed=42)  # -> flatten(Random)
multiplication_2 = Multiplication(A=graph_2, B=item_4)
rotate = Rotate(Geometry=xprod.Vector, Angle=random_3, Plane=PlaneXY(0, 0, 0))  # -> Geometry, Transform
multiplication_3 = Multiplication(A=multiplication_2, B=unityslider_3.Value)
vdis_2 = VectorDisplay(Anchor=pcen.CenterV, Vector=rotate.Geometry)

# ---- group: X/Y
multiplication_4 = Multiplication(A=vec2pt_2.Vector, B=multiplication_3)

# ----
multiplication_5 = Multiplication(A=multiplication_3, B=Slider(5, range=0..1000))
lng_2 = ListLength(List=multiplication_3)
dom_5 = ConstructDomain(DomainStart=multiplication_5, DomainEnd=multiplication_3)
series = Series(Start=0, Step=1, Count=lng_2)
random_4 = Random(Range=dom_5, Number=1, Seed=series)  # -> flatten(Random)
vec = VectorXYZ(XComponent=0, YComponent=0, ZComponent=random_4)  # -> flatten(Vector), Length
multiplication_6 = Multiplication(A=random_4, B=Slider(0.75, range=0..100))
addition = Addition(A=multiplication_4, B=vec.Vector)
rot3d = Rotate3D(Geometry=cull_2, Angle=multiplication_6, Center=pcen.CenterV, Axis=rotate.Geometry)  # -> Geometry, Transform
area_2 = Area(Geometry=srf4pt_2)  # -> Area, Centroid
scale_2 = Scale(Geometry=planesrf, Center=area_2.Centroid, Factor=Slider(2, range=0..2))  # -> Geometry, Transform
move_3 = Move(Geometry=rot3d.Geometry, Motion=addition)  # -> Geometry, Transform
Z = UnitZ(Factor=1)
project = Project(Curve=move_3.Geometry, Brep=scale_2.Geometry, Direction=Z)
closecrv = CloseCurve(Curve=project)
clscrv = CloseCurve(Curve=project, CloseType=0, Bulge=0.5, Tolerance=0)  # -> Closed, R
rot3d_2 = Rotate3D(Geometry=clscrv.Closed, Angle=1.570796327, Center=area_2.Centroid, Axis="1,0,0")  # -> flatten(Geometry), Transform
bbox = BoundingBox(Content=rot3d_2.Geometry, Plane=PlaneXY(0, 0, 0), UnionBox=True)  # -> Box, Box_2
debrep_2 = DeconstructBrep(Brep=bbox.Box)  # -> Faces, Edges, Vertices
item_5 = ListItem(List=debrep_2.Vertices, Index=0, Wrap=True)
pt_16 = ConstructPoint(XCoordinate=0, YCoordinate=0, ZCoordinate=0)
pl = PlaneNormal(Origin=pt_16, ZAxis=Vector(0, 0, 1))
orient = Orient(Geometry=rot3d_2.Geometry, Source=item_5, Target=pl)  # -> Geometry, Transform
number_slider_4 = Slider(5, range=0..10)
flatten = FlattenTree(Tree=orient.Geometry, Path="{0}")
receive = CSharpScript()  # -> A
# ---------- receive: C# ----------
    Register(Component);

    A = randomSeed;
# ---------- receive: C# additional code ----------
  double randomSeed = 0.0;
  bool registered = false;
  IGH_Component comp = null;

  void Register(IGH_Component component)
  {
    if(!registered)
    {
      Rhino.Runtime.HostUtils.RegisterNamedCallback("ToGrasshopper", ToGrasshopper);

      comp = component;

      registered = true;
    }
  }

  void ToGrasshopper(object sender, Rhino.Runtime.NamedParametersEventArgs args)
  {
    double val;
    if (args.TryGetDouble("randomSeed", out val))
      randomSeed = val;

    comp.ExpireSolution(true);
  }
# ---------- end receive ----------
lng_3 = ListLength(List=flatten)
random_5 = Random(Range=number_slider_4, Number=lng_3, Seed=receive, Integers=True)
division_3 = Division(A=random_5, B=number_slider_4)
gradient = Gradient(LowerLimit=0, UpperLimit=1, Parameter=division_3, stops=[0: RGB(255, 255, 255), 1: RGB(0, 0, 0)])
graft = GraftTree(Tree=flatten, IncludeEmptyLists=True, IncludeNullItems=True)
graft_2 = GraftTree(Tree=gradient, IncludeEmptyLists=True, IncludeNullItems=True)
mcol = MeshColours(Mesh=graft, Colours=graft_2)
mjoin = MeshJoin(Meshes=flatten(mcol))
filter = StreamFilter(Gate=Slider(1, range=0..1), Stream0=mcol, Stream1=mjoin)  # -> flatten(Stream)
demesh = DeconstructMesh(Mesh=filter)  # -> Vertices, Faces, Colours, Normals
lng_4 = ListLength(List=demesh.Vertices)
unitymesh = UnityMesh(meshes=simplify(filter), mats=simplify(gradient))  # -> outMesh, outMat; inputs meshes: tree of Mesh, mats: tree
# ---------- unitymesh: C# usings ----------
using System.Linq;
using System.Drawing;
using Grasshopper.GUI.Canvas;
# ---------- unitymesh: C# ----------
    if(comp == null){
      Component.PingDocument -= OnPingDocument;
      Component.PingDocument += OnPingDocument;
      Component.ObjectChanged -= OnObjectChanged;
      Component.ObjectChanged += OnObjectChanged;
      Grasshopper.Instances.ActiveCanvas.DocumentChanged -= OnDocumentChanged;
      Grasshopper.Instances.ActiveCanvas.DocumentChanged += OnDocumentChanged;

      comp = Component;
    }
    prevMeshes = meshes;

    DataTree<GH_Material> ghMats = new DataTree<GH_Material>();
    ClearAllMeshes(meshes);

    List <int> tempDataTreeCounts = new List<int>();
    for(int i = 0; i < meshes.BranchCount; i++){
      GH_Path path = meshes.Paths[i];
      tempDataTreeCounts.Add(meshes.Branches[i].Count);

      List<object> matList = mats.Branches[Math.Min(i, mats.BranchCount - 1)];
      for(int n = 0; n < meshes.Branches[i].Count; n++){
        Mesh mesh = meshes.Branches[i][n];
        object mat = matList[Math.Min(n, matList.Count - 1)];
        using(var args = new Rhino.Runtime.NamedParametersEventArgs())
        {
          Color color = Color.White;
          Color emission = Color.Black;
          Color specular = Color.DarkGray;
          double transparency = 0f;
          double shine = 50;


          if(mat != null && mat.GetType() == typeof(Rhino.Display.DisplayMaterial)){
            var material = (Rhino.Display.DisplayMaterial) mat;
            color = material.Diffuse;
            emission = material.Emission;
            transparency = material.Transparency;
            shine = material.Shine;
            specular = material.Specular;
          }else if(mat != null && mat.GetType() == typeof(System.Drawing.Color)){
            color = (System.Drawing.Color) mat;
            shine = 0.5;
          }

          args.Set("id", Component.InstanceGuid.ToString() + "-" + i.ToString() + "_" + n.ToString());
          args.Set("mesh", new Mesh[]{mesh});
          args.Set("diffuse", color);
          args.Set("emission", emission);
          args.Set("specular", specular);
          args.Set("transparency", transparency);
          args.Set("shine", shine);
          Rhino.Runtime.HostUtils.ExecuteNamedCallback("FromGHMesh", args);

          var displayMat = new Rhino.Display.DisplayMaterial(color);
          displayMat.Specular = specular;
          displayMat.Emission = emission;
          displayMat.Transparency = transparency;
          displayMat.Shine = shine;

          var ghmat = new GH_Material(displayMat);
          ghMats.Add(ghmat, path);
        }
      }
    }

    prevDataTreeCounts = tempDataTreeCounts;

    outMesh = meshes;
    outMat = ghMats;
# ---------- unitymesh: C# additional code ----------
  IGH_Component comp = null;
  DataTree<Mesh> prevMeshes = new DataTree<Mesh>();
  List<int> prevDataTreeCounts = new List<int>();

  public void OnPingDocument(object sender, GH_PingDocumentEventArgs e){
    if(e.Document == null){
      ClearAllMeshes(prevMeshes);
    }
  }

  public void OnObjectChanged(object sender, GH_ObjectChangedEventArgs e){
    if(e.Type == GH_ObjectEventType.Enabled){
      if(comp.Locked){
        ClearAllMeshes(prevMeshes);
      }
    }

    comp.ExpireSolution(true);
  }

  public void OnDocumentChanged(object sender, GH_CanvasDocumentChangedEventArgs e){
    ClearAllMeshes(prevMeshes);
    if(comp != null){
      comp.ExpireSolution(true);
    }
  }

  public void ClearAllMeshes(DataTree<Mesh> meshes){
    int branchCount = Math.Max(meshes.BranchCount, prevDataTreeCounts.Count);
    for(int i = 0; i < branchCount; i++){
      int meshCount = 0;
      int prevCount = 0;
      if(meshes.BranchCount > i){
        meshCount = meshes.Branches[i].Count;
      }
      if(prevDataTreeCounts.Count > i){
        prevCount = prevDataTreeCounts[i];
      }
      int itemCount = Math.Max(meshCount, prevCount);


      for(int n = 0; n < itemCount; n++){
        using(var args = new Rhino.Runtime.NamedParametersEventArgs()){
          args.Set("id", comp.InstanceGuid.ToString() + "-" + i.ToString() + "_" + n.ToString());
          Rhino.Runtime.HostUtils.ExecuteNamedCallback("FromGHClearMesh", args);
        }
      }
    }
  }
# ---------- end unitymesh ----------
panel_5 = Panel(lng_4)
