# Grasshopper definition 20210521_test01_Tracker_Simulation_Echo.gh (Grasshopper 1.0.7)
# plug-ins: Robots, AstarPathFinder, Owl.GH, Owl.Accord.GH, Anemone, treesloth01

read_file = ReadFile(File="D:\Go Abroad\05 IaaC_Term 3\01 Software\02 Data Sets\0514\bag1,2,3-combined.csv", PerLineParse=True)

crv = Curve(<curve referenced from the Rhino model>)
arrrec = RectangularArray(Geometry=crv, Cell=crv, XCount="-15", YCount="-20")  # -> Geometry, Transform
area = Area(Geometry=arrrec.Geometry)  # -> Area, Centroid
preview = CustomPreview(Geometry=arrrec.Geometry, Material=ColourSwatch(SwatchColor=RGB(171, 171, 171)))
points = PointList(Points=area.Centroid, Size=8)

panel = Panel(read_file)
panel_2 = Panel("""X: 
Y: 
Z: 
Pitch:
Roll:
Yaw: """)
panel_3 = Panel("""9
14
19
28
36
43""")
text_split = TextSplit(Text=read_file, Separators=panel_2)
deconstruct = Deconstruct(Point=area.Centroid)  # -> XComponent, YComponent, ZComponent
list_item = ListItem(List=text_split, Index=0, Wrap=True)

crv_2 = Curve(<curve referenced from the Rhino model>)
arrrec_2 = RectangularArray(Geometry=crv_2, Cell=crv_2, XCount="-15", YCount="-20")  # -> Geometry, Transform
area_2 = Area(Geometry=arrrec_2.Geometry)  # -> Area, Centroid
points_2 = PointList(Points=area_2.Centroid)
preview_2 = CustomPreview(Geometry=arrrec_2.Geometry, Material=ColourSwatch(SwatchColor=RGB(171, 171, 171)))

tree_statistics = TreeStatistics(Tree=list_item)  # -> Paths, Length, Count
panel_4 = Panel(list_item)
cull_index = CullIndex(List=tree_statistics.Paths, Indices="0", Wrap=True)
file = ReadFile(File="D:\Go Abroad\05 IaaC_Term 3\01 Software\02 Data Sets\0514\bag1,2,3-combined.csv", PerLineParse=True)
bounds = Bounds(Numbers=deconstruct.XComponent)
bounds_2 = Bounds(Numbers=deconstruct.ZComponent)
bounds_3 = Bounds(Numbers=deconstruct.YComponent)
tree_branch = TreeBranch(Tree=list_item, Path=cull_index, MaintainPaths=True)
cull_i = CullIndex(List=file, Indices="0", Wrap=True)
text_split_2 = TextSplit(Text=tree_branch, Separators=",")

# ---- group: Craftsman WS
crv_3 = Curve(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)
arrrec_3 = RectangularArray(Geometry=crv_3, Cell=crv_3, XCount="-15", YCount="-20")  # -> Geometry, Transform
area_3 = Area(Geometry=arrrec_3.Geometry)  # -> Area, Centroid
preview_3 = CustomPreview(Geometry=arrrec_3.Geometry, Material=ColourSwatch(SwatchColor=RGB(171, 171, 171)))
points_3 = PointList(Points=area_3.Centroid, Size=8)

# ---- group: Robotic WS
crv_4 = Curve(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)
arrrec_4 = RectangularArray(Geometry=crv_4, Cell=crv_4, XCount="-15", YCount="-20")  # -> Geometry, Transform
area_4 = Area(Geometry=arrrec_4.Geometry)  # -> Area, Centroid
preview_4 = CustomPreview(Geometry=arrrec_4.Geometry, Material=ColourSwatch(SwatchColor=RGB(171, 171, 171)))
points_4 = PointList(Points=area_4.Centroid)

# ----
lng = ListLength(List=cull_i)
panel_5 = Panel(""",
,
X: 
Y: 
Z: 
Pitch:
Roll:
Yaw: """)
panel_6 = Panel("G:\firefox download\full_q1\bag1,2,3-combined.csv")
panel_7 = Panel(lng)
list_item_2 = ListItem(List=text_split_2, Index="2", Wrap=True)  # -> flatten(Item)

# ---- group: XYZ YPR Controller
list_item_3 = ListItem(List=list_item_2, Index=Slider(0, range=0..84), Wrap=True)

# ---- group: YPR
panel_8 = Panel("""24
32
39""")
list_item_4 = ListItem(List=text_split, Index=panel_8, Wrap=True)
tree_statistics_2 = TreeStatistics(Tree=list_item_4)  # -> Paths, Length, Count
cull_index_2 = CullIndex(List=tree_statistics_2.Paths, Indices="0", Wrap=True)
tree_branch_2 = TreeBranch(Tree=list_item_4, Path=cull_index_2, MaintainPaths=True)
tree_statistics_3 = TreeStatistics(Tree=tree_branch_2)  # -> Paths, Length, Count
list_item_5 = ListItem(List=tree_statistics_3.Paths, Index=list_item_3, Wrap=True)
tree_branch_3 = TreeBranch(Tree=list_item_4, Path=list_item_5, MaintainPaths=True)
list_item_6 = ListItem(List=tree_branch_3, Index=0, Wrap=True)  # -> Item, Item1, Item2

# ---- group: XYZ
panel_9 = Panel("""5
10
15""")
list_item_7 = ListItem(List=text_split, Index=panel_9, Wrap=True)
tree_statistics_4 = TreeStatistics(Tree=list_item_7)  # -> Paths, Length, Count
cull_index_3 = CullIndex(List=tree_statistics_4.Paths, Indices="0", Wrap=True)
tree_branch_4 = TreeBranch(Tree=list_item_7, Path=cull_index_3, MaintainPaths=True)
tree_statistics_5 = TreeStatistics(Tree=tree_branch_4)  # -> Paths, Length, Count
list_item_8 = ListItem(List=tree_statistics_5.Paths, Index=list_item_3, Wrap=True)
tree_branch_5 = TreeBranch(Tree=list_item_7, Path=list_item_8, MaintainPaths=True)
list_item_9 = ListItem(List=tree_branch_5, Index=0, Wrap=True)  # -> Item, Item1, Item2

# ----
list_item_10 = ListItem(List=area.Centroid, Index=list_item_3, Wrap=True)
panel_10 = Panel(list_item_4)
panel_11 = Panel(tree_branch_2)
panel_12 = Panel(cull_i)
panel_13 = Panel(tree_branch_3)
split = TextSplit(Text=graft(cull_i), Separators=panel_5)
flip_matrix = FlipMatrix(Data=tree_branch_4)
bounds_4 = Bounds(Numbers=flip_matrix)
num = Number(split)

# ---- group: Robot
elbow = Slider(0, range=-90..90)
shoulder = Slider(-90, range=-90..90)
point = Point(<point referenced from the Rhino model>)
mesh = Mesh(<mesh referenced from the Rhino model>)
list = ValueList({"AA-KR60", "AA-KR30", "AA-KR60_KR30", "AARCH IRB120", "AARCH IRB6620", "AAU-Utzon-UR10", "Automata", "Bartlett-IRB120", "Bartlett-IRB1600", "Bartlett-KR6"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}, selected="KULeuven-UR10e")
xy = XYPlane(Origin=point)
xy_2 = XYPlane(Origin=Point(0, 0, 0))
merge = Merge(
    Data1=Slider(0, range=-90..90),
    Data2=reverse(shoulder),
    Data3=reverse(elbow),
    Data4=Slider(0, range=-90..90),
    Data5=Slider(0, range=-90..90),
    Data6=Slider(0, range=-180..180))
load_robot_system = LoadRobotSystem(Name=list, Base=xy_2)
pflip = FlipPlane(Plane=xy, ReverseX=False, ReverseY=False, SwapAxes=True)
tool = CreateTool(Name="WnC_gripper", TCP=pflip, Weight=0, Mesh=mesh)  # -> Tool, TCP
degtorad = DegreesToRadians(Degrees=merge, RobotSystem=load_robot_system, MechanicalGroup=0)
target = CreateTarget(Joints=degtorad, Tool=tool.Tool, IsCartesian=False)

# ----
panel_14 = Panel(tree_branch_4)
null = NullItem(Item=num)  # -> NullFlags, InvalidFlags, Description
cull = CullPattern(List=split, CullPattern=invert(null.NullFlags))
panel_16 = Panel(cull)
custom_preview = CustomPreview(
    Geometry=mesh,
    Material={diffuse=RGB(221, 160, 221), emission=RGB(66, 48, 66), shine=0.5, specular=RGB(255, 255, 255), transparency=0})

timer = Timer(Interval=10, TimerInterval=10, Target=time)  # disabled
time = Timekeeper(Play=Toggle(False), Pause=Toggle(False), Max="83")  # -> out, C, H
# ---------- time: VB ----------
    component.Params.Output(0).Name = "HMS"
    component.Params.Output(0).Description = "Hours, Minutes and seconds"
    component.Params.Output(1).Name = "Count"
    component.Params.Output(1).Description = "Counter"
    component.Params.Output(2).Name = "Hours"
    component.Params.Output(2).Description = "Hours in decimal value"

    Timer = FindGhTimer()

    If play And Not pause Then
      count += 1
      pararTimer = False
    Else
      If Not pause Then count = 0
      pararTimer = True
    End If

    C = count

    If Max <> 0 AndAlso Count >= Max Then pararTimer = True
    If timer IsNot Nothing Then
      Timer.Locked = PararTimer
      Dim span As TimeSpan = TimeSpan.FromSeconds(Count * (timer.Interval / 1000))
      Print(String.Format("{0}h {1}m {2}s", span.Hours, span.Minutes, span.Seconds))
      H = span.Minutes / 60 + span.Hours
    End If
# ---------- time: VB additional code ----------
  Dim count As New Integer
  Dim Timer As Grasshopper.Kernel.Special.GH_Timer
  Dim pararTimer As New Boolean

  Function FindGhTimer() As Grasshopper.Kernel.Special.GH_Timer
    Dim ghDoc As GH_Document = owner.OnPingDocument()
    If ghDoc Is Nothing Then Return Nothing
    For Each obj As IGH_DocumentObject In ghDoc.Objects
      If TypeOf(obj) Is Grasshopper.Kernel.Special.GH_Timer Then
        Dim timer As Grasshopper.Kernel.Special.GH_Timer = DirectCast(obj, grasshopper.Kernel.Special.GH_Timer)
        If timer.Targets.Contains(owner.InstanceGuid) Then Return timer
      End If
    Next
    Return Nothing
  End Function
# ---------- end time ----------
subtraction = Subtraction(A="83", B=time.C)
subtraction_2 = Subtraction(A="83", B=subtraction)
addition = Addition(A=time.C, B=subtraction_2)
division = Division(A=addition, B="2")
panel_17 = Panel(division)

panel_18 = Panel("""0
1
2""")
cull_i_2 = CullIndex(List=cull, Indices=panel_18, Wrap=True)
flip_last = FlipLast(Data=cull_i_2)

panel_19 = Panel(list_item_9.Item)
panel_20 = Panel(list_item_9.Item1)
panel_21 = Panel(list_item_9.Item2)

list_item_11 = ListItem(List=flatten(bounds_4), Index=0, Wrap=True)  # -> Item, Item1, Item2

panel_22 = Panel(list_item_6.Item)
panel_23 = Panel(list_item_6.Item1)
panel_24 = Panel(list_item_6.Item2)

dam = DataDam(BufferDelay=10000000, BufferMode=0)
construct_point = ConstructPoint(XCoordinate=panel_19, YCoordinate=panel_20, ZCoordinate=panel_21)
item = ListItem(List=flip_last, Index=division, Wrap=True)  # -> flatten(Item)
panel_25 = Panel(item)

# ---- group: matrix from YPR
creatematrixfromyawpitchroll = CreateMatrixFromYawPitchRoll(Yaw=panel_22, Pitch=panel_23, Roll=panel_24)
display_matrix = DisplayMatrix(creatematrixfromyawpitchroll)

# ----
point_2 = Point(<point referenced from the Rhino model>)
panel_26 = Panel(target)
plane = Plane(point_2)
item_2 = ListItem(List=item, Index=0, Wrap=True)  # -> Item, Item1, Item2, Item3, Item4, Item5
flip_plane = FlipPlane(Plane=plane, ReverseX=False, ReverseY=False, SwapAxes=True)
mesh_2 = Mesh(<mesh referenced from the Rhino model>)
yaw = Number(item_2.Item5)
pitch = Number(item_2.Item3)
roll = Number(item_2.Item4)
deconstruct_2 = Deconstruct(Point=construct_point)  # -> XComponent, YComponent, ZComponent
remap_numbers = RemapNumbers(Value=deconstruct_2.XComponent, Source=list_item_11.Item, Target=bounds)  # -> Mapped, Clipped
remap_numbers_2 = RemapNumbers(Value=deconstruct_2.YComponent, Source=list_item_11.Item1, Target=bounds_3)  # -> Mapped, Clipped
remap_numbers_3 = RemapNumbers(Value=deconstruct_2.ZComponent, Source=list_item_11.Item2, Target=bounds_2)  # -> Mapped, Clipped
panel_27 = Panel(remap_numbers_3.Mapped)

# ---- group: Number Select
item_3 = ListItem(List=cull, Index="2", Wrap=True)
item_4 = ListItem(List=flatten(item_3), Index=division, Wrap=True)

# ----
item_5 = ListItem(List=area_4.Centroid, Index=item_4, Wrap=True)
item_6 = ListItem(List=area_3.Centroid, Index=item_4, Wrap=True)
construct_point_2 = ConstructPoint(XCoordinate=remap_numbers.Mapped, YCoordinate=remap_numbers_2.Mapped, ZCoordinate=remap_numbers_3.Mapped)
orient = Orient(Geometry=mesh_2, Source=flip_plane, Target=construct_point)  # -> Geometry, Transform
point_3 = Point(item_6)
point_4 = Point(<point referenced from the Rhino model>)
panel_28 = Panel(item_4)
plane_2 = Plane(construct_point)
Z = UnitZ(Factor=1)
Z_2 = UnitZ(Factor="-1")
pl = PlaneNormal(Origin=point_3, ZAxis=Z)
pl_2 = PlaneNormal(Origin=point_4, ZAxis=Z_2)
merge_2 = Merge(Data1=plane_2, Data2=orient.Geometry)

# ---- group: Tools
mesh_3 = Mesh(<mesh referenced from the Rhino model>)

# ----
orient_2 = Orient(Geometry=merge_2, Source=plane_2, Target=construct_point_2)  # -> Geometry, Transform
orient_3 = Orient(Geometry=mesh_3, Source=pl_2, Target=pl)  # -> Geometry, Transform
craftsman = Craftsman(geometry=orient_3.Geometry, yaw=yaw, pitch=pitch, roll=roll, center=point_3)

# ---- group: hand area plane rotation
cluster = Cluster_2(
    geometry=orient_2.Geometry,
    angle=panel_24,
    center=construct_point_2,
    angle_2=panel_23,
    center_2=construct_point_2,
    angle_3=panel_22,
    center_3=construct_point_2)

# ---- group: Robot plane rotation
list_item_12 = ListItem(List=area_2.Centroid, Index=list_item_3, Wrap=True)
plane_3 = Plane(list_item_12)
cluster_2 = Cluster(
    geometry=plane_3,
    angle=panel_24,
    center=list_item_12,
    angle_2=panel_23,
    center_2=list_item_12,
    angle_3=panel_22,
    center_3=list_item_12)

# ----
list_2 = ValueList({"AA-KR60", "AA-KR30", "AA-KR60_KR30", "AARCH IRB120", "AARCH IRB6620", "AAU-Utzon-UR10", "Automata", "Bartlett-IRB120", "Bartlett-IRB1600", "Bartlett-KR6"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}, selected="KULeuven-UR10e")
wrist_2 = Slider(0, range=-90..90)
wrist_3 = Slider(0, range=-180..180)
base = Slider(0, range=-90..90)
shoulder_2 = Slider(-90, range=-90..90)
elbow_2 = Slider(0, range=-90..90)
wrist_1 = Slider(0, range=-90..90)
xy_3 = XYPlane(Origin=Point(0, 0, 0))
point_5 = Point(<point referenced from the Rhino model>)
load_robot_system_2 = LoadRobotSystem(Name=list_2, Base=xy_3)
merge_3 = Merge(Data1=base, Data2=reverse(shoulder_2), Data3=reverse(elbow_2), Data4=wrist_1, Data5=wrist_2, Data6=wrist_3)
xy_4 = XYPlane(Origin=point_5)
pflip_2 = FlipPlane(Plane=xy_4, ReverseX=False, ReverseY=False, SwapAxes=True)
degtorad_2 = DegreesToRadians(Degrees=merge_3, RobotSystem=load_robot_system_2, MechanicalGroup=0)
tool_2 = CreateTool(Name="CraftsTool", TCP=pflip_2, Weight=0, Mesh=mesh_3)  # -> Tool, TCP
pln = Plane(item_5)
craftsman_2 = Craftsman(geometry=pln, yaw=yaw, pitch=pitch, roll=roll, center=item_5)
list_3 = ValueList({"Joint", "Linear"}, selected="Joint")
target_2 = CreateTarget(Plane=craftsman_2, Motion=list_3, Tool=tool_2.Tool, Speed="100", IsCartesian=True)
target_3 = CreateTarget(Joints=degtorad_2, Tool=tool_2.Tool, IsCartesian=False)
list_4 = ValueList({"Joint", "Linear"}, selected="Joint")
panel_29 = Panel(target_3)
target_4 = CreateTarget(Plane=cluster_2, Motion=list_4, Tool=tool.Tool, Speed="100", IsCartesian=True)
entwine = Entwine(Branch00=target_3, Branch01=target_2, Branch02=target_3, FlattenInputs=True)
merge_4 = Merge(Data1=flatten(target), Data2=target_4, Data3=flatten(target))
program = CreateProgram(Name="Echo_Experiment", RobotSystem=load_robot_system_2, Targets1=flatten(entwine), StepSize=1)  # -> Program, Code, Duration, Warnings, Errors
panel_30 = Panel(program.Code)
sim = ProgramSimulation(Program=program.Program, Time=Slider(0.5, range=0..1), Normalized=True)  # -> SystemMeshes, JointRotations, Plane, Index, Time, Program, Errors
panel_31 = Panel(program.Errors)
# Where can take the TCP data?
collisions = CheckCollisions(Program=program.Program, FirstSet=7, SecondSet=4, EnvironmentPlane=-1, LinearStepSize=100, AngularStepSize=0.7853981634)  # -> CollisionFound, TargetIndex, CollidedMeshes
panel_32 = Panel(collisions.CollisionFound)
panel_33 = Panel(collisions.CollidedMeshes)
panel_34 = Panel(sim.JointRotations)
mesh_4 = Mesh(sim.SystemMeshes)
preview_5 = CustomPreview(Geometry=mesh_4, Shader=ColourSwatch(SwatchColor=RGBA(0, 0, 0, 137)))
txt = Text(flatten(program.Code))
file_name = Panel("SW_Echo")
path = FilePath("D:\\")
python = GhPythonScript(program=txt, path=path, name=file_name, write=Button())  # -> out, a; inputs program: list
# ---------- python: Python ----------
__author__ = "kunal"
__version__ = "2018.10.16"

import rhinoscriptsyntax as rs

if write:
    with open(path + name + '.prg', 'w') as file:
        for line in program:
            file.write(line)
            file.write('\n')
# ---------- end python ----------
# ROBOT SETUP
program_2 = CreateProgram(Name="Studio", RobotSystem=load_robot_system, Targets1=flatten(merge_4), StepSize=1)  # -> Program, Code, Duration, Warnings, Errors
check_errors = Panel(program_2.Errors)
to_export_code_file_prg = Panel(program_2.Code)
entwine_2 = Entwine(
    Branch00=item_4,
    Branch01=item_5,
    Branch02=item_6,
    Branch03=pitch,
    Branch04=roll,
    Branch05=yaw,
    Branch06=sim.JointRotations,
    FlattenInputs=True)  # -> flatten(Result)
panel_35 = Panel(entwine_2)
collisions_2 = CheckCollisions(
    Program=program_2.Program,
    FirstSet=7,
    SecondSet=4,
    EnvironmentPlane=-1,
    LinearStepSize=100,
    AngularStepSize=0.7853981634)  # -> CollisionFound, TargetIndex, CollidedMeshes
item_7 = ListItem(List=entwine_2, Index=0, Wrap=True)  # -> Item, Item1, Item2, Item3, Item4, Item5, Item6, Item7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
sim_2 = ProgramSimulation(Program=program_2.Program, Time=Slider(0, range=0..1), Normalized=True)  # -> SystemMeshes, JointRotations, Plane, Index, Time, Program, Errors

list_item_13 = ListItem(List=sim_2.SystemMeshes, Index=Slider(7, range=0..10), Wrap=True)
preview_6 = CustomPreview(Geometry=list_item_13, Shader=ColourSwatch(SwatchColor=RGB(0, 0, 0)))
# DISPLAY SETUP
split_2 = SplitList(List=sim_2.SystemMeshes, Index="7")  # -> ListA, ListB
preview_7 = CustomPreview(Geometry=split_2.ListB, Shader=ColourSwatch(SwatchColor=RGB(71, 71, 71)))
preview_8 = CustomPreview(Geometry=split_2.ListA, Shader=ColourSwatch(SwatchColor=RGBA(30, 0, 36, 137)))

rec = DataRecorder(item_7.Item, DataLimit=-10, RecordData=True)  # disabled
rec_2 = DataRecorder(item_7.Item1, DataLimit=-10, RecordData=True)  # disabled
rec_3 = DataRecorder(item_7.Item2, DataLimit=-10, RecordData=True)  # disabled
rec_4 = DataRecorder([item_7.Item3, item_7.Item4, item_7.Item5], DataLimit=-10, RecordData=True)  # disabled
rec_5 = DataRecorder(
    graft([item_7.Item6, item_7.Item7, item_7.Item8, item_7.Item9, item_7.Item10, item_7.Item11]),
    DataLimit=-10,
    RecordData=True)  # disabled
panel_36 = Panel(rec)
trail = SimpleTrail(Program=sim_2.Program, Length=500, MechanicalGroup=0)
panel_37 = Panel(collisions_2.CollisionFound)
panel_38 = Panel(sim_2.Index)
time_seconds = Panel(sim_2.Time)
txt_2 = Text(flatten(program_2.Code))
path_2 = FilePath("D:\\")
file_name_2 = Panel("WirenClay_08")
robot_grid = Panel(rec_2)
python_2 = GhPythonScript(program=txt_2, path=path_2, name=file_name_2, write=Button())  # -> out, a; inputs program: list; same code as python
preview_9 = CustomPreview(Geometry=trail, Shader=ColourSwatch(SwatchColor=RGB(255, 0, 0)))
craftsman_grid = Panel(rec_3)
pry = Panel(rec_4)
entwine_3 = Entwine(
    Branch00=list_item_3,
    Branch01=list_item_12,
    Branch02=construct_point_2,
    Branch03=panel_24,
    Branch04=panel_23,
    Branch05=panel_22,
    Branch06=sim_2.JointRotations,
    FlattenInputs=True)  # -> flatten(Result)
panel_39 = Panel("""6
7
8
9
10
11""")
joint = Panel(rec_5)
panel_40 = Panel("""3
4
5""")
list_item_14 = ListItem(List=entwine_3, Index=0, Wrap=True)
list_item_15 = ListItem(List=entwine_3, Index="1", Wrap=True)
list_item_16 = ListItem(List=entwine_3, Index="2", Wrap=True)
list_item_17 = ListItem(List=entwine_3, Index=panel_40, Wrap=True)
list_item_18 = ListItem(List=entwine_3, Index=panel_39, Wrap=True)
data_recorder = DataRecorder(list_item_15, DataLimit=-10, RecordData=False)
data_recorder_2 = DataRecorder(list_item_17, DataLimit=-10, RecordData=False)
data_recorder_3 = DataRecorder(list_item_16, DataLimit=-10, RecordData=False)
data_recorder_4 = DataRecorder(list_item_14, DataLimit=-10, RecordData=False)
data_recorder_5 = DataRecorder(list_item_18, DataLimit=-10, RecordData=False)
robot_grid_point = Panel(list_item_18)

# ---- group: All inputs
panel_41 = Panel(entwine_3)

# ----
s_no = Panel(data_recorder_4)
craftsman_grid_2 = Point([Point(-700, 102.575, 0), Point(-840, 102.575, 0), Point(-924, 102.575, 0), Point(-952, 102.575, 0), Point(-644, 87.725, 0), Point(-784, 87.725, 0)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])
pry_2 = Number([-153.8503756, -171.9841706, -91.67223717, -167.8136134, -167.9792664, -95.45578369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])

j2 = Number([-2.288133029, -2.036766931, -1.900000395, -1.857642074, -2.41324368, -2.134646767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])
j3 = Number([-1.778987506, -2.184988161, -2.387258514, -2.487745974, -1.611709003, -2.044327898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])
j4 = Number([-0.1751590106, -0.2002500927, -0.2453345341, -0.1547162654, -0.05646207172, -0.1586136276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])
j1 = Number([0.4454781123, 0.5395772873, 0.615297634, 0.6731580804, 0.343924646, 0.4385256505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])
j5 = Number([1.493777437, 1.637041241, 1.75645933, 1.744995732, 1.641347682, 1.663783247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])
j6 = Number([0.488752713, 0.6669661876, 0.7396698734, 0.8556232906, 0.3713240881, 0.5135697584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])

robot_grid_point_2 = Panel(data_recorder)
deg = Degrees(Radians=j6)
panel_42 = Panel("""True
False
False""")
panel_43 = Panel("""False
True
False""")
panel_44 = Panel("""False
False
True""")
deg_2 = Degrees(Radians=j5)
deg_3 = Degrees(Radians=j4)
deg_4 = Degrees(Radians=j3)
deg_5 = Degrees(Radians=j2)
deg_6 = Degrees(Radians=j1)
hand_grid_point = Panel(data_recorder_3)
bnd = Bounds(Numbers=deg)
bnd_2 = Bounds(Numbers=deg_2)
bnd_3 = Bounds(Numbers=deg_3)
bnd_4 = Bounds(Numbers=deg_4)
bnd_5 = Bounds(Numbers=deg_5)
bnd_6 = Bounds(Numbers=deg_6)
pdecon = Deconstruct(Point=craftsman_grid_2)  # -> XComponent, YComponent, ZComponent
cull_2 = CullPattern(List=pry_2, CullPattern=panel_42)
cull_3 = CullPattern(List=pry_2, CullPattern=panel_43)
cull_4 = CullPattern(List=pry_2, CullPattern=panel_44)
dom = ConstructDomain(DomainStart=0, DomainEnd="1")

# ---- group: X
robot_grid_2 = Point([Point(963.515, 244.125, 0), Point(711.865, 244.125, 0), Point(560.875, 244.125, 0), Point(510.545, 244.125, 0), Point(1064.175, 216.375, 0), Point(812.525, 216.375, 0)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])
no = Number([4, 9, 12, 13, 17, 22, 24, 29, 32, 34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])
pdecon_2 = Deconstruct(Point=robot_grid_2)  # -> XComponent, YComponent, ZComponent
bnd_7 = Bounds(Numbers=pdecon_2.XComponent)
bnd_8 = Bounds(Numbers=pdecon_2.YComponent)
remap = RemapNumbers(Value=pdecon_2.XComponent, Source=bnd_7, Target=dom)  # -> Mapped, Clipped
remap_2 = RemapNumbers(Value=pdecon_2.YComponent, Source=bnd_8, Target=dom)  # -> Mapped, Clipped

# ----
ypr = Panel(data_recorder_2)
bnd_9 = Bounds(Numbers=pdecon.XComponent)
bnd_10 = Bounds(Numbers=pdecon.YComponent)
bnd_11 = Bounds(Numbers=cull_2)
bnd_12 = Bounds(Numbers=cull_3)
bnd_13 = Bounds(Numbers=cull_4)
dom_2 = ConstructDomain(DomainStart="0", DomainEnd="1")
robot_joints = Panel(data_recorder_5)
remap_3 = RemapNumbers(Value=deg, Source=bnd, Target=dom_2)  # -> Mapped, Clipped
remap_4 = RemapNumbers(Value=pdecon.XComponent, Source=bnd_9, Target=dom)  # -> Mapped, Clipped
remap_5 = RemapNumbers(Value=pdecon.YComponent, Source=bnd_10, Target=dom)  # -> Mapped, Clipped
remap_6 = RemapNumbers(Value=cull_2, Source=bnd_11, Target=dom)  # -> Mapped, Clipped
remap_7 = RemapNumbers(Value=cull_3, Source=bnd_12, Target=dom)  # -> Mapped, Clipped
remap_8 = RemapNumbers(Value=cull_4, Source=bnd_13, Target=dom)  # -> Mapped, Clipped
remap_9 = RemapNumbers(Value=deg_6, Source=bnd_6, Target=dom_2)  # -> Mapped, Clipped
remap_10 = RemapNumbers(Value=deg_5, Source=bnd_5, Target=dom_2)  # -> Mapped, Clipped
remap_11 = RemapNumbers(Value=deg_4, Source=bnd_4, Target=dom_2)  # -> Mapped, Clipped
remap_12 = RemapNumbers(Value=deg_3, Source=bnd_3, Target=dom_2)  # -> Mapped, Clipped
remap_13 = RemapNumbers(Value=deg_2, Source=bnd_2, Target=dom_2)  # -> Mapped, Clipped
featurets = FeatureTensorSet(
    Feature0=remap_4.Mapped,
    Feature1=remap_5.Mapped,
    Feature2=remap_6.Mapped,
    Feature3=remap_7.Mapped,
    Feature4=remap_8.Mapped)
featurets_2 = FeatureTensorSet(
    Feature0=remap_9.Mapped,
    Feature1=remap_10.Mapped,
    Feature2=remap_11.Mapped,
    Feature3=remap_12.Mapped,
    Feature4=remap_13.Mapped,
    Feature5=remap_3.Mapped)
tsview = TensorSetDisplay(TensorSet=featurets, Range=Domain(0, 1))
tsview_2 = TensorSetDisplay(TensorSet=featurets_2, Range=Domain(0, 1))
number_slider = Slider(2, range=0..10)
merge_5 = Merge(Data1="5", Data2=number_slider, Data3="6")

# ---- group: YPR
path_3 = FilePath("C:\Users\user\Downloads\Robot joints.csv")

# ---- group: Hand Area Coordinates
path_4 = FilePath("C:\Users\user\Downloads\Hand grid coordinates.csv")
file_2 = ReadFile(File=path_4, PerLineParse=True)  # -> graft(Content)

# ---- group: Grid number
path_5 = FilePath("C:\Users\user\Downloads\Grid No.csv")
file_3 = ReadFile(File=path_5, PerLineParse=True)  # -> graft(Content)

# ---- group: Robot Joints
path_6 = FilePath("C:\Users\user\Downloads\Robot joints.csv")
file_4 = ReadFile(File=path_6, PerLineParse=True)
cluster_3 = Cluster_3(list=file_4, list_2=file_4, list_3=file_4, list_4=file_4, list_5=file_4, list_6=file_4)  # -> i, i_2, i_3, i_4, i_5, i_6

# ---- group: Robot Area Coordinates
path_7 = FilePath("C:\Users\user\Downloads\Robot joints.csv")
file_5 = ReadFile(File=path_7, PerLineParse=True)
deconstruct_3 = Deconstruct(Point=file_5)  # -> XComponent, YComponent, ZComponent

# ---- group: YPR / Read File
file_6 = ReadFile(File=path_3, PerLineParse=True)
cluster_4 = Cluster_4(list=file_6, list_2=file_6, list_3=file_6)  # -> graft(i), graft(i_2), graft(i_3)

# ----
network = ConstructNetwork(Layers=merge_5, Activation=0, Alpha=Slider(2, range=0..5), Seed=123)

deconstruct_4 = Deconstruct(Point=file_2)  # -> XComponent, YComponent, ZComponent
flip_matrix_2 = FlipMatrix(Data=deconstruct_4.XComponent)
flip_matrix_3 = FlipMatrix(Data=deconstruct_4.YComponent)
bounds_5 = Bounds(Numbers=flip_matrix_2)
bounds_6 = Bounds(Numbers=flip_matrix_3)
remap_numbers_4 = RemapNumbers(Value=deconstruct_4.XComponent, Source=bounds_5, Target=Domain(0, 1))  # -> Mapped, Clipped
remap_numbers_5 = RemapNumbers(Value=deconstruct_4.YComponent, Source=bounds_6, Target=Domain(0, 1))  # -> Mapped, Clipped

graft_tree = GraftTree(Tree=cluster_3.i, IncludeEmptyLists=True, IncludeNullItems=True)
flip_matrix_4 = FlipMatrix(Data=graft_tree)
bounds_7 = Bounds(Numbers=flip_matrix_4)
graft_tree_2 = GraftTree(Tree=cluster_3.i_2, IncludeEmptyLists=True, IncludeNullItems=True)
flip_matrix_5 = FlipMatrix(Data=graft_tree_2)
bounds_8 = Bounds(Numbers=flip_matrix_5)

flip_matrix_6 = FlipMatrix(Data=cluster_4.i_2)
flip_matrix_7 = FlipMatrix(Data=cluster_4.i)
flip_matrix_8 = FlipMatrix(Data=cluster_4.i_3)
bounds_9 = Bounds(Numbers=flip_matrix_6)
bounds_10 = Bounds(Numbers=flip_matrix_7)
bounds_11 = Bounds(Numbers=flip_matrix_8)
remap_numbers_6 = RemapNumbers(Value=cluster_4.i_2, Source=bounds_9, Target=Domain(0, 1))  # -> Mapped, Clipped
remap_numbers_7 = RemapNumbers(Value=cluster_4.i, Source=bounds_10, Target=Domain(0, 1))  # -> Mapped, Clipped
remap_numbers_8 = RemapNumbers(Value=cluster_4.i_3, Source=bounds_11, Target=Domain(0, 1))  # -> Mapped, Clipped

graft_tree_3 = GraftTree(Tree=cluster_3.i_4, IncludeEmptyLists=True, IncludeNullItems=True)
flip_matrix_9 = FlipMatrix(Data=graft_tree_3)
bounds_12 = Bounds(Numbers=flip_matrix_9)
graft_tree_4 = GraftTree(Tree=cluster_3.i_5, IncludeEmptyLists=True, IncludeNullItems=True)
flip_matrix_10 = FlipMatrix(Data=graft_tree_4)
bounds_13 = Bounds(Numbers=flip_matrix_10)
graft_tree_5 = GraftTree(Tree=cluster_3.i_3, IncludeEmptyLists=True, IncludeNullItems=True)
flip_matrix_11 = FlipMatrix(Data=graft_tree_5)
bounds_14 = Bounds(Numbers=flip_matrix_11)
graft_tree_6 = GraftTree(Tree=cluster_3.i_6, IncludeEmptyLists=True, IncludeNullItems=True)
flip_matrix_12 = FlipMatrix(Data=graft_tree_6)
bounds_15 = Bounds(Numbers=flip_matrix_12)
degrees = Degrees(Radians=graft_tree_4)
degrees_2 = Degrees(Radians=graft_tree_3)
degrees_3 = Degrees(Radians=graft_tree_6)
degrees_4 = Degrees(Radians=graft_tree_2)
degrees_5 = Degrees(Radians=graft_tree_5)
degrees_6 = Degrees(Radians=graft_tree)
flip_matrix_13 = FlipMatrix(Data=degrees_6)
flip_matrix_14 = FlipMatrix(Data=degrees_4)
flip_matrix_15 = FlipMatrix(Data=degrees_5)
flip_matrix_16 = FlipMatrix(Data=degrees_2)
flip_matrix_17 = FlipMatrix(Data=degrees_3)
flip_matrix_18 = FlipMatrix(Data=degrees)
bounds_16 = Bounds(Numbers=flip_matrix_13)
bounds_17 = Bounds(Numbers=flip_matrix_14)
bounds_18 = Bounds(Numbers=flip_matrix_15)
bounds_19 = Bounds(Numbers=flip_matrix_16)
bounds_20 = Bounds(Numbers=flip_matrix_17)
bounds_21 = Bounds(Numbers=flip_matrix_18)
remap_numbers_9 = RemapNumbers(Value=degrees_6, Source="-90 To 90", Target=Domain(0, 1))  # -> Mapped, Clipped
remap_numbers_10 = RemapNumbers(Value=degrees_4, Source="-180 To 0", Target=Domain(0, 1))  # -> Mapped, Clipped
remap_numbers_11 = RemapNumbers(Value=degrees_5, Source="-90 To 90", Target=Domain(0, 1))  # -> Mapped, Clipped
remap_numbers_12 = RemapNumbers(Value=degrees_3, Source="-90 To 90", Target=Domain(0, 1))  # -> Mapped, Clipped
remap_numbers_13 = RemapNumbers(Value=degrees, Source="-90 To 90", Target=Domain(0, 1))  # -> Mapped, Clipped
remap_numbers_14 = RemapNumbers(Value=degrees_2, Source="-90 To 90", Target=Domain(0, 1))  # -> Mapped, Clipped
panel_45 = Panel(deconstruct_4.XComponent)
loop_start = LoopStart(N=Slider(200, range=0..500), T=Button(), D0=network)  # -> port, Counter, Data, Data_2
backprop = Backpropagation(
    ActivationNetwork=loop_start.Data,
    Input=featurets,
    Output=featurets_2,
    LearningRate=0.01,
    Momentum=0.001,
    Epoch=10,
    Iterations=100)  # -> ActivationNetwork, Error
panel_46 = Panel(remap_numbers_9.Mapped)
num_2 = Number(backprop.Error)
panel_47 = Panel(loop_start.Counter)
panel_48 = Panel(num_2)
remap_numbers_15 = RemapNumbers(Value=graft_tree_2, Source=bounds_8, Target=Domain(0, 1))  # -> Mapped, Clipped
remap_numbers_16 = RemapNumbers(Value=graft_tree_5, Source=bounds_14, Target=Domain(0, 1))  # -> Mapped, Clipped
remap_numbers_17 = RemapNumbers(Value=graft_tree_6, Source=bounds_15, Target=Domain(0, 1))  # -> Mapped, Clipped
remap_numbers_18 = RemapNumbers(Value=graft_tree, Source=bounds_7, Target=Domain(0, 1))  # -> Mapped, Clipped
remap_numbers_19 = RemapNumbers(Value=graft_tree_4, Source=bounds_13, Target=Domain(0, 1))  # -> Mapped, Clipped
remap_numbers_20 = RemapNumbers(Value=graft_tree_3, Source=bounds_12, Target=Domain(0, 1))  # -> Mapped, Clipped
merge_6 = Merge(Data1=loop_start.Data_2, Data2=num_2)
panel_49 = Panel(remap_numbers_8.Mapped)
remap_numbers_21 = RemapNumbers(Value=remap_numbers_4.Mapped, Source=remap_numbers_4.Mapped, Target=deconstruct_4.XComponent)  # -> Mapped, Clipped
feature_tensorset = FeatureTensorSet(
    Feature0=flatten(remap_numbers_9.Mapped),
    Feature1=flatten(remap_numbers_10.Mapped),
    Feature2=flatten(remap_numbers_11.Mapped),
    Feature3=flatten(remap_numbers_14.Mapped),
    Feature4=flatten(remap_numbers_13.Mapped),
    Feature5=flatten(remap_numbers_12.Mapped))
merge_7 = Merge(Data1=remap_numbers_4.Mapped, Data2=remap_numbers_5.Mapped, Data3=remap_numbers_7.Mapped, Data4=remap_numbers_6.Mapped)
feature_tensorset_2 = FeatureTensorSet(
    Feature0=cluster_3.i,
    Feature1=cluster_3.i_2,
    Feature2=cluster_3.i_3,
    Feature3=cluster_3.i_4,
    Feature4=cluster_3.i_5,
    Feature5=cluster_3.i_6)
number_slider_2 = Slider(4, range=0..10)
loop_end = LoopEnd(
    port=loop_start.port,
    Exit=False,
    Data=backprop.ActivationNetwork,
    Data_2=merge_6,
    TimeOutVal=0,
    pausedState=False,
    state="Constant output")  # -> D0, D1
panel_50 = Panel(feature_tensorset)
galapagos = Galapagos(fitness=num_2, gene=number_slider)
feature_tensorset_3 = FeatureTensorSet(
    Feature0=flatten(remap_numbers_4.Mapped),
    Feature1=flatten(remap_numbers_5.Mapped),
    Feature2=flatten(remap_numbers_7.Mapped),
    Feature3=flatten(remap_numbers_6.Mapped),
    Feature4=flatten(remap_numbers_8.Mapped))
panel_51 = Panel(feature_tensorset_2)
panel_52 = Panel(loop_end.D0)
_2dpreview = NetworkPreview(Network=backprop.ActivationNetwork, Lines=Domain(1, 5), Radius=5)
feature_tensorset_4 = FeatureTensorSet(
    Feature0=flatten(remap_numbers_18.Mapped),
    Feature1=flatten(remap_numbers_15.Mapped),
    Feature2=flatten(remap_numbers_16.Mapped),
    Feature3=flatten(remap_numbers_20.Mapped),
    Feature4=flatten(remap_numbers_19.Mapped),
    Feature5=flatten(remap_numbers_17.Mapped))
panel_53 = Panel(remap_numbers_18.Mapped)
merge_8 = Merge(Data1="5", Data2=number_slider_2, Data3="6")
network_2 = ConstructNetwork(Layers=merge_8, Activation=0, Alpha=Slider(2, range=0..5), Seed=123)
panel_54 = Panel("D:\Go Abroad\05 IaaC_Term 3\01 Software\02 Data Sets\0514\AN_result")
# Neural Network
panel_55 = Panel(network_2)
button = Button()
network_3 = SaveNetwork(ActivationNetwork=backprop.ActivationNetwork, FilePath=panel_54)
loop_start_2 = LoopStart(Repeat=Slider(500, range=0..1000), Trigger=Toggle(False), Data=network_2)  # -> port, Counter, Data, Data_2
backpropagation = Backpropagation(
    ActivationNetwork=loop_start_2.Data,
    Input=feature_tensorset_3,
    Output=feature_tensorset_4,
    LearningRate=0.01,
    Momentum=0.001,
    Epoch=10,
    Iterations=100)  # -> ActivationNetwork, Error
panel_56 = Panel("D:\Go Abroad\05 IaaC_Term 3\01 Software\02 Data Sets\0514\AN_result")
panel_57 = Panel(loop_start_2.Counter)
merge_9 = Merge(Data1=loop_start_2.Data_2, Data2=backpropagation.Error)
panel_58 = Panel(backpropagation.Error)
galapagos_2 = Galapagos(fitness=number, gene=number_slider_2)
number = Number(backpropagation.Error)
loop_end_2 = LoopEnd(
    port=loop_start_2.port,
    Exit=False,
    Data=backpropagation.ActivationNetwork,
    Data_2=merge_9,
    TimeOutVal=0,
    pausedState=False,
    state="Constant output")  # -> Data, D1
panel_59 = Panel(loop_end_2.Data)
panel_60 = Panel("D:\Arpan\Personal\IAAC\Practice\Gh\Studio data 18.05.21 - NN mapping\NN\1st-19.05.21\NN-studio-1st")
_2dpreview_2 = NetworkPreview(Network=backpropagation.ActivationNetwork, Lines=Domain(1, 5), Radius=5)
network_4 = SaveNetwork(ActivationNetwork=backpropagation.ActivationNetwork, FilePath=panel_60)
deconstruct_tensorset = DeconstructTensorSet(TensorSet=featurets)
network_5 = LoadNetwork(FilePath=panel_56)
deconstruct_tensorset_2 = DeconstructTensorSet(TensorSet=feature_tensorset_3)
merge_10 = Merge(Data1=graft_tree, Data2=graft_tree_2, Data3=graft_tree_5, Data4=graft_tree_3, Data5=graft_tree_4, Data6=graft_tree_6)
list_item_19 = ListItem(List=deconstruct_tensorset, Index=Slider(37, range=0..83), Wrap=True)
number_slider_3 = Slider(21, range=0..83)
construct_tensorset = ConstructTensorSet(Tensors=list_item_19)
list_item_20 = ListItem(List=merge_10, Index=number_slider_3, Wrap=True)
list_item_21 = ListItem(List=deconstruct_tensorset_2, Index=number_slider_3, Wrap=True)
compute = Compute(ActivationNetwork=network_5, Input=construct_tensorset)
panel_61 = Panel("D:\Arpan\Personal\IAAC\Practice\Gh\Studio data 18.05.21 - NN mapping\NN\1st-19.05.21\NN-studio-1st")
panel_62 = Panel(merge_10)
construct_tensorset_2 = ConstructTensorSet(Tensors=list_item_21)
network_6 = LoadNetwork(FilePath=panel_61)
detset = DeconstructTensorSet(TensorSet=compute)
tensorset_display = TensorSetDisplay(TensorSet=compute, Range=Domain(0, 1))
compute_2 = Compute(ActivationNetwork=network_6, Input=construct_tensorset_2)
detensor = DeconstructTensor(Tensor=detset)
tensorset_display_2 = TensorSetDisplay(TensorSet=compute_2, Range=Domain(0, 1))
panel_63 = Panel(detensor)
detset_2 = DeconstructTensorSet(TensorSet=compute_2)
panel_64 = Panel("-180 To 0")
panel_65 = Panel("-90 To 90")
detensor_2 = DeconstructTensor(Tensor=detset_2)
panel_70 = Panel(detensor_2)
list_item_22 = ListItem(List=panel_70, Index=0, Wrap=True)  # -> Item, Item1, Item2, Item3, Item4, Item5
remap_numbers_22 = RemapNumbers(Value=list_item_22.Item1, Source=Domain(0, 1), Target=bounds_8)  # -> Mapped, Clipped
list_item_23 = ListItem(List=detensor, Index=0, Wrap=True)  # -> Item, Item1, Item2, Item3, Item4, Item5
dom_3 = ConstructDomain(DomainStart="-360", DomainEnd="360")
remap_numbers_23 = RemapNumbers(Value=list_item_22.Item2, Source=Domain(0, 1), Target=bounds_14)  # -> Mapped, Clipped
remap_numbers_24 = RemapNumbers(Value=list_item_22.Item5, Source=Domain(0, 1), Target=bounds_15)  # -> Mapped, Clipped
remap_numbers_25 = RemapNumbers(Value=list_item_22.Item3, Source=Domain(0, 1), Target=bounds_12)  # -> Mapped, Clipped
remap_numbers_26 = RemapNumbers(Value=list_item_22.Item4, Source=Domain(0, 1), Target=bounds_13)  # -> Mapped, Clipped
remap_numbers_27 = RemapNumbers(Value=list_item_22.Item, Source=Domain(0, 1), Target=bounds_7)  # -> Mapped, Clipped
remap_14 = RemapNumbers(Value=list_item_23.Item, Source=Domain(0, 1), Target=bnd_6)  # -> Mapped, Clipped
remap_15 = RemapNumbers(Value=list_item_23.Item1, Source=Domain(0, 1), Target=bnd_5)  # -> Mapped, Clipped
remap_16 = RemapNumbers(Value=list_item_23.Item4, Source=Domain(0, 1), Target=bnd_2)  # -> Mapped, Clipped
remap_17 = RemapNumbers(Value=list_item_23.Item2, Source=Domain(0, 1), Target=bnd_4)  # -> Mapped, Clipped
remap_18 = RemapNumbers(Value=list_item_23.Item3, Source=Domain(0, 1), Target=bnd_3)  # -> Mapped, Clipped
remap_19 = RemapNumbers(Value=list_item_23.Item5, Source=Domain(0, 1), Target=bnd)  # -> Mapped, Clipped

list_5 = ValueList({"AA-KR60", "AA-KR30", "AA-KR60_KR30", "AARCH IRB120", "AARCH IRB6620", "AAU-Utzon-UR10", "Automata", "Bartlett-IRB120", "Bartlett-IRB1600", "Bartlett-KR6"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}, selected="KULeuven-UR10e")
wrist_2_2 = Slider(90, range=-90..90)
wrist_3_2 = Slider(0, range=-180..180)
base_2 = Slider(0, range=-90..90)
shoulder_3 = Slider(-90, range=-90..90)
elbow_3 = Slider(-90, range=-90..90)
wrist_1_2 = Slider(-90, range=-90..90)
xy_5 = XYPlane(Origin=Point(0, 0, 0))
load_robot_system_3 = LoadRobotSystem(Name=list_5, Base=xy_5)
merge_11 = Merge(Data1=base_2, Data2=reverse(shoulder_3), Data3=reverse(elbow_3), Data4=wrist_1_2, Data5=wrist_2_2, Data6=wrist_3_2)
degtorad_3 = DegreesToRadians(Degrees=merge_11, RobotSystem=load_robot_system_3, MechanicalGroup=0)

merge_12 = Merge(
    Data1=remap_14.Mapped,
    Data2=remap_15.Mapped,
    Data3=remap_17.Mapped,
    Data4=remap_18.Mapped,
    Data5=remap_16.Mapped,
    Data6=remap_19.Mapped)
panel_71 = Panel(remap_numbers_26.Mapped)
degtorad_4 = DegreesToRadians(Degrees=merge_12, RobotSystem=load_robot_system_3, MechanicalGroup=0)
tool_3 = ToolParameter(tool_2.Tool)
target_5 = CreateTarget(Joints=degtorad_4, Tool=tool_3, IsCartesian=False)
target_6 = CreateTarget(Joints=degtorad_3, Tool=tool_3, IsCartesian=False)
entwine_4 = Entwine(Branch00=target_6, Branch01=target_5, Branch02=target_6, FlattenInputs=True)  # -> flatten(Result)
program_3 = CreateProgram(Name="Studio", RobotSystem=load_robot_system_3, Targets1=flatten(entwine_4), StepSize=1)  # -> Program, Code, Duration, Warnings, Errors
panel_72 = Panel(program_3.Errors)
sim_3 = ProgramSimulation(Program=program_3.Program, Time=Slider(0.5, range=0..1), Normalized=True)  # -> SystemMeshes, JointRotations, Plane, Index, Time, Program, Errors

number_slider_4 = Slider(0, range=-90..90)
number_slider_5 = Slider(0, range=-90..90)
elbow_4 = Slider(0, range=-90..90)
number_slider_6 = Slider(0, range=-90..90)
number_slider_7 = Slider(0, range=-180..180)
point_6 = Point(<point referenced from the Rhino model>)
shoulder_4 = Slider(-90, range=-90..90)
list_6 = ValueList({"AA-KR60", "AA-KR30", "AA-KR60_KR30", "AARCH IRB120", "AARCH IRB6620", "AAU-Utzon-UR10", "Automata", "Bartlett-IRB120", "Bartlett-IRB1600", "Bartlett-KR6"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}, selected="KULeuven-UR10e")
mesh_5 = Mesh(<mesh referenced from the Rhino model>)
xy_6 = XYPlane(Origin=point_6)
xy_7 = XYPlane(Origin=Point(0, 0, 0))
load_robot_system_4 = LoadRobotSystem(Name=list_6, Base=xy_7)
merge_13 = Merge(
    Data1=remap_numbers_27.Mapped,
    Data2=remap_numbers_22.Mapped,
    Data3=remap_numbers_23.Mapped,
    Data4=remap_numbers_25.Mapped,
    Data5=remap_numbers_26.Mapped,
    Data6=remap_numbers_24.Mapped)
pflip_3 = FlipPlane(Plane=xy_6, ReverseX=False, ReverseY=False, SwapAxes=True)
tool_4 = CreateTool(Name="WnC_gripper", TCP=pflip_3, Weight=0, Mesh=mesh_5)  # -> Tool, TCP

degrees_7 = Degrees(Radians=merge_13)

degtorad_5 = DegreesToRadians(Degrees=degrees_7, RobotSystem=load_robot_system_4, MechanicalGroup=0)
target_7 = CreateTarget(Joints=degtorad_5, Tool=tool_4.Tool, IsCartesian=False)

merge_14 = Merge(Data1=flatten(target_7), Data3=flatten(target_7))
program_4 = CreateProgram(Name="Studio", RobotSystem=load_robot_system, Targets1=flatten(merge_14), StepSize=1)  # -> Program, Code, Duration, Warnings, Errors
panel_73 = Panel(program_4.Errors)
sim_4 = ProgramSimulation(Program=program_4.Program, Time=Slider(1, range=0..1), Normalized=True)  # -> SystemMeshes, JointRotations, Plane, Index, Time, Program, Errors

# ==== cluster Cluster
unit_z = UnitZ(Factor=1)
geometry = ClusterInput()
angle = ClusterInput()
center = ClusterInput()
rotate_3d = Rotate3D(Geometry=geometry, Angle=degrees(angle), Center=center, Axis=unit_z)  # -> Geometry, Transform
unit_y = UnitY(Factor=1)
angle_2 = ClusterInput()
center_2 = ClusterInput()
rotate_3d_2 = Rotate3D(Geometry=rotate_3d.Geometry, Angle=degrees(angle_2), Center=center_2, Axis=unit_y)  # -> Geometry, Transform
unit_x = UnitX(Factor=1)
angle_3 = ClusterInput()
center_3 = ClusterInput()
rotate_3d_3 = Rotate3D(Geometry=rotate_3d_2.Geometry, Angle=degrees(angle_3), Center=center_3, Axis=unit_x)  # -> Geometry, Transform
geometry_2 = ClusterOutput(rotate_3d_3.Geometry)

# ==== cluster Cluster_2
unit_z = UnitZ(Factor=1)
unit_y = UnitY(Factor=1)
geometry = ClusterInput()
angle = ClusterInput()
center = ClusterInput()
rotate_3d = Rotate3D(Geometry=geometry, Angle=degrees(angle), Center=center, Axis=unit_z)  # -> Geometry, Transform
unit_x = UnitX(Factor=1)
angle_2 = ClusterInput()
center_2 = ClusterInput()
rotate_3d_2 = Rotate3D(Geometry=rotate_3d.Geometry, Angle=degrees(angle_2), Center=center_2, Axis=unit_y)  # -> Geometry, Transform
angle_3 = ClusterInput()
center_3 = ClusterInput()
rotate_3d_3 = Rotate3D(Geometry=rotate_3d_2.Geometry, Angle=degrees(angle_3), Center=center_3, Axis=unit_x)  # -> Geometry, Transform
geometry_2 = ClusterOutput(rotate_3d_3.Geometry)

# ==== cluster Cluster_3
ghpython_script = GhPythonScript()  # -> out, a
# ---------- ghpython_script: Python ----------
__author__ = "Arpan"
__version__ = "2021.05.19"

import rhinoscriptsyntax as rs

y = range(0,504)
#print(y)
x = 0

while x in y:
    print(x)
    x += 6
# ---------- end ghpython_script ----------
ghpython_script_2 = GhPythonScript()  # -> out, a
# ---------- ghpython_script_2: Python ----------
__author__ = "Arpan"
__version__ = "2021.05.19"

import rhinoscriptsyntax as rs

y = range(0,504)
#print(y)
x = 1

while x in y:
    print(x)
    x += 6
# ---------- end ghpython_script_2 ----------
ghpython_script_3 = GhPythonScript()  # -> out, a
# ---------- ghpython_script_3: Python ----------
__author__ = "Arpan"
__version__ = "2021.05.19"

import rhinoscriptsyntax as rs

y = range(0,504)
#print(y)
x = 2

while x in y:
    print(x)
    x += 6
# ---------- end ghpython_script_3 ----------
ghpython_script_4 = GhPythonScript()  # -> out, a
# ---------- ghpython_script_4: Python ----------
__author__ = "Arpan"
__version__ = "2021.05.19"

import rhinoscriptsyntax as rs

y = range(0,504)
#print(y)
x = 3

while x in y:
    print(x)
    x += 6
# ---------- end ghpython_script_4 ----------
ghpython_script_5 = GhPythonScript()  # -> out, a
# ---------- ghpython_script_5: Python ----------
__author__ = "Arpan"
__version__ = "2021.05.19"

import rhinoscriptsyntax as rs

y = range(0,504)
#print(y)
x = 4

while x in y:
    print(x)
    x += 6
# ---------- end ghpython_script_5 ----------
ghpython_script_6 = GhPythonScript()  # -> out, a
# ---------- ghpython_script_6: Python ----------
__author__ = "Arpan"
__version__ = "2021.05.19"

import rhinoscriptsyntax as rs

y = range(0,504)
#print(y)
x = 5

while x in y:
    print(x)
    x += 6
# ---------- end ghpython_script_6 ----------
list = ClusterInput()
list_2 = ClusterInput()
list_3 = ClusterInput()
list_4 = ClusterInput()
list_5 = ClusterInput()
list_6 = ClusterInput()
list_item = ListItem(List=list, Index=ghpython_script.out, Wrap=True)
list_item_2 = ListItem(List=list_2, Index=ghpython_script_2.out, Wrap=True)
list_item_3 = ListItem(List=list_3, Index=ghpython_script_3.out, Wrap=True)
list_item_4 = ListItem(List=list_4, Index=ghpython_script_4.out, Wrap=True)
list_item_5 = ListItem(List=list_5, Index=ghpython_script_5.out, Wrap=True)
list_item_6 = ListItem(List=list_6, Index=ghpython_script_6.out, Wrap=True)
i = ClusterOutput(list_item)
i_2 = ClusterOutput(list_item_2)
i_3 = ClusterOutput(list_item_3)
i_4 = ClusterOutput(list_item_4)
i_5 = ClusterOutput(list_item_5)
i_6 = ClusterOutput(list_item_6)

# ==== cluster Cluster_4
ghpython_script = GhPythonScript()  # -> out, a
# ---------- ghpython_script: Python ----------
__author__ = "Arpan"
__version__ = "2021.05.19"

import rhinoscriptsyntax as rs

y = range(0,252)
#print(y)
x = 1

while x in y:
    print(x)
    x += 3
# ---------- end ghpython_script ----------
ghpython_script_2 = GhPythonScript()  # -> out, a
# ---------- ghpython_script_2: Python ----------
__author__ = "Arpan"
__version__ = "2021.05.19"

import rhinoscriptsyntax as rs

y = range(0,252)
#print(y)
x = 0

while x in y:
    print(x)
    x += 3
# ---------- end ghpython_script_2 ----------
ghpython_script_3 = GhPythonScript()  # -> out, a
# ---------- ghpython_script_3: Python ----------
__author__ = "Arpan"
__version__ = "2021.05.19"

import rhinoscriptsyntax as rs

y = range(0,252)
#print(y)
x = 2

while x in y:
    print(x)
    x += 3
# ---------- end ghpython_script_3 ----------
list = ClusterInput()
list_2 = ClusterInput()
list_3 = ClusterInput()
list_item = ListItem(List=list, Index=ghpython_script_2.out, Wrap=True)
list_item_2 = ListItem(List=list_2, Index=ghpython_script.out, Wrap=True)
list_item_3 = ListItem(List=list_3, Index=ghpython_script_3.out, Wrap=True)
i = ClusterOutput(list_item)
i_2 = ClusterOutput(list_item_2)
i_3 = ClusterOutput(list_item_3)

# ==== cluster Craftsman
unit_z = UnitZ(Factor=1)
geometry = ClusterInput()
yaw = ClusterInput()
center = ClusterInput()
rotate_3d = Rotate3D(Geometry=geometry, Angle=degrees(yaw), Center=center, Axis=unit_z)  # -> Geometry, Transform
unit_y = UnitY(Factor=1)
pitch = ClusterInput()
rotate_3d_2 = Rotate3D(Geometry=rotate_3d.Geometry, Angle=degrees(pitch), Center=center, Axis=unit_y)  # -> Geometry, Transform
unit_x = UnitX(Factor=1)
roll = ClusterInput()
rotate_3d_3 = Rotate3D(Geometry=rotate_3d_2.Geometry, Angle=degrees(roll), Center=center, Axis=unit_x)  # -> Geometry, Transform
geometry_2 = ClusterOutput(rotate_3d_3.Geometry)
